# Grasshopper definition FinalFinal[0].gh (Grasshopper 1.0.7)
# plug-ins: FloorsAndVolumes, Centipede, horsterCameraControl, MetaHopper, TT Toolbox

# ---- group: ModifyGenePools / NumberOfTowers
numberoftowers = Slider(2, range=1..3)  # disabled

# ---- group: Platform / TamañoPlanta
number_slider = Slider(37.442, range=0..100)
number_slider_2 = Slider(7.676, range=0..100)

# ----
number_slider_3 = Slider(0.2, range=0..1)

# ---- group: Edificios
number_slider_4 = Slider(0.807, range=0..1)
number_slider_5 = Slider(1, range=0..1)
number_slider_6 = Slider(1, range=0..1)
expression = Expression(x=number_slider_3, Expression="If( x = 0, False, True )")
colour_rgb_f = ColourRGBF(Alpha=number_slider_3, Red=number_slider_4, Green=number_slider_4, Blue=number_slider_4)
get_object_by_nickname = GetObjectByNickname(NickName="CustomEdificios")
mesh = Mesh([<mesh referenced from the Rhino model> x1311])
customedificios = CustomPreview(CustomMaterial=mesh, Material=colour_rgb_f)
enable_disable_object = EnableDisableObject(Objects=get_object_by_nickname, Enabled=expression, AllObjects_Object=customedificios)

# ---- group: Platform / NumeroDePisosAlturaEntreFinoYFino
number_slider_7 = Slider(3, range=0..10)
number_slider_8 = Slider(5.797, range=0..10)

# ----
number_slider_9 = Slider(0.4997, range=0..1)  # disabled
pt = Point()  # disabled
curve = Curve([<curve referenced from the Rhino model> x2])
join_curves = JoinCurves(Curves=curve, Preserve=False)
curve_2 = Curve(<curve referenced from the Rhino model>)

# ---- group: Animation
number_slider_10 = Slider(2400, range=0..2400)
number_slider_11 = Slider(1600, range=0..10000)
number_slider_12 = Slider(1200, range=0..1200)
number_slider_13 = Slider(754, range=0..1000)
number_slider_14 = Slider(375, range=0..500)
number_slider_15 = Slider(2000, range=0..10000)
number_slider_16 = Slider(1, range=0..1)
number_slider_17 = Slider(0, range=0..1)
number_slider_18 = Slider(0.448, range=0..1)
centipede = Centipede(
    Double=number_slider_17,
    Double_2=number_slider_16,
    Integer=Slider(0, range=0..100),
    Integer_2=number_slider_14,
    Integer_3=number_slider_10)
centipede_2 = Centipede(
    Double=number_slider_17,
    Double_2=number_slider_18,
    Integer=number_slider_13,
    Integer_2=number_slider_12,
    Integer_3=number_slider_10)
centipede_3 = Centipede(
    Double=number_slider_17,
    Double_2=number_slider_16,
    Integer=number_slider_14,
    Integer_2=number_slider_13,
    Integer_3=number_slider_10)
centipede_4 = Centipede(
    Double=number_slider_17,
    Double_2=number_slider_18,
    Integer=number_slider_11,
    Integer_2=number_slider_15,
    Integer_3=number_slider_10)
centipede_5 = Centipede(
    Double=number_slider_17,
    Double_2=number_slider_18,
    Integer=number_slider_12,
    Integer_2=number_slider_11,
    Integer_3=number_slider_10)
boolean_toggle = BooleanToggle(False)  # disabled
get_camera = GetCamera(GetCamera=boolean_toggle)  # -> Location, Target, LensLength, UpDirection; disabled
point = Point(Point(-398.0973697, 162.8016651, 65.14088964))
point_2 = Point(Point(-370.948061, 373.8819851, 81.53191157))
point_3 = Point(Point(-168.646359, 496.4721814, 84.17550522))
point_4 = Point(Point(-169.3749009, -82.11620509, 195.5540842))
point_5 = Point(Point(-396.4990699, 64.91942677, 209.3986668))
point_6 = Point(Point(-407.1996286, 147.1574345, 230.8522818))
point_7 = Point(Point(-396.288621, 202.5476923, 241.048847))
point_8 = Point(Point(-239.2511343, -77.01564917, 215.4740685))
point_9 = Point(Point(-305.1733387, 302.4615101, 273.3192179))
point_10 = Point(Point(-176.9013778, 425.7908603, 226.6067334))
point_11 = Point(Point(-471.0277421, 176.8444394, 90.20043466))
point_12 = Point(Point(-191.0065835, 111.6092916, 47.99413552))
point_13 = Point(Point(-277.7968026, 168.9915439, 29.78233403))
point_14 = Point(Point(-246.0066201, 189.2318598, 38.39411235))
point_15 = Point(Point(-268.2799443, 169.9085453, 53.8163559))
point_16 = Point(Point(-85.49145157, 97.7991856, 46.6232992))
point_17 = Point(Point(-244.4213956, 189.0498896, 39.00514006))
point_18 = Point(Point(-242.3450216, 175.5005526, 32.98647487))
point_19 = Point(Point(-240.8028423, 171.5906576, 33.80395119))
point_20 = Point(Point(-263.3484405, 152.1903207, 24.47562387))
point_21 = Point(Point(-247.7008788, 178.0114795, 37.17734643))
point_22 = Point(Point(-157.2318917, 115.0153497, 90.09331923))
point_23 = Point(reverse([point_11, point, point_2, point_3, point_4, point_8, point_5, point_6, point_7, point_9, point_10]))
boolean_toggle_2 = BooleanToggle(False)  # disabled
point_24 = Point(reverse([point_22, point_16, point_12, point_17, point_13, point_14, point_18, point_19, point_20, point_15, point_21]))
interpolate = Interpolate(Vertices=point_23, Degree=3, Periodic=False, KnotStyle=1)  # -> Curve, Length, Domain
interpolate_2 = Interpolate(Vertices=point_24, Degree=3, Periodic=False, KnotStyle=1)  # -> Curve, Length, Domain
number_slider_19 = Slider(2400, range=0..2400)
centipede_6 = Centipede(
    Double=number_slider_17,
    Double_2=number_slider_16,
    Integer=number_slider_15,
    Integer_2=number_slider_19,
    Integer_3=number_slider_10)
divide_curve = DivideCurve(Curve=interpolate.Curve, Count=number_slider_19, Kinks=False, UseTasks=False)  # -> Points, Tangents, Parameters
divide_curve_2 = DivideCurve(Curve=interpolate_2.Curve, Count=number_slider_19, Kinks=False, UseTasks=False)  # -> Points, Tangents, Parameters
number_slider_20 = Slider(24.323, range=0..500)
set_camera = SetCamera(CameraLocation=point_9, TargetLocation=point_15, LensLength=number_slider_20, Activate=boolean_toggle_2)  # disabled
list_item = ListItem(List=divide_curve_2.Points, Index=number_slider_10, Wrap=True)
list_item_2 = ListItem(List=divide_curve.Points, Index=number_slider_10, Wrap=True)
set_camera_2 = SetCamera(CameraLocation=list_item_2, TargetLocation=list_item, LensLength=number_slider_20, Activate=Toggle(True))

# ---- group: Platform
dom = ConstructDomain(DomainStart=expr("-x", number_slider), DomainEnd=number_slider)
dom_2 = ConstructDomain(DomainStart=expr("-x", number_slider_2), DomainEnd=number_slider_2)
srf = Surface(<surface referenced from the Rhino model>)
reparametrizecurve = ReparametrizeCurve(curve=srf, domain_start_2=dom, domain_end_2=dom, domain_start=dom_2, domain_end=dom_2)  # -> plane, domain_2, domain
unit_z = UnitZ(Factor=Slider(0.1, range=0..1))
colour_rgb_f_2 = ColourRGBF(Alpha=centipede_3, Red=Slider(1, range=0..1), Green=Slider(0.462, range=0..1), Blue=Slider(0.729, range=0..1))
rectangle = Rectangle(Plane=reparametrizecurve.plane, XSize=reparametrizecurve.domain_2, YSize=reparametrizecurve.domain, Radius=0)  # -> Rectangle, Length
move = Move(Geometry=srf, Motion=unit_z)  # -> Geometry, Transform
expression_2 = Expression(x=centipede_3, Expression="If( x = 0, False, True )")
customagora = CustomPreview(CustomMaterial=move.Geometry, Material=colour_rgb_f_2)
srf_2 = Surface(<surface referenced from the Rhino model>)
get_object_by_nickname_2 = GetObjectByNickname(NickName="CustomAgora")
number_slider_21 = Slider(1, range=0..1)
sint = SolidIntersection(BrepsA=rectangle.Rectangle, BrepsB=srf_2)
enable_disable_object_2 = EnableDisableObject(Objects=get_object_by_nickname_2, Enabled=expression_2, AllObjects_Object=customagora)
item = ListItem(List=sint, Index=number_slider_21, Wrap=True)
subtraction = Subtraction(A=number_slider_7, B=1)
series = Series(Start=0, Step=number_slider_8, Count=number_slider_7)
multiplication = Multiplication(A=number_slider_8, B=subtraction)
Z = UnitZ(Factor=series)
move_2 = Move(Geometry=item, Motion=Z)  # -> Geometry, Transform
Z_2 = UnitZ(Factor=multiplication)
lng = ListLength(List=move_2.Geometry)
srf_3 = Surface(move_2.Geometry)
cull_i = CullIndex(List=move_2.Geometry, Indices=expr("x-1", lng), Wrap=True)
area = Area(Geometry=cull_i, UseTasks=False)  # -> Area, Centroid
loft = Loft(Curves=move_2.Geometry, Options={Adjust=False, Closed=False, LoftEnds=0, LoftSimp=0, LoftType=0, Rebuild=10, Refit=0.01})
ma = MassAddition(Input=flatten(area.Area))  # -> Result, PartialResults
area_2 = Area(Geometry=move_2.Geometry, UseTasks=False)  # -> Area, Centroid
item_2 = ListItem(List=area_2.Area, Index=0, Wrap=True)  # -> Item, Item1
ma_2 = MassAddition(Input=flatten([item_2.Item, item_2.Item1]))  # -> Result, PartialResults
cap = CapHoles(Brep=loft)
expression_3 = Expression(x=centipede_2, Expression="If( x = 0, False, True )")
get_object_by_nickname_3 = GetObjectByNickname(NickName="PreviewPlatform")
enable_disable_object_3 = EnableDisableObject(Objects=get_object_by_nickname_3, Enabled=expression_3, AllObjects_Object=previewplatform)
number_slider_22 = Slider(1, range=0..1)
number_slider_23 = Slider(0, range=0..1)
number_slider_24 = Slider(0, range=0..1)
frgb = ColourRGBF(Alpha=Slider(0.191, range=0..1), Red=number_slider_22, Green=number_slider_24, Blue=number_slider_23)
frgb_2 = ColourRGBF(Alpha=centipede_2, Red=number_slider_22, Green=number_slider_24, Blue=number_slider_23)
unit_z_2 = UnitZ(Factor=Slider(0.01, range=0..0.01))
move_3 = Move(Geometry=cap, Motion=unit_z_2)  # -> Geometry, Transform
panel = Panel(ma_2.Result)
preview = CustomPreview(Geometry=srf_3, Material=frgb)
previewplatform = CustomPreview(Geometry=move_3.Geometry, Material=frgb_2)

# ---- group: Lote
expression_4 = Expression(x=centipede, Expression="If( x = 0, False, True )")
colour_rgb_f_3 = ColourRGBF(Alpha=centipede, Red=Slider(0.215, range=0..1), Green=Slider(0.682, range=0..1), Blue=Slider(0.78, range=0..1))
get_object_by_nickname_4 = GetObjectByNickname(NickName="CustomLote")
surface = Surface(<surface referenced from the Rhino model>)
customlote = CustomPreview(CustomMaterial=surface, Material=colour_rgb_f_3)
enable_disable_object_4 = EnableDisableObject(Objects=get_object_by_nickname_4, Enabled=expression_4, AllObjects_Object=customlote)

# ---- group: Commercial
number_slider_25 = Slider(6, range=0..10)
series_2 = Series(Start=Z_2, Step=number_slider_25, Count=Slider(5, range=4..8))
Z_3 = UnitZ(Factor=series_2)

number_slider_26 = Slider(6, range=0..10)
number_slider_27 = Slider(7, range=4..8)
series_3 = Series(Start=Z_2, Step=number_slider_26, Count=number_slider_27)
Z_4 = UnitZ(Factor=series_3)

# ---- group: Commercial / Floors
number_slider_28 = Slider(0.5, range=0..1)
pt_2 = ConstructPoint(XCoordinate=number_slider_28, YCoordinate=number_slider_28, ZCoordinate=0)
move_4 = Move(Geometry=join_curves, Motion=Z_4)  # -> simplify(Geometry), Transform
c_script = CSharpScript(x=move_4.Geometry)  # -> A; inputs x: tree of Polyline
# ---------- c_script: C# ----------
    var treeOut = new DataTree<Polyline>();

    for( int i = 0; i < 1; ++i )
      for( int j = 0; j < x.Branch(i).Count; ++j )
      {

        treeOut.Add(x.Branch(i)[j], new GH_Path(i));

      }

    A = treeOut;
# ---------- end c_script ----------
evalsrf = EvaluateSurface(Surface=reparameterize(c_script), Point=pt_2)  # -> Point, Normal, UDirection, VDirection, Frame
runion = RegionUnion(Curves=flatten(move_4.Geometry), Plane=flatten(evalsrf.Point))  # -> simplify(Result)
frgb_3 = ColourRGBF(Alpha=Slider(1, range=0..1), Red=Slider(1, range=0..1), Green=Slider(1, range=0..1), Blue=Slider(0, range=0..1))
srf_4 = Surface(runion)
preview_2 = CustomPreview(Geometry=srf_4, Material=frgb_3)

# ---- group: Commercial / Volume
flip = FlipMatrix(Data=runion)
lng_2 = ListLength(List=flip)
item_3 = ListItem(List=flip, Index=expr("x-1", lng_2), Wrap=True)
Z_5 = UnitZ(Factor=number_slider_26)
expression_5 = Expression(x=centipede_5, Expression="If( x = 0, False, True )")
move_5 = Move(Geometry=item_3, Motion=Z_5)  # -> Geometry, Transform
loft_2 = Loft(
    Curves=[flip, move_5.Geometry],
    Options={Adjust=False, Closed=False, LoftEnds=0, LoftSimp=0, LoftType=0, Rebuild=10, Refit=0.01})
cap_2 = CapHoles(Brep=loft_2)
get_object_by_nickname_5 = GetObjectByNickname(NickName="PreviewOffice")
enable_disable_object_5 = EnableDisableObject(Objects=get_object_by_nickname_5, Enabled=expression_5, AllObjects_Object=[previewoffice, previewoffice_2])
frgb_4 = ColourRGBF(Alpha=centipede_5, Red=Slider(1, range=0..1), Green=Slider(0.587, range=0..1), Blue=Slider(0, range=0..1))
previewoffice = CustomPreview(Geometry=cap_2, Material=frgb_4)

# ---- group: IndiceDeOcupacionCaso1
area_3 = Area(Geometry=curve_2, UseTasks=False)  # -> Area, Centroid
item_4 = ListItem(List=sint, Index=number_slider_21, Wrap=True)
area_4 = Area(Geometry=item_4, UseTasks=False)  # -> Area, Centroid
addition = Addition(A="11395.83", B=area_4.Area)
division = Division(A=addition, B=area_3.Area)
panel_2 = Panel(division)
multiplication_2 = Multiplication(A=division, B=100)
panel_3 = Panel(multiplication_2)

# ----
expression_6 = Expression(x=centipede_4, Expression="If( x = 0, False, True )")
get_object_by_nickname_6 = GetObjectByNickname(NickName="PreviewBuildingsTwo")
hide_show_object_preview = HideShowObjectPreview(Objects=get_object_by_nickname_6, Visible=expression_6)
addition_2 = Addition(A=ma_2.Result)
number_slider_29 = Slider(12000, range=0..100000)
number_slider_30 = Slider(118000, range=0..1000000)
addition_3 = Addition()
galapagos = Galapagos(fitness=ma_7, gene=[genelist_e, number_slider_31, genelist_f, genelist_h, genelist_g])

# ---- group: WhereToPlaceRectangles
crv = Curve(<curve referenced from the Rhino model>)
crv_2 = Curve(<curve referenced from the Rhino model>)
crv_3 = Curve(<curve referenced from the Rhino model>)
number_slider_31 = Slider(2, range=0..10)
crv_4 = Curve([crv, crv_2, crv_3])
shift = ShiftList(List=crv_4, Shift=number_slider_31, Wrap=True)
genelist_f = GenePool(Decimals=0, Maximum=1825, Minimum=0, Value=[887, 912.5])  # disabled
crv_5 = Curve(flatten(shift))
number_slider_32 = Slider(50, range=0..100)
runion_2 = RegionUnion(Curves=crv_5)
srf_5 = Surface(runion_2)  # disabled
sdivide = DivideSurface(Surface=srf_5, UCount=number_slider_32, VCount=number_slider_32)  # -> Points, Normals, Parameters; disabled
disc = Discontinuity(Curve=runion_2, Level=1)  # -> Points, Parameters; disabled
null = NullItem(Item=sdivide.Points)  # -> NullFlags, InvalidFlags, Description; disabled
cull = CullPattern(List=sdivide.Points, CullPattern=invert(null.NullFlags))  # disabled
item_5 = ListItem(List=disc.Points, Index=0, Wrap=True)  # -> Item, Item1, Item2; disabled
item_6 = ListItem(List=flatten(cull), Index=genelist_f, Wrap=True)  # disabled
vec2pt = Vector2Pt(PointA=item_5.Item, PointB=item_5.Item1, Unitize=False)  # -> Vector, Length; disabled
vec2pt_2 = Vector2Pt(PointA=item_5.Item1, PointB=item_5.Item2, Unitize=False)  # -> Vector, Length; disabled
Z_6 = UnitZ(Factor=1)
xprod = CrossProduct(VectorA=vec2pt.Vector, VectorB=Z_6, Unitize=False)  # -> expr("-x", Vector), Length; disabled

# ---- group: ModifyGenePools
number_slider_33 = Slider(0.5, range=0..1)  # disabled
number_slider_34 = Slider(1, range=0..40)  # disabled
number_slider_35 = Slider(40, range=0..40)  # disabled
number_slider_36 = Slider(40, range=0..40)  # disabled
number_slider_37 = Slider(0, range=0..100)  # disabled
number_slider_38 = Slider(10, range=0..100)  # disabled
number_slider_39 = Slider(10, range=0..100)  # disabled
lng_3 = ListLength(List=flatten(cull))  # disabled
panel_4 = Panel("GeneList G")  # disabled
panel_5 = Panel("GeneList H")  # disabled
panel_6 = Panel("GeneList D")  # disabled
panel_7 = Panel("GeneList E")  # disabled
panel_8 = Panel("GeneList F")  # disabled
panel_9 = Panel("GeneList C")  # disabled
dom_3 = ConstructDomain(DomainStart=number_slider_33, DomainEnd=number_slider_34)  # disabled
dom_4 = ConstructDomain(DomainStart=number_slider_33, DomainEnd=number_slider_34)  # disabled
dom_5 = ConstructDomain(DomainStart=number_slider_38, DomainEnd=number_slider_35)  # disabled
dom_6 = ConstructDomain(DomainStart=number_slider_39, DomainEnd=number_slider_36)  # disabled
dom_7 = ConstructDomain(DomainStart=number_slider_37, DomainEnd=lng_3)  # disabled
genemodifier = GenePoolModifier(GeneList=panel_4, Count=numberoftowers, Domain=dom_3)  # disabled
genemodifier_2 = GenePoolModifier(GeneList=panel_5, Count=numberoftowers, Domain=dom_4)  # disabled
genemodifier_3 = GenePoolModifier(GeneList=panel_9, Count=numberoftowers, Domain=dom_5)  # disabled
genemodifier_4 = GenePoolModifier(GeneList=panel_6, Count=numberoftowers, Domain=dom_5)  # disabled
genemodifier_5 = GenePoolModifier(GeneList=panel_7, Count=numberoftowers, Domain=dom_6)  # disabled
genemodifier_6 = GenePoolModifier(GeneList=panel_8, Count=numberoftowers, Domain=dom_7)  # disabled

# ----
graft = GraftTree(Tree=item_6, IncludeEmptyLists=True, IncludeNullItems=True)  # disabled

# ---- group: WhereToPlaceRectangles (continued)
pl = ConstructPlane(Origin=graft, XAxis=vec2pt.Vector, YAxis=vec2pt_2.Vector)  # -> simplify(Plane); disabled

# ----
c_script_2 = CSharpScript(points=pt, vector=vec2pt.Vector, percentage=number_slider_9)  # -> rectangles; inputs points: list of Point3d, vector: Vector3d, percentage: Double; disabled
# ---------- c_script_2: C# ----------
    Point3d pointOne = points[0];
    Point3d pointTwo = points[1];

    Rhino.Geometry.Point p = new Point(pointOne);
    p.Translate(-vector);

    Point3d pointTranslate = p.Location;

    NurbsCurve curve = new Line(pointTwo, pointTranslate).ToNurbsCurve();
    double t = 0.0;
    curve.ClosestPoint(pointOne, out t);
    Point3d pt = curve.PointAt(t);

    double total = 1.0 - percentage;

    double distance = pt.DistanceTo(pointTwo);
    double distanceOne = distance * percentage;
    double distanceTwo = distance * total;

    Interval[] inter = new Interval[2];

    inter[0] = new Interval(-distanceOne, distanceOne);
    inter[1] = new Interval(-distanceTwo, distanceTwo);

    rectangles = inter;
# ---------- end c_script_2 ----------

# ---- group: Rectangles / y
vector = Vector(expr("x*10.0", vec2pt.Vector))  # disabled
vector_2 = Vector(expr("-x", vector))  # disabled

# ---- group: Rectangles / x
vector_3 = Vector(expr("x*10.0", vec2pt_2.Vector))  # disabled
vector_4 = Vector(expr("-x", vector_3))  # disabled

# ---- group: Rectangles
pln = Plane(pl)  # disabled
number_slider_40 = Slider(1000, range=0..1000)  # disabled
item_7 = ListItem(List=pln, Index=0, Wrap=True)  # -> Item, Item1, Item2; disabled
pt_3 = Point(pln)  # disabled
deconstruct = Deconstruct(Point=pt_3)  # -> XComponent, YComponent, ZComponent; disabled
addition_4 = Addition(A=deconstruct.YComponent, B=number_slider_40)  # disabled
sort_list = SortList(Keys=addition_4, ValuesValuesA=pt_3)  # -> Keys, ValuesValuesA; disabled
vector_5 = Vector(expr("-x", [vec2pt.Vector, xprod.Vector]))  # disabled
vector_6 = Vector([vec2pt.Vector, xprod.Vector])  # disabled
item_8 = ListItem(List=sort_list.ValuesValuesA, Index=0, Wrap=True)  # -> Item, Item1, Item2; disabled
vector_7 = Vector([vector_3, vector_4, vector, vector_2])  # disabled
pt_4 = Point(pln)  # disabled
curve_3 = Curve(runion_2)  # disabled
move_6 = Move(Geometry=pt_4, Motion=vector_7)  # -> Geometry, Transform; disabled
explode_tree = ExplodeTree(Data=pt_4)  # -> Branch0, Branch1, Branch2; disabled
brep_wireframe = BrepWireframe(Brep=curve_3, Density=-1)  # disabled
surface_2 = Surface(curve_3)  # disabled
number_slider_41 = Slider(6, range=0..10)  # disabled
number_slider_42 = Slider(7, range=0..10)  # disabled
point_25 = Point(explode_tree.Branch0)  # disabled
curve_closest_point = CurveClosestPoint(Point=pt_3, Curve=curve_3)  # -> flatten(Point), Parameter, Distance; disabled
curve_closest_point_2 = CurveClosestPoint(Point=pt_3, Curve=curve_3)  # -> flatten(Point), Parameter, Distance; disabled
list_item_3 = ListItem(List=brep_wireframe, Index=number_slider_42, Wrap=True)  # -> Item, Item1; disabled
list_item_4 = ListItem(List=brep_wireframe, Index=number_slider_41, Wrap=True)  # disabled
list_item_5 = ListItem(List=move_6.Geometry, Index=0, Wrap=True)  # -> Item, Item1, Item2, Item3; disabled
join_curves_2 = JoinCurves(Curves=[list_item_3.Item, list_item_3.Item1], Preserve=False)  # disabled
c_script_3 = CSharpScript(pointOne=item_8.Item, pointTwo=item_8.Item1)  # -> pointOut; inputs pointOne: Point3d, pointTwo: Point3d; disabled
# ---------- c_script_3: C# ----------
    double slope = gradient(pointOne, pointTwo);

    Point3d point = new Point3d();

    if( slope <= 0.0 )
    {

      point.X = Math.Max(pointOne.X, pointTwo.X);
      point.Y = Math.Max(pointOne.Y, pointTwo.Y);

    }

    else
    {

      point.X = Math.Min(pointOne.X, pointTwo.X);
      point.Y = Math.Max(pointOne.Y, pointTwo.Y);

    }

    pointOut = point;
# ---------- c_script_3: C# additional code ----------
  private double gradient(Point3d pointOne, Point3d pointTwo)
  {

    double y = pointTwo.Y - pointOne.Y;
    double x = pointTwo.X - pointOne.X;

    return y / x;

  }
# ---------- end c_script_3 ----------
c_script_4 = CSharpScript(pointOne=item_8.Item1, pointTwo=item_8.Item2)  # -> pointOut; inputs pointOne: Point3d, pointTwo: Point3d; disabled; same code as c_script_3
line = Line(StartPoint=[list_item_5.Item, list_item_5.Item2], EndPoint=[list_item_5.Item1, list_item_5.Item3])  # disabled
curve_closest_point_3 = CurveClosestPoint(Point=flatten(pt_3), Curve=join_curves_2)  # -> flatten(Point), Parameter, Distance; disabled
deconstruct_2 = Deconstruct(Point=curve_closest_point_3.Point)  # -> XComponent, YComponent, ZComponent; disabled
curve_closest_point_4 = CurveClosestPoint(Point=flatten(pt_3), Curve=list_item_4)  # -> flatten(Point), Parameter, Distance; disabled
deconstruct_3 = Deconstruct(Point=curve_closest_point_4.Point)  # -> XComponent, YComponent, ZComponent; disabled
sort_list_2 = SortList(Keys=deconstruct_2.XComponent, ValuesValuesA=curve_closest_point_3.Point)  # -> Keys, ValuesValuesA; disabled
sort_list_3 = SortList(Keys=deconstruct_3.YComponent, ValuesValuesA=curve_closest_point_4.Point)  # -> Keys, ValuesValuesA; disabled
curve_curve = CurveCurve(CurveA=line, CurveB=runion_2)  # -> Points, ParamsA, ParamsB; disabled
shift_list = ShiftList(List=curve_closest_point_4.Point, Shift=1, Wrap=True)  # disabled
list_item_6 = ListItem(List=sort_list_2.ValuesValuesA, Index=0, Wrap=True)  # -> Item, Item1, Item2; disabled
list_item_7 = ListItem(List=sort_list_3.ValuesValuesA, Index=0, Wrap=True)  # -> Item, Item1, Item2; disabled
vector_2pt = Vector2Pt(PointA=curve_closest_point_4.Point, PointB=shift_list, Unitize=False)  # -> Vector, Length; disabled
distance = Distance(PointA=item_8.Item, PointB=c_script_3)  # disabled
distance_2 = Distance(PointA=item_8.Item1, PointB=c_script_4)  # disabled
list_item_8 = ListItem(List=curve_curve.Points, Index=0, Wrap=True)  # -> Item, Item1; disabled
line_2 = Line(StartPoint=list_item_6.Item1, EndPoint=list_item_6.Item2)  # disabled
line_3 = Line(StartPoint=list_item_7.Item1, EndPoint=list_item_7.Item2)  # disabled
distance_3 = Distance(PointA=list_item_6.Item, PointB=list_item_6.Item1)  # disabled
line_4 = Line(StartPoint=list_item_6.Item, EndPoint=list_item_6.Item1)  # disabled
distance_4 = Distance(PointA=list_item_7.Item, PointB=list_item_7.Item1)  # disabled
distance_5 = Distance(PointA=list_item_6.Item1, PointB=list_item_6.Item2)  # disabled
distance_6 = Distance(PointA=list_item_7.Item1, PointB=list_item_7.Item2)  # disabled
line_5 = Line(StartPoint=list_item_7.Item, EndPoint=list_item_7.Item1)  # disabled
number_slider_43 = Slider(24.676, range=0..30)  # disabled
number_slider_44 = Slider(0.6, range=0..1)  # disabled
number_slider_45 = Slider(1, range=0..1.4)  # disabled
number = Number([distance_4, distance_6])  # disabled
number_slider_46 = Slider(0.7, range=0..1)  # disabled
number_slider_47 = Slider(0.4, range=0..1)  # disabled
number_slider_48 = Slider(1, range=0..2)  # disabled
line_6 = Line(StartPoint=list_item_8.Item, EndPoint=list_item_8.Item1)  # -> simplify(Line); disabled
number_slider_49 = Slider(0.3, range=0..1)  # disabled
dom_8 = ConstructDomain(DomainStart=expr("-x", number_slider_43), DomainEnd=number_slider_43)  # disabled
number_slider_50 = Slider(1, range=0..2)  # disabled
subtraction_2 = Subtraction(A=number_slider_45, B=number_slider_44)  # disabled
golden_ratio = GoldenRatio(Factor=1)  # disabled
plane = Plane(pln)  # disabled
golden_ratio_2 = GoldenRatio(Factor=1)  # disabled
subtraction_3 = Subtraction(A=number_slider_48, B=number_slider_47)  # disabled
subtraction_4 = Subtraction(A=number_slider_48, B=number_slider_49)  # disabled
multiplication_3 = Multiplication(A=distance_2, B=number_slider_46)  # disabled
multiplication_4 = Multiplication(A=distance, B=subtraction_2)  # disabled
subtraction_5 = Subtraction(A=distance_2, B=multiplication_4)  # disabled
multiplication_5 = Multiplication(A=distance, B=number_slider_44)  # disabled
lexicalops = CSharpScript(x=line_6)  # -> A; inputs x: tree of Line; disabled
# ---------- lexicalops: C# ----------
    var pathString = x.Path(0).ToString();
    var tree = new DataTree<Line>();

    if( pathString == "{0}" )
    {

      x.Flatten();
      
      tree = x;
      
    }

    else if( pathString == "{0;0}" )
    {

      var ls = "{A;B}";
      var lt = "{A}";

      LexerOps<Line>(x, out tree, ls, lt);

      A = tree;

    }

    A = tree;
# ---------- lexicalops: C# additional code ----------
  private void LexerOps<T>( DataTree<T> lines, out DataTree<T> linesOut, string lexSource, string lexTarget )
  {

  var linesOUT = new DataTree<T>();
  var source = new GH_Lexer(lexSource);
  var target = new GH_Lexer(lexTarget);
  GH_Lexer.PerformLexicalReplace(source, target, lines, linesOUT);
  linesOut = linesOUT;

}
# ---------- end lexicalops ----------
explode_tree_2 = ExplodeTree(Data=plane)  # -> Branch0, Branch1, Branch2; disabled
multiplication_6 = Multiplication(A=distance_3, B=number_slider_47)  # disabled
subtraction_6 = Subtraction(A=multiplication_6, B=distance_5)  # disabled
multiplication_7 = Multiplication(A=distance_3, B=subtraction_3)  # disabled
multiplication_8 = Multiplication(A=distance_4, B=number_slider_49)  # disabled
subtraction_7 = Subtraction(A=multiplication_8, B=distance_6)  # disabled
multiplication_9 = Multiplication(A=distance_4, B=subtraction_4)  # disabled
curve_closest_point_5 = CurveClosestPoint(Point=pt_4, Curve=reparameterize(lexicalops))  # -> simplify(Point), Parameter, Distance; disabled
length = Length(Curve=lexicalops)  # disabled
dom_9 = ConstructDomain(DomainStart=expr("-x", multiplication_4), DomainEnd=multiplication_4)  # disabled
dom_10 = ConstructDomain(DomainStart=expr("-x", multiplication_5), DomainEnd=multiplication_5)  # disabled
dom_11 = ConstructDomain(DomainStart=expr("-x", subtraction_5), DomainEnd=subtraction_5)  # disabled
construct_domain = ConstructDomain(DomainStart=expr("-x", multiplication_7), DomainEnd=multiplication_7)  # disabled
construct_domain_2 = ConstructDomain(DomainStart=expr("-x", multiplication_6), DomainEnd=multiplication_6)  # disabled
construct_domain_3 = ConstructDomain(DomainStart=expr("-x", multiplication_9), DomainEnd=multiplication_9)  # disabled
construct_domain_4 = ConstructDomain(DomainStart=expr("-x", multiplication_8), DomainEnd=multiplication_8)  # disabled
rectangle_2 = Rectangle(Plane=[item_7.Item, item_7.Item1], XSize=dom_8, YSize=[dom_9, dom_10], Radius=0)  # -> Rectangle, Length; disabled
dom_12 = ConstructDomain(DomainStart=expr("-x", subtraction_6), DomainEnd=subtraction_6)  # disabled
dom_13 = ConstructDomain(DomainStart=expr("-x", subtraction_7), DomainEnd=subtraction_7)  # disabled
domain = Domain([construct_domain_2, construct_domain, dom_12])  # disabled
domain_2 = Domain([construct_domain_4, construct_domain_3, dom_13])  # disabled
number_2 = Number(length)  # disabled
list_item_9 = ListItem(List=number_2, Index=0, Wrap=True)  # -> Item, Item1; disabled
list_item_10 = ListItem(List=curve_closest_point_5.Parameter, Index=0, Wrap=True)  # -> Item, Item1; disabled
number_slider_51 = Slider(1, range=0..1)  # disabled
number_slider_52 = Slider(1, range=0..1)  # disabled
subtraction_8 = Subtraction(A=number_slider_51, B=list_item_10.Item1)  # disabled
subtraction_9 = Subtraction(A=number_slider_52, B=list_item_10.Item)  # disabled
multiplication_10 = Multiplication(A=list_item_10.Item, B=list_item_9.Item)  # disabled
multiplication_11 = Multiplication(A=subtraction_8, B=list_item_9.Item1)  # disabled
multiplication_12 = Multiplication(A=subtraction_9, B=list_item_9.Item)  # disabled
multiplication_13 = Multiplication(A=list_item_10.Item1, B=list_item_9.Item1)  # disabled
plane_2 = Plane(pl)  # disabled
rectangle_3 = Rectangle(Plane=flatten(plane_2), XSize=domain, YSize=domain_2, Radius=0)  # -> Rectangle, Length; disabled
dom_14 = ConstructDomain(DomainStart=expr("-x", multiplication_12), DomainEnd=multiplication_10)  # disabled
dom_15 = ConstructDomain(DomainStart=expr("-x", multiplication_11), DomainEnd=multiplication_13)  # disabled
rectangle_4 = Rectangle(Plane=plane_2, XSize=dom_15, YSize=dom_14, Radius=0)  # -> Rectangle, Length; disabled
genelist_h = GenePool(Decimals=2, Maximum=1, Minimum=0.5, Value=[0.62, 0.75])  # disabled
genelist_g = GenePool(Decimals=2, Maximum=1, Minimum=0.5, Value=[0.57, 0.75])  # disabled
scale_nu = ScaleNU(Geometry=rectangle_4.Rectangle, Plane=plane_2, ScaleX=graft(genelist_g), ScaleY=graft(genelist_h), ScaleZ=1)  # -> Geometry, Transform; disabled

# ---- group: CreateOurInitialFloorPlan
flatten = FlattenTree(Tree=scale_nu.Geometry, Path="{0}")  # disabled
graft_2 = GraftTree(Tree=flatten, IncludeEmptyLists=True, IncludeNullItems=True)  # disabled
rint = RegionIntersection(CurvesA=runion_2, CurvesB=graft_2)  # -> simplify(Result); disabled
c_script_5 = CSharpScript(x=rint)  # -> A; inputs x: tree of Polyline; disabled
# ---------- c_script_5: C# ----------
    var treeOut = new DataTree<Polyline>();

    for( int i = 0; i < x.BranchCount; ++i )
      for( int j = 0; j < x.Branch(i).Count; ++j )
      {

        treeOut.Add(x.Branch(i)[j], new GH_Path(i));

      }

    A = treeOut;
# ---------- end c_script_5 ----------
crv_6 = Curve(simplify(c_script_5))  # disabled

# ----
rectangle_5 = Rectangle(Plane=flatten(PlaneXY(0, 0, 0)), XSize=c_script_2, YSize=c_script_2, Radius=0)  # -> Rectangle, Length; disabled

# ---- group: Commercial / Floors
number_slider_53 = Slider(0.5, range=0..1)
pt_5 = ConstructPoint(XCoordinate=number_slider_53, YCoordinate=number_slider_53, ZCoordinate=0)
move_7 = Move(Geometry=runion_2, Motion=Z_3)  # -> simplify(Geometry), Transform
c_script_6 = CSharpScript(x=move_7.Geometry)  # -> A; inputs x: tree of Polyline; same code as c_script
evalsrf_2 = EvaluateSurface(Surface=reparameterize(c_script_6), Point=pt_5)  # -> Point, Normal, UDirection, VDirection, Frame
runion_3 = RegionUnion(Curves=flatten(move_7.Geometry), Plane=flatten(evalsrf_2.Point))  # -> simplify(Result)
frgb_5 = ColourRGBF(Alpha=Slider(1, range=0..1), Red=Slider(1, range=0..1), Green=Slider(1, range=0..1), Blue=Slider(0, range=0..1))
srf_6 = Surface(runion_3)
preview_3 = CustomPreview(Geometry=srf_6, Material=frgb_5)

# ---- group: Commercial / Volume
flip_2 = FlipMatrix(Data=runion_3)
lng_4 = ListLength(List=flip_2)
item_9 = ListItem(List=flip_2, Index=expr("x-1", lng_4), Wrap=True)
Z_7 = UnitZ(Factor=number_slider_25)
expression_7 = Expression(x=centipede_5, Expression="If( x = 0, False, True )")
move_8 = Move(Geometry=item_9, Motion=Z_7)  # -> Geometry, Transform
loft_3 = Loft(
    Curves=[flip_2, move_8.Geometry],
    Options={Adjust=False, Closed=False, LoftEnds=0, LoftSimp=0, LoftType=0, Rebuild=10, Refit=0.01})
cap_3 = CapHoles(Brep=loft_3)
get_object_by_nickname_7 = GetObjectByNickname(NickName="PreviewOffice")
enable_disable_object_6 = EnableDisableObject(Objects=get_object_by_nickname_7, Enabled=expression_7, AllObjects_Object=[previewoffice, previewoffice_2])
frgb_6 = ColourRGBF(Alpha=centipede_5, Red=Slider(1, range=0..1), Green=Slider(0.587, range=0..1), Blue=Slider(0, range=0..1))
previewoffice_2 = CustomPreview(Geometry=cap_3, Material=frgb_6)

# ---- group: Office
genelist_e = GenePool(Decimals=0, Maximum=40, Minimum=10, Value=[32, 25])  # disabled
number_slider_54 = Slider(3.8, range=0..10)  # disabled
item_10 = ListItem(List=series_3, Index=expr("x-1", number_slider_27), Wrap=True)  # disabled
addition_5 = Addition(A=number_slider_26, B=item_10)  # disabled
series_4 = Series(Start=addition_5, Step=number_slider_54, Count=graft(genelist_e))  # -> simplify(Series); disabled
Z_8 = UnitZ(Factor=series_4)  # -> simplify(UnitVector); disabled
move_9 = Move(Geometry=crv_6, Motion=Z_8)  # -> simplify(Geometry), Transform; disabled
sortbranchaccordingtoheight = CSharpScript(x=move_9.Geometry)  # -> A, B, C; inputs x: tree of Polyline; disabled
# ---------- sortbranchaccordingtoheight: C# ----------
    int count = x.BranchCount;

    var treeOut = new DataTree<Polyline>();
    var itemsOfBranch = new int[count];
    var index = new int[count];

    for( int i = 0; i < count; ++i )
    {

      itemsOfBranch[i] = x.Branch(i).Count;
      index[i] = i;

    }

    Array.Sort(itemsOfBranch, index);

    for( int i = 0; i < count; ++i )
    {

      treeOut.AddRange(x.Branch(index[i]), new GH_Path(i));

    }

    A = treeOut;
    B = itemsOfBranch;
    C = count;
# ---------- end sortbranchaccordingtoheight ----------
number_slider_55 = Slider(1, range=0..1)  # disabled
prune = PruneTree(Tree=sortbranchaccordingtoheight.A, Minimum=number_slider_55, Maximum=0)  # disabled
number_slider_56 = Slider(0.5, range=0..1)  # disabled
path_mapper = PathMapper(prune, source="{A}", target="{path_index}")  # disabled
pt_6 = ConstructPoint(XCoordinate=number_slider_56, YCoordinate=number_slider_56, ZCoordinate=0)  # disabled
evalsrf_3 = EvaluateSurface(Surface=reparameterize(path_mapper), Point=pt_6)  # -> Point, Normal, UDirection, VDirection, Frame; disabled
crv_7 = Curve(path_mapper)  # disabled
list_item_11 = ListItem(List=crv_7, Index=0, Wrap=True)  # disabled
colmm = CollisionManyMany(Colliders=flatten(list_item_11))  # -> Collision, Indices; disabled
ma_3 = MassAddition(Input=colmm.Collision)  # -> Result, PartialResults; disabled
floorsandvolumes = FloorsAndVolumes(Points=evalsrf_3.Point, Frames=evalsrf_3.Frame, Collisions=ma_3.Result, Curves=crv_7)  # -> Floors, Volumes, NumberOfBranches; disabled

# ---- group: IndiceDeOcupacionCaso1
area_5 = Area(Geometry=curve_2, UseTasks=False)  # -> Area, Centroid
item_11 = ListItem(List=sint, Index=number_slider_21, Wrap=True)
surface_3 = Surface(simplify(runion_2))
project = Project(Geometry=simplify([item_11, surface_3]), Plane=PlaneXY(0, 0, 0))  # -> Geometry, Transform
region_union = RegionUnion(Curves=flatten(project.Geometry))
surface_4 = Surface(region_union)
list_item_12 = ListItem(List=surface_4, Index=0, Wrap=True)  # -> Item, Item1
solid_intersection = SolidIntersection(BrepsA=list_item_12.Item, BrepsB=list_item_12.Item1)
area_6 = Area(Geometry=solid_intersection, UseTasks=False)  # -> Area, Centroid
addition_6 = Addition(A="11395.83", B=area_6.Area)
division_2 = Division(A=addition_6, B=area_5.Area)
panel_10 = Panel(division_2)
multiplication_14 = Multiplication(A=division_2, B=100)
panel_11 = Panel(multiplication_14)

# ---- group: Office / Volumes
number_slider_57 = Slider(0.436, range=0..1)  # disabled
number_slider_58 = Slider(0.618, range=0..1)  # disabled
number_slider_59 = Slider(0.103, range=0..1)  # disabled
number_slider_60 = Slider(1, range=0..1)  # disabled
number_slider_61 = Slider(0, range=0..1)  # disabled
number_slider_62 = Slider(0.561, range=0..1)  # disabled
number_slider_63 = Slider(0.711, range=0..1)  # disabled
number_slider_64 = Slider(0, range=0..1)  # disabled
number_slider_65 = Slider(0, range=0..1)  # disabled
number_slider_66 = Slider(0.438, range=0..1)  # disabled
brep = Brep(floorsandvolumes.Volumes)  # disabled
expression_8 = Expression(x=centipede_4, Expression="If( x = 0, False, True )")  # disabled
frgb_7 = ColourRGBF(
    Alpha=centipede_4,
    Red=[number_slider_58, number_slider_61, number_slider_64],
    Green=[number_slider_59, number_slider_62, number_slider_65],
    Blue=[number_slider_60, number_slider_63, number_slider_66])  # -> simplify(graft(Colour)); disabled
panel_12 = Panel("PreviewBuildings")  # disabled
number_slider_67 = Slider(0.02, range=0..1)  # disabled
unit_z_3 = UnitZ(Factor=number_slider_67)  # disabled
prunecolours = CSharpScript(colours=frgb_7, branchCount=floorsandvolumes.NumberOfBranches)  # -> prunedTree; inputs colours: tree, branchCount: Int32; disabled
# ---------- prunecolours: C# ----------
    switch( branchCount )
    {

      case 1:

        colours.RemovePath(1);
        colours.RemovePath(2);

        break;

      case 2:

        colours.RemovePath(2);

        break;

    }

    prunedTree = colours;
# ---------- end prunecolours ----------
get_object_by_nickname_8 = GetObjectByNickname(NickName=panel_12)  # disabled
move_10 = Move(Geometry=brep, Motion=unit_z_3)  # -> Geometry, Transform; disabled
hide_show_object_preview_2 = HideShowObjectPreview(Objects=get_object_by_nickname_8, Visible=expression_8)  # disabled
previewbuildings = CustomPreview(Geometry=move_10.Geometry, Material=prunecolours)  # disabled

# ---- group: Office / Floors
area_7 = Area(Geometry=flatten(floorsandvolumes.Floors), UseTasks=True)  # -> Area, Centroid; disabled
srf_7 = Surface(floorsandvolumes.Floors)  # disabled
number_slider_68 = Slider(0.426, range=0..1)  # disabled
number_slider_69 = Slider(1, range=0..1)  # disabled
number_slider_70 = Slider(0.071, range=0..1)  # disabled
number_slider_71 = Slider(0.04, range=0..1)  # disabled
ma_4 = MassAddition(Input=area_7.Area)  # -> Result, PartialResults; disabled
frgb_8 = ColourRGBF(Alpha=number_slider_68, Red=number_slider_69, Green=number_slider_70, Blue=number_slider_71)  # disabled
preview_4 = CustomPreview(Geometry=srf_7, Material=frgb_8)  # disabled

# ----
area_8 = Area(Geometry=move_8.Geometry)  # -> Area, Centroid
deconstruct_4 = Deconstruct(Point=area_8.Centroid)  # -> XComponent, YComponent, ZComponent

# ---- group: PenalizeFloorPlan
curve_4 = Curve(floorsandvolumes.Floors)  # disabled
area_9 = Area(Geometry=curve_4, UseTasks=False)  # -> Area, Centroid; disabled
deconstruct_5 = Deconstruct(Point=area_9.Centroid)  # -> XComponent, YComponent, ZComponent; disabled
expression_9 = Expression(x=deconstruct_5.ZComponent, y=addition_5, Expression="If( ( x - y ) > 0.1, False, True )")  # disabled
cull_pattern = CullPattern(List=curve_4, CullPattern=expression_9)  # disabled
disc_2 = Discontinuity(Curve=cull_pattern, Level=1)  # -> Points, Parameters; disabled
number_slider_72 = Slider(4, range=0..10)  # disabled
lng_5 = ListLength(List=disc_2.Points)  # disabled
expression_10 = Expression(x=lng_5, y=number_slider_72, Expression="If( x ≠ y, -50, 0 )")  # -> flatten(R); disabled
panel_13 = Panel(expression_10)  # disabled

# ---- group: Fitness / CloseToEachOtherOffice
flip_3 = FlipMatrix(Data=crv_7)  # disabled
c_script_7 = CSharpScript(x=flip_3)  # -> A; inputs x: tree of Polyline; disabled; same code as c_script
crossref = CrossReference(ListA=c_script_7, ListB=c_script_7, CrossMode=5)  # -> graft(ListA), graft(ListB); disabled
crv_8 = Curve([crossref.ListA, crossref.ListB])  # disabled
item_12 = ListItem(List=crv_8, Index=0, Wrap=True)  # -> simplify(Item), simplify(Item1); disabled
number_slider_73 = Slider(0.001, range=0..0.001)  # disabled
number_slider_74 = Slider(7, range=0..10)  # disabled
crvprox = CurveProximity(CurveA=item_12.Item, CurveB=item_12.Item1)  # -> PointA, PointB, Distance; disabled
nullrep = ReplaceNulls(Items=crvprox.Distance, Replacements=number_slider_73)  # -> Items, Count; disabled
expression_11 = Expression(x=nullrep.Items, y=number_slider_73, z=number_slider_74, Expression="If( x < z, If( x > y, -7, 0 ), 0 ) ")  # -> flatten(R); disabled
panel_14 = Panel(expression_11)  # disabled

# ---- group: Fitness / NoOverlappingGeo
crossref_2 = CrossReference(ListA=c_script_7, ListB=c_script_7, CrossMode=5)  # -> graft(ListA), graft(ListB); disabled
crv_9 = Curve(simplify([crossref_2.ListA, crossref_2.ListB]))  # disabled
sdivide_2 = DivideSurface(Surface=crv_9, UCount=10, VCount=10)  # -> simplify(Points), Normals, Parameters; disabled
lexoperator = CSharpScript(points=sdivide_2.Points)  # -> A; inputs points: tree of Point3d; disabled
# ---------- lexoperator: C# ----------
    var pathString = points.Path( 0 ).ToString();
    var pointsOut = new DataTree<Point3d>();
    
    if( pathString == "{0;0;0}" )
    {
    
      var ls = "{A;B;C}";
      var lt = "{A}";
      
      LexerOps<Point3d>( points, out pointsOut, ls, lt );
    
    }
    
    else
    {
    
      var ls = "{A;B}";
      var lt = "{A}";
      
      LexerOps<Point3d>(points, out pointsOut, ls, lt);
    
    }
    
    A = pointsOut;
# ---------- lexoperator: C# additional code ----------
  private void LexerOps<T>( DataTree<T> lines, out DataTree<T> linesOut, string lexSource, string lexTarget )
  {

  var linesOUT = new DataTree<T>();
  var source = new GH_Lexer(lexSource);
  var target = new GH_Lexer(lexTarget);
  GH_Lexer.PerformLexicalReplace(source, target, lines, linesOUT);
  linesOut = linesOUT;

}
# ---------- end lexoperator ----------
null_2 = NullItem(Item=lexoperator)  # -> NullFlags, InvalidFlags, Description; disabled
cull_2 = CullPattern(List=lexoperator, CullPattern=invert(null_2.NullFlags))  # disabled
pt_7 = Point(cull_2)  # disabled
number_slider_75 = Slider(15, range=0..100)  # disabled
number_slider_76 = Slider(30, range=0..100)  # disabled
item_13 = ListItem(List=crv_9, Index=0, Wrap=True)  # -> Item, Item1; disabled
lng_6 = ListLength(List=pt_7)  # disabled
multiplication_15 = Multiplication(A=lng_6, B=0.5)  # disabled
split = SplitList(List=pt_7, Index=multiplication_15)  # -> simplify(ListA), simplify(ListB); disabled
crv_10 = Curve(item_13.Item)  # disabled
pt_8 = Point(split.ListB)  # disabled
pointinclusion = CSharpScript(pts=pt_8, crv=crv_10)  # -> flatten(A); inputs pts: list of Point3d, crv: Polyline; disabled
# ---------- pointinclusion: C# ----------
    int penalize = 0;

    System.Threading.Tasks.Parallel.ForEach(pts, pt =>
      {

      if( IsInside(pt, crv) )
      {

        System.Threading.Interlocked.Decrement( ref penalize );

      }

      }
      );

    A = penalize;
# ---------- pointinclusion: C# additional code ----------
  bool IsInside (Point3d pt, Polyline crv)
  {
    Point3d pt1, pt2;
    bool oddNodes = false;

    for (int i = 0; i < crv.SegmentCount; i++) //for each contour line
    {

      pt1 = crv.SegmentAt(i).From; //get start and end pt
      pt2 = crv.SegmentAt(i).To;

      if ( (pt1[1] < pt[1] && pt2[1] >= pt[1] || pt2[1] < pt[1] && pt1[1] >= pt[1]) && (pt1[0] <= pt[0] || pt2[0] <= pt[0]) ) //if pt is between pts in y, and either of pts is before pt in x
        oddNodes ^= ( pt2[0] + (pt[1] - pt2[1]) * (pt1[0] - pt2[0]) / (pt1[1] - pt2[1]) < pt[0] ); //^= is xor
      //end.X + (pt-end).Y   * (start-end).X  /(start-end).Y   <   pt.X
    }


    if (!oddNodes)
    {
      double minDist = 1e10;
      for (int i = 0; i < crv.SegmentCount; i++) {
        Point3d cp = crv.SegmentAt(i).ClosestPoint(pt, true);
        //Point3d cp = mvContour[i].closestPoint(pt);
        //minDist = min(minDist, cp.distance(pt));
        minDist = Math.Min(minDist, cp.DistanceTo(pt));
      }
      if (minDist < 1e-10)
        return true;
    }

    if(oddNodes) return true;

    return false;
  }
# ---------- end pointinclusion ----------
expression_12 = Expression(x=pointinclusion, y=number_slider_75, z=number_slider_76, Expression="If( ( x ≥ y ) And ( x ≤ z ), 0, -10 )")  # disabled
point_within_curve = PointWithinCurve(pts=pt_8, crv=crv_10)  # -> out, A, B; inputs pts: list of Point3d, crv: Polyline; disabled
# ---------- point_within_curve: C# ----------
    var inside = new List<Point3d>();
    var outside = new List<Point3d>();

    foreach (Point3d pt in pts)
    {
      if(IsInside(pt, crv))
      {
        inside.Add(pt);
      }
      else outside.Add(pt);
    }
    A = inside;
    B = outside;
# ---------- point_within_curve: C# additional code ----------
  bool IsInside (Point3d pt, Polyline crv)
  {
    Point3d pt1, pt2;
    bool oddNodes = false;

    for (int i = 0; i < crv.SegmentCount; i++) //for each contour line
    {

      pt1 = crv.SegmentAt(i).From; //get start and end pt
      pt2 = crv.SegmentAt(i).To;

      if ( (pt1[1] < pt[1] && pt2[1] >= pt[1] || pt2[1] < pt[1] && pt1[1] >= pt[1]) && (pt1[0] <= pt[0] || pt2[0] <= pt[0]) ) //if pt is between pts in y, and either of pts is before pt in x
        oddNodes ^= ( pt2[0] + (pt[1] - pt2[1]) * (pt1[0] - pt2[0]) / (pt1[1] - pt2[1]) < pt[0] ); //^= is xor
      //end.X + (pt-end).Y   * (start-end).X  /(start-end).Y   <   pt.X
    }


    if (!oddNodes)
    {
      double minDist = 1e10;
      for (int i = 0; i < crv.SegmentCount; i++) {
        Point3d cp = crv.SegmentAt(i).ClosestPoint(pt, true);
        //Point3d cp = mvContour[i].closestPoint(pt);
        //minDist = min(minDist, cp.distance(pt));
        minDist = Math.Min(minDist, cp.DistanceTo(pt));
      }
      if (minDist < 1e-10)
        return true;
    }

    if(oddNodes) return true;

    return false;
  }
# ---------- end point_within_curve ----------
point_26 = Point(point_within_curve.A)  # disabled
point_27 = Point(point_within_curve.B)  # disabled
panel_15 = Panel(pointinclusion)  # disabled
panel_16 = Panel(expression_12)  # disabled

# ---- group: Fitness / TotalArea
area_10 = Area(Geometry=flatten(runion), UseTasks=False)  # -> Area, Centroid
area_11 = Area(Geometry=flatten(runion_3), UseTasks=False)  # -> Area, Centroid
cull_index = CullIndex(List=area_10.Area, Indices=0, Wrap=True)
cull_index_2 = CullIndex(List=area_11.Area, Indices=0, Wrap=True)
ma_5 = MassAddition(Input=cull_index)  # -> Result, PartialResults
ma_6 = MassAddition(Input=cull_index_2)  # -> Result, PartialResults
addition_7 = Addition(A=ma.Result, B=ma_5.Result)  # disabled
number_slider_77 = Slider(83000, range=0..100000)  # disabled
number_slider_78 = Slider(85799, range=0..100000)  # disabled
addition_8 = Addition(A=addition_7, B=ma_4.Result)  # disabled
panel_17 = Panel(addition_7)  # disabled
expression_13 = Expression(x=addition_8, y=number_slider_77, z=number_slider_78, Expression="If( ( x ≤ z ) And ( x ≥ y ), 0, -100 )")  # -> flatten(Result); disabled
panel_18 = Panel(addition_8)  # disabled

# ---- group: Fitness / RectangularFloorPlans
crv_11 = Curve(crv_6)  # disabled
disc_3 = Discontinuity(Curve=crv_11, Level=1)  # -> Points, Parameters; disabled
number_slider_79 = Slider(4, range=0..10)  # disabled
lng_7 = ListLength(List=disc_3.Points)  # disabled
expression_14 = Expression(x=lng_7, y=number_slider_79, Expression="If( x ≠ y, -50, 0 )")  # -> flatten(R); disabled
panel_19 = Panel(expression_14)  # disabled

# ---- group: Fitness / NoSmallBuildings
number_slider_80 = Slider(400, range=0..1000)  # disabled
area_12 = Area(Geometry=crv_6)  # -> Area, Centroid; disabled
expression_15 = Expression(x=area_12.Area, y=number_slider_80, Expression="If( x < y, -2, 0 )")  # -> flatten(R); disabled
panel_20 = Panel(expression_15)  # disabled

# ----
mass_addition = MassAddition(Input=flatten([ma_2.Result, ma_5.Result]))  # -> flatten(Result), PartialResults

# ---- group: Fitness / MinMaxWidthHeight
number_slider_81 = Slider(25, range=0..100)  # disabled
number_slider_82 = Slider(60, range=0..100)  # disabled
minwidth_height = CSharpScript(x=rectangle_4.Rectangle, y=number_slider_81, z=number_slider_82)  # -> A; inputs x: tree of Rectangle3d, y: Double, z: Double; disabled
# ---------- minwidth_height: C# ----------
    int branchCount = x.BranchCount;

    int penal = 0;

    for( int i = 0; i < branchCount; ++i )
    {

      double width = x.Branch(i)[0].Width;
      double height = x.Branch(i)[0].Height;

      if( width <= y || width >= z )

        penal -= 200;

      if( height <= y || height >= z )

        penal -= 200;

    }

    A = penal;
# ---------- end minwidth_height ----------

# ---- group: Final
# Numero de pisos
# Area total m2
# Area plataforma m2
# Area comercial m2
# Area oficinas m2
# Altura total(desde plataforma) m
list_item_13 = ListItem(List=area.Centroid, Index=0, Wrap=True)
deconstruct_6 = Deconstruct(Point=list_item_13)  # -> XComponent, YComponent, ZComponent
panel_21 = Panel("""Opción 1
Opción 2
Opción 3""")
number_slider_83 = Slider(17, range=0..100)
number_slider_84 = Slider(30, range=0..100)
series_5 = Series(Start=deconstruct_4.ZComponent, Step=Slider(3.8, range=0..10), Count=[number_slider_83, number_slider_84])
boolean_toggle_3 = BooleanToggle(True)
unit_z_4 = UnitZ(Factor=series_5)
expression_16 = Expression(x=centipede_4, Expression="If( x = 0, False, True )")
expression_17 = Expression(x=boolean_toggle_3, Expression="If( x = False, True, False )")
move_11 = Move(Geometry=runion_2, Motion=unit_z_4)  # -> Geometry, Transform
loft_4 = Loft(
    Curves=move_11.Geometry,
    Options={Adjust=False, Closed=False, LoftEnds=0, LoftSimp=0, LoftType=0, Rebuild=10, Refit=0.01})
cap_holes = CapHoles(Brep=loft_4)
get_object_by_nickname_9 = GetObjectByNickname(NickName="PreviewBuildingsOne")
hide_show_object_preview_3 = HideShowObjectPreview(Objects=get_object_by_nickname_9, Visible=expression_16)
area_13 = Area(Geometry=move_11.Geometry, UseTasks=False)  # -> Area, Centroid
list_length = ListLength(List=area_13.Centroid)
list_item_14 = ListItem(List=area_13.Centroid, Index=expr("x-1", list_length), Wrap=True)  # -> simplify(Item)
deconstruct_7 = Deconstruct(Point=list_item_14)  # -> XComponent, YComponent, ZComponent
construct_point = ConstructPoint(XCoordinate=deconstruct_6.XComponent, YCoordinate=deconstruct_6.YComponent, ZCoordinate=deconstruct_7.ZComponent)
vector_2pt_2 = Vector2Pt(PointA=list_item_13, PointB=construct_point, Unitize=False)  # -> Vector, simplify(Length)
number_slider_85 = Slider(0.775, range=0..1)
number_slider_86 = Slider(0.172, range=0..1)
enable_disable_object_7 = EnableDisableObject(
    Objects=get_object_by_nickname_6,
    Enabled=boolean_toggle_3,
    AllObjects_Object=[previewbuildingstwo, previewbuildingstwo_2])
enable_disable_object_8 = EnableDisableObject(Objects=get_object_by_nickname_9, Enabled=expression_17, AllObjects_Object=[previewbuildingsone_2, previewbuildingsone])
number_slider_87 = Slider(0.244, range=0..1)
mass_addition_2 = MassAddition(Input=area_13.Area)  # -> simplify(Result), PartialResults
list_length_2 = ListLength(List=series_5)  # -> simplify(Length)
frgb_9 = ColourRGBF(Alpha=centipede_4, Red=Slider(0.654, range=0..1), Green=Slider(1, range=0..1), Blue=Slider(0.711, range=0..1))  # -> graft(Colour)
addition_9 = Addition(A=ma_6.Result, B=mass_addition_2.Result)  # -> simplify(Result)
explode_tree_3 = ExplodeTree(Data=cap_holes)  # -> Branch0, Branch1
boolean_toggle_4 = BooleanToggle(True)
vector_display_ex = VectorDisplayEx(Point=list_item_13, Vector=vector_2pt_2.Vector, Colour=frgb_9, Width=Slider(1.635, range=0..10))

# ----
mass_addition_3 = MassAddition(Input=[number_slider_7, number_slider_27, number_slider_84])  # -> Result, PartialResults
mass_addition_4 = MassAddition(Input=[number_slider_7, number_slider_27, number_slider_83])  # -> Result, PartialResults
subtraction_10 = Subtraction(A=mass_addition_3.Result, B=Slider(3, range=0..10))
subtraction_11 = Subtraction(A=mass_addition_4.Result, B=Slider(3, range=0..10))
c_script_8 = CSharpScript(x=list_item_14)  # -> A; inputs x: tree
# ---------- c_script_8: C# ----------
    A = x.BranchCount;
# ---------- end c_script_8 ----------
number_3 = Number(simplify(graft([subtraction_11, subtraction_10])))
frgb_10 = ColourRGBF(Alpha=centipede_4, Red=number_slider_87, Green=number_slider_86, Blue=number_slider_85)  # -> graft(Colour)
previewbuildingstwo = CustomPreview(Geometry=explode_tree_3.Branch1, Material=frgb_9)

# ---- group: Caso2
list_item_15 = ListItem(List=area.Centroid, Index=0, Wrap=True)
area_14 = Area(Geometry=move_5.Geometry, UseTasks=False)  # -> Area, Centroid
deconstruct_8 = Deconstruct(Point=list_item_15)  # -> XComponent, YComponent, ZComponent
curve_5 = Curve([<curve referenced from the Rhino model> x2])
join_curves_3 = JoinCurves(Curves=curve_5, Preserve=False)
deconstruct_9 = Deconstruct(Point=area_14.Centroid)  # -> XComponent, YComponent, ZComponent
area_15 = Area(Geometry=join_curves_3, UseTasks=False)  # -> Area, Centroid
deconstruct_10 = Deconstruct(Point=area_15.Centroid)  # -> XComponent, YComponent, ZComponent
construct_point_2 = ConstructPoint(XCoordinate=deconstruct_10.XComponent, YCoordinate=deconstruct_10.YComponent, ZCoordinate=deconstruct_9.ZComponent)
panel_22 = Panel("""Opción 1
Opción 2""")
unit_z_5 = UnitZ(Factor=1)
vector_2pt_3 = Vector2Pt(PointA=area_15.Centroid, PointB=construct_point_2, Unitize=False)  # -> Vector, Length
move_12 = Move(Geometry=join_curves_3, Motion=vector_2pt_3.Vector)  # -> Geometry, Transform
expression_18 = Expression(x=centipede_4, Expression="If( x = 0, False, True )")
expression_19 = Expression(x=centipede_4, Expression="If( x = 0, False, True )")
boolean_toggle_5 = BooleanToggle(True)
number_slider_88 = Slider(53, range=0..100)
series_6 = Series(Start=0, Step=Slider(3.8, range=0..10), Count=number_slider_88)
unit_z_6 = UnitZ(Factor=series_6)
expression_20 = Expression(x=boolean_toggle_5, Expression="If( x = False, True, False )")
move_13 = Move(Geometry=move_12.Geometry, Motion=unit_z_6)  # -> Geometry, Transform
loft_5 = Loft(
    Curves=move_13.Geometry,
    Options={Adjust=False, Closed=False, LoftEnds=0, LoftSimp=0, LoftType=0, Rebuild=10, Refit=0.01})
cap_holes_2 = CapHoles(Brep=loft_5)
get_object_by_nickname_10 = GetObjectByNickname(NickName="PreviewBuildingsTwo")
get_object_by_nickname_11 = GetObjectByNickname(NickName="PreviewBuildingsOne")
mass_addition_5 = MassAddition(Input=[number_slider_7, number_slider_88, number_slider_27])  # -> Result, PartialResults
hide_show_object_preview_4 = HideShowObjectPreview(Objects=get_object_by_nickname_10, Visible=expression_18)
hide_show_object_preview_5 = HideShowObjectPreview(Objects=get_object_by_nickname_11, Visible=expression_19)
area_16 = Area(Geometry=move_13.Geometry, UseTasks=False)  # -> Area, Centroid
list_length_3 = ListLength(List=area_16.Centroid)
list_item_16 = ListItem(List=area_16.Centroid, Index=expr("x-1", list_length_3), Wrap=True)  # -> simplify(Item)
deconstruct_11 = Deconstruct(Point=list_item_16)  # -> XComponent, YComponent, ZComponent
construct_point_3 = ConstructPoint(XCoordinate=deconstruct_8.XComponent, YCoordinate=deconstruct_8.YComponent, ZCoordinate=deconstruct_11.ZComponent)
vector_2pt_4 = Vector2Pt(PointA=list_item_15, PointB=construct_point_3, Unitize=False)  # -> Vector, simplify(Length)
c_script_9 = CSharpScript(x=list_item_16)  # -> A; inputs x: tree; same code as c_script_8
subtraction_12 = Subtraction(A=mass_addition_5.Result, B=Slider(3, range=0..10))
enable_disable_object_9 = EnableDisableObject(
    Objects=get_object_by_nickname_10,
    Enabled=boolean_toggle_5,
    AllObjects_Object=[previewbuildingstwo, previewbuildingstwo_2])
enable_disable_object_10 = EnableDisableObject(Objects=get_object_by_nickname_11, Enabled=expression_20, AllObjects_Object=[previewbuildingsone_2, previewbuildingsone])
repeat_data = RepeatData(Data=ma_5.Result, Length=c_script_9)  # -> simplify(Data)
repeat_data_2 = RepeatData(Data=ma_2.Result, Length=c_script_9)  # -> simplify(Data)
frgb_11 = ColourRGBF(Alpha=centipede_4, Red=Slider(1, range=0..1), Green=Slider(1, range=0..1), Blue=Slider(0.711, range=0..1))  # -> graft(Colour)
frgb_12 = ColourRGBF(Alpha=centipede_4, Red=Slider(0.244, range=0..1), Green=Slider(0.172, range=0..1), Blue=Slider(0.775, range=0..1))  # -> graft(Colour)
explode_tree_4 = ExplodeTree(Data=cap_holes_2)  # -> Branch0, Branch1
vector_display_ex_2 = VectorDisplayEx(Point=list_item_15, Vector=vector_2pt_4.Vector, Colour=frgb_11, Width=Slider(1.635, range=0..10))
previewbuildingsone = CustomPreview(Geometry=explode_tree_4.Branch0, Material=frgb_12)  # disabled
previewbuildingstwo_2 = CustomPreview(Geometry=explode_tree_4.Branch0, Material=frgb_11)
panel_23 = Panel("""Numero de pisos
Area total m2
Area plataforma m2
Area comercial m2
Area oficinas m2
Altura total(desde n0) m
Indice de Ocupación""")

# ----
cull_index_3 = CullIndex(List=area_16.Area, Indices=[0, 1], Wrap=True)

# ---- group: Caso2 (continued)
mass_addition_6 = MassAddition(Input=cull_index_3)  # -> simplify(Result), PartialResults
addition_10 = Addition(A=mass_addition.Result, B=mass_addition_6.Result)  # -> simplify(Result)
merge = Merge(
    Data1=subtraction_12,
    Data2=addition_10,
    Data3=repeat_data_2,
    Data4=repeat_data,
    Data5=mass_addition_6.Result,
    Data6=vector_2pt_4.Length)
data = Data(flatten(merge))
write_to_excel = WriteToExcel(
    Run=Toggle(False),
    ExcelWorksheet="1",
    ColumnNames=panel_23,
    RowNames=panel_22,
    WriteOptions="None",
    ColumnnsOrRows=Toggle(True),
    DataToWriteIntoColumns=data)
panel_24 = Panel(data)

# ----
merge_2 = Merge(Data1=data, Data2=multiplication_2)  # -> flatten(Result)
list_item_17 = ListItem(List=data, Index=Slider(2, range=0..10), Wrap=True)  # -> Item, Item1
addition_11 = Addition(A=list_item_17.Item, B=list_item_17.Item1)
panel_25 = Panel(merge_2)

# ---- group: Fitness / NoFloatingOfficeBuildings
number_slider_89 = Slider(2, range=0..10)  # disabled
srf_8 = Surface(<surface referenced from the Rhino model>)  # disabled
rint_2 = RegionIntersection(CurvesA=srf_5, CurvesB=srf_8)  # disabled
crv_12 = Curve(rint_2)  # disabled
offset = OffsetCurve(Curve=crv_12, Distance=number_slider_89, Plane=PlaneXY(0, 0, 0), Corners=1)  # disabled
project_2 = Project(Geometry=crv_7, Plane=PlaneXY(0, 0, 0))  # -> Geometry, Transform; disabled
disc_4 = Discontinuity(Curve=flatten(offset), Level=1)  # -> Points, Parameters; disabled
rint_3 = RegionIntersection(CurvesA=offset, CurvesB=project_2.Geometry)  # disabled
item_14 = ListItem(List=disc_4.Points, Index=0, Wrap=True)  # -> Item, Item1, Item2; disabled
disc_5 = Discontinuity(Curve=rint_3, Level=3)  # -> simplify(Points), Parameters; disabled
sortbranchaccordingtonumberofpoints = CSharpScript(x=disc_5.Points)  # -> A, B, C; inputs x: tree of Point3d; disabled
# ---------- sortbranchaccordingtonumberofpoints: C# ----------
    int count = x.BranchCount;

    var treeOut = new DataTree<Point3d>();
    var itemsOfBranch = new int[count];
    var index = new int[count];

    for( int i = 0; i < count; ++i )
    {

      itemsOfBranch[i] = x.Branch(i).Count;
      index[i] = i;

    }

    Array.Sort(itemsOfBranch, index);

    for( int i = 0; i < count; ++i )
    {

      treeOut.AddRange(x.Branch(index[i]), new GH_Path(i));

    }

    A = treeOut;
    B = itemsOfBranch;
    C = count;
# ---------- end sortbranchaccordingtonumberofpoints ----------
number_slider_90 = Slider(1000, range=0..1000)  # disabled
pdecon = Deconstruct(Point=disc_5.Points)  # -> XComponent, YComponent, ZComponent; disabled
ln = Line(StartPoint=item_14.Item1, EndPoint=item_14.Item2)  # disabled
dist = Distance(PointA=item_14.Item1, PointB=item_14.Item2)  # disabled
path = ConstructPath(Indices=expr("x-1", sortbranchaccordingtonumberofpoints.C))  # disabled
addition_12 = Addition(A=pdecon.XComponent, B=number_slider_90)  # disabled
multiplication_16 = Multiplication(A=pdecon.YComponent, B=addition_12)  # disabled
branch = TreeBranch(Tree=sortbranchaccordingtonumberofpoints.A, Path=path, MaintainPaths=True)  # disabled
sort = SortList(Keys=multiplication_16, ValuesA=disc_5.Points)  # -> Keys, ValuesA; disabled
round = Round(Number=dist)  # -> Nearest, Floor, Ceiling; disabled

# ----
lng_8 = ListLength(List=branch)  # disabled
item_15 = ListItem(List=sort.ValuesA, Index=expr("x-2", lng_8), Wrap=True)  # disabled
item_16 = ListItem(List=sort.ValuesA, Index=expr("x-1", lng_8), Wrap=True)  # disabled

# ---- group: Fitness / NoFloatingOfficeBuildings (continued)
dist_2 = Distance(PointA=item_15, PointB=item_16)  # disabled
ln_2 = Line(StartPoint=item_15, EndPoint=item_16)  # disabled
nullrep_2 = ReplaceNulls(Items=dist_2, Replacements=dist)  # -> Items, Count; disabled
round_2 = Round(Number=nullrep_2.Items)  # -> Nearest, Floor, Ceiling; disabled
expression_21 = Expression(x=round.Nearest, y=round_2.Nearest, Expression="If( x = y, 0, -50 )")  # -> flatten(R); disabled
panel_26 = Panel(expression_21)  # disabled

# ---- group: Fitness / DifferenceBetweenNumberOfFloors
int = Integer(genelist_e)  # disabled
crossref_3 = CrossReference(ListA=int, ListB=int, CrossMode=5)  # -> graft(ListA), graft(ListB); disabled
int_2 = Integer(simplify([crossref_3.ListA, crossref_3.ListB]))  # disabled
number_slider_91 = Slider(5, range=0..10)  # disabled
c_script_10 = CSharpScript(x=int_2, y=number_slider_91)  # -> A; inputs x: tree of Int32, y: Int32; disabled
# ---------- c_script_10: C# ----------
    int count = x.BranchCount, counter = 0;

    var output = new List<int>();


    if( count != 0 )
    {

      for( int i = 0; i < count; ++i )
      {

        var branch = x.Branch(i);

        int one = x.Branch(i)[0], two = x.Branch(i)[1], temp = 0;

        temp = Math.Abs(one - two);
        output.Add(temp);

        if( output[i] < y )

          counter -= 5;

      }

    }

    A = counter;
# ---------- end c_script_10 ----------
ghpython_script = GhPythonScript(x=c_script_10)  # -> a; disabled
# ---------- ghpython_script: Python ----------
from ghpythonlib.componentbase import executingcomponent as component
import Grasshopper, GhPython
import System
import Rhino
import rhinoscriptsyntax as rs

class MyComponent(component):
    
    def RunScript(self, x):
        """Provides a scripting component.
            Inputs:
                x: The x script variable
                y: The y script variable
            Output:
                a: The a output variable"""
        
        __author__ = "Paula"
        __version__ = "2019.04.24"
        
        import rhinoscriptsyntax as rs
        
        string = str( x )
        
        if string:
        
            a = 0
            
        else:
            
            a = x
        
        # return outputs if you have them; here I try it for you:
        return a
# ---------- end ghpython_script ----------

# ----
c_script_11 = CSharpScript(x=c_script_10)  # -> A; inputs x: Int32; disabled
# ---------- c_script_11: C# ----------
    var str = x.ToString();
    
    if( string.IsNullOrEmpty( str ) )
      
      A = 0;
    
    else
    {
    
      A = x;
    
    }
# ---------- end c_script_11 ----------

# ---- group: Fitness / DifferenceBetweenNumberOfFloors (continued)
panel_27 = Panel([ghpython_script, c_script_11])  # disabled

# ---- group: Fitness
ma_7 = MassAddition(Input=flatten([expression_14, expression_15, expression_21, expression_13, expression_11, pointinclusion, minwidth_height, expression_10, c_script_11]))  # -> Result, PartialResults; disabled
panel_28 = Panel(ma_7.Result)  # disabled

# ---- group: Final (continued)
repeat_data_3 = RepeatData(Data=multiplication_14, Length=c_script_8)  # -> simplify(graft(Data))
repeat_data_4 = RepeatData(Data=ma_6.Result, Length=c_script_8)  # -> simplify(graft(Data))
repeat_data_5 = RepeatData(Data=ma_2.Result, Length=c_script_8)  # -> simplify(graft(Data))
previewbuildingsone_2 = CustomPreview(Geometry=explode_tree_3.Branch0, Material=frgb_10)  # disabled

# ----
addition_13 = Addition(A=repeat_data_5, B=addition_9)

# ---- group: Final (continued)
merge_3 = Merge(
    Data1=number_3,
    Data2=addition_13,
    Data3=repeat_data_5,
    Data4=repeat_data_4,
    Data5=mass_addition_2.Result,
    Data6=vector_2pt_2.Length,
    Data7=repeat_data_3)
data_2 = Data(merge_3)
list_item_18 = ListItem(List=data_2, Index=Slider(2, range=0..10), Wrap=True)  # -> Item, Item1
addition_14 = Addition(A=list_item_18.Item, B=list_item_18.Item1)
panel_29 = Panel(data_2)

# ----
panel_30 = Panel(addition_14)
c_script_12 = CSharpScript(x=data_2, y=merge_2)  # -> A; inputs x: tree of Double, y: list of Double
# ---------- c_script_12: C# ----------
    x.AddRange( y, new GH_Path(2) );
    
    A = x;
# ---------- end c_script_12 ----------
write_to_excel_2 = WriteToExcel(
    Run=Toggle(True),
    ExcelWorksheet="1",
    ColumnNames=panel_23,
    RowNames=panel_21,
    WriteOptions="None",
    ColumnnsOrRows=boolean_toggle_4,
    DataToWriteIntoColumns=c_script_12)
panel_31 = Panel(c_script_12)

# ==== cluster ReparametrizeCurve
curve = ClusterInput()
discontinuity = Discontinuity(Curve=curve, Level=1)  # -> Points, Parameters
area = Area(Geometry=curve, UseTasks=False)  # -> Area, Centroid
list_item = ListItem(List=discontinuity.Points, Index=0, Wrap=True)  # -> Item, Item1, Item2, Item3
point = Point(list_item.Item)
point_2 = Point(list_item.Item1)
point_3 = Point(list_item.Item2)
point_4 = Point(list_item.Item3)
point_5 = Point(area.Centroid)
vector_2pt = Vector2Pt(PointA=point, PointB=point_2, Unitize=False)  # -> Vector, Length
vector_2pt_2 = Vector2Pt(PointA=point, PointB=point_5, Unitize=False)  # -> Vector, Length
move = Move(Geometry=point_5, Motion=expr("x*0.5", vector_2pt.Vector))  # -> Geometry, Transform
move_2 = Move(Geometry=point, Motion=expr("x*0.5", vector_2pt_2.Vector))  # -> Geometry, Transform
move_3 = Move(Geometry=point, Motion=expr("x*0.5", vector_2pt.Vector))  # -> Geometry, Transform
domain_start = ClusterInput()
domain_end = ClusterInput()
domain_start_2 = ClusterInput()
domain_end_2 = ClusterInput()
construct_domain = ConstructDomain(DomainStart=expr("-x", domain_start), DomainEnd=domain_end)
construct_domain_2 = ConstructDomain(DomainStart=expr("-x", domain_start_2), DomainEnd=domain_end_2)
plane_3pt = Plane3Pt(PointA=point_5, PointB=move_3.Geometry, PointC=move.Geometry)
domain = ClusterOutput(construct_domain)
domain_2 = ClusterOutput(construct_domain_2)
plane = ClusterOutput(plane_3pt)
