# Grasshopper definition Final[1].gh (Grasshopper 1.0.7)
# plug-ins: FloorsAndVolumes

# ---- group: ModifyGenePools / NumberOfTowers
numberoftowers = Slider(3, range=1..3)

# ---- group: Platform / TamañoPlanta
number_slider = Slider(37.442, range=0..100)
number_slider_2 = Slider(7.676, range=0..100)

# ---- group: WhereToPlaceRectangles
crv = Curve(<curve referenced from the Rhino model>)
crv_2 = Curve(<curve referenced from the Rhino model>)
crv_3 = Curve(<curve referenced from the Rhino model>)
number_slider_3 = Slider(8, range=0..10)
crv_4 = Curve([crv, crv_2, crv_3])
shift = ShiftList(List=crv_4, Shift=number_slider_3, Wrap=True)
genelist_f = GenePool(Decimals=0, Maximum=1825, Minimum=0, Value=[126, 195, 16])
crv_5 = Curve(flatten(shift))
number_slider_4 = Slider(50, range=0..100)
runion = RegionUnion(Curves=crv_5)
srf = Surface(runion)
sdivide = DivideSurface(Surface=srf, UCount=number_slider_4, VCount=number_slider_4)  # -> Points, Normals, Parameters
disc = Discontinuity(Curve=runion, Level=1)  # -> Points, Parameters
null = NullItem(Item=sdivide.Points)  # -> NullFlags, InvalidFlags, Description
cull = CullPattern(List=sdivide.Points, CullPattern=invert(null.NullFlags))
item = ListItem(List=disc.Points, Index=0, Wrap=True)  # -> Item, Item1, Item2
item_2 = ListItem(List=flatten(cull), Index=genelist_f, Wrap=True)  # -> graft(Item)
vec2pt = Vector2Pt(PointA=item.Item, PointB=item.Item1, Unitize=False)  # -> Vector, Length
vec2pt_2 = Vector2Pt(PointA=item.Item1, PointB=item.Item2, Unitize=False)  # -> Vector, Length
pl = ConstructPlane(Origin=item_2, XAxis=vec2pt.Vector, YAxis=vec2pt_2.Vector)

# ---- group: ModifyGenePools
lng = ListLength(List=flatten(cull))
dom = ConstructDomain(DomainStart=Slider(10, range=0..100), DomainEnd=Slider(40, range=0..40))
dom_2 = ConstructDomain(DomainStart=Slider(10, range=0..100), DomainEnd=Slider(40, range=0..40))
dom_3 = ConstructDomain(DomainStart=Slider(0, range=0..100), DomainEnd=lng)
genemodifier = GenePoolModifier(GeneList="GeneList C", Count=numberoftowers, Domain=dom)
genemodifier_2 = GenePoolModifier(GeneList="GeneList D", Count=numberoftowers, Domain=dom)
genemodifier_3 = GenePoolModifier(GeneList="GeneList E", Count=numberoftowers, Domain=dom_2)
genemodifier_4 = GenePoolModifier(GeneList="GeneList F", Count=numberoftowers, Domain=dom_3)

# ---- group: SizeOfRectangles
genelist_c = GenePool(Decimals=2, Maximum=40, Minimum=10, Value=[36.17, 24.39, 27.84])
genelist_d = GenePool(Decimals=2, Maximum=40, Minimum=10, Value=[18.97, 13.71, 19.11])
dom_4 = ConstructDomain(DomainStart=expr("-x", genelist_c), DomainEnd=genelist_c)  # -> graft(Domain)
dom_5 = ConstructDomain(DomainStart=expr("-x", genelist_d), DomainEnd=genelist_d)  # -> graft(Domain)

# ---- group: Platform / NumeroDePisosAlturaEntreFinoYFino
number_slider_5 = Slider(3, range=0..10)
number_slider_6 = Slider(5.797, range=0..10)

# ---- group: Platform
dom_6 = ConstructDomain(DomainStart=expr("-x", number_slider), DomainEnd=number_slider)
dom_7 = ConstructDomain(DomainStart=expr("-x", number_slider_2), DomainEnd=number_slider_2)
srf_2 = Surface(<surface referenced from the Rhino model>)
reparametrizecurve = ReparametrizeCurve(curve=srf_2, domain_start_2=dom_6, domain_end_2=dom_6, domain_start=dom_7, domain_end=dom_7)  # -> plane, domain_2, domain
rectangle = Rectangle(Plane=reparametrizecurve.plane, XSize=reparametrizecurve.domain_2, YSize=reparametrizecurve.domain, Radius=0)  # -> Rectangle, Length
srf_3 = Surface(<surface referenced from the Rhino model>)
sint = SolidIntersection(BrepsA=rectangle.Rectangle, BrepsB=srf_3)
item_3 = ListItem(List=sint, Index=Slider(1, range=0..1), Wrap=True)
subtraction = Subtraction(A=number_slider_5, B=1)
series = Series(Start=0, Step=number_slider_6, Count=number_slider_5)
multiplication = Multiplication(A=number_slider_6, B=subtraction)
Z = UnitZ(Factor=series)
move = Move(Geometry=item_3, Motion=Z)  # -> Geometry, Transform
Z_2 = UnitZ(Factor=multiplication)
lng_2 = ListLength(List=move.Geometry)
srf_4 = Surface(move.Geometry)
cull_i = CullIndex(List=move.Geometry, Indices=expr("x-1", lng_2), Wrap=True)
area = Area(Geometry=cull_i, UseTasks=False)  # -> Area, Centroid
loft = Loft(Curves=move.Geometry, Options={Adjust=False, Closed=False, LoftEnds=0, LoftSimp=0, LoftType=0, Rebuild=10, Refit=0.01})
ma = MassAddition(Input=flatten(area.Area))  # -> Result, PartialResults
area_2 = Area(Geometry=move.Geometry, UseTasks=False)  # -> Area, Centroid
item_4 = ListItem(List=area_2.Area, Index=0, Wrap=True)  # -> Item, Item1
ma_2 = MassAddition(Input=flatten([item_4.Item, item_4.Item1]))  # -> Result, PartialResults
cap = CapHoles(Brep=loft)
number_slider_7 = Slider(1, range=0..1)
number_slider_8 = Slider(0, range=0..1)
number_slider_9 = Slider(0, range=0..1)
frgb = ColourRGBF(Alpha=Slider(0.191, range=0..1), Red=number_slider_7, Green=number_slider_9, Blue=number_slider_8)
frgb_2 = ColourRGBF(Alpha=Slider(0.223, range=0..1), Red=number_slider_7, Green=number_slider_9, Blue=number_slider_8)
preview = CustomPreview(Geometry=srf_4, Material=frgb)
preview_2 = CustomPreview(Geometry=cap, Material=frgb_2)
panel = Panel(ma_2.Result)

# ---- group: CreateOurInitialFloorPlan
rectangle_2 = Rectangle(Plane=pl, XSize=dom_4, YSize=dom_5, Radius=0)  # -> Rectangle, Length
flatten = FlattenTree(Tree=rectangle_2.Rectangle, Path="{0}")
graft = GraftTree(Tree=flatten, IncludeEmptyLists=True, IncludeNullItems=True)
rint = RegionIntersection(CurvesA=runion, CurvesB=graft)  # -> simplify(Result)
c_script = CSharpScript(x=rint)  # -> A; inputs x: tree of Polyline
# ---------- c_script: C# ----------
    var treeOut = new DataTree<Polyline>();

    for( int i = 0; i < x.BranchCount; ++i )
      for( int j = 0; j < x.Branch(i).Count; ++j )
      {

        treeOut.Add(x.Branch(i)[j], new GH_Path(i));

      }

    A = treeOut;
# ---------- end c_script ----------
crv_6 = Curve(simplify(c_script))

# ---- group: Commercial
number_slider_10 = Slider(6, range=0..10)
number_slider_11 = Slider(4, range=4..8)
series_2 = Series(Start=Z_2, Step=number_slider_10, Count=number_slider_11)
Z_3 = UnitZ(Factor=series_2)

# ---- group: Commercial / Floors
number_slider_12 = Slider(0.5, range=0..1)
pt = ConstructPoint(XCoordinate=number_slider_12, YCoordinate=number_slider_12, ZCoordinate=0)
move_2 = Move(Geometry=runion, Motion=Z_3)  # -> simplify(Geometry), Transform
c_script_2 = CSharpScript(x=move_2.Geometry)  # -> A; inputs x: tree of Polyline
# ---------- c_script_2: C# ----------
    var treeOut = new DataTree<Polyline>();

    for( int i = 0; i < 1; ++i )
      for( int j = 0; j < x.Branch(i).Count; ++j )
      {

        treeOut.Add(x.Branch(i)[j], new GH_Path(i));

      }

    A = treeOut;
# ---------- end c_script_2 ----------
evalsrf = EvaluateSurface(Surface=reparameterize(c_script_2), Point=pt)  # -> Point, Normal, UDirection, VDirection, Frame
runion_2 = RegionUnion(Curves=flatten(move_2.Geometry), Plane=flatten(evalsrf.Point))  # -> simplify(Result)
frgb_3 = ColourRGBF(Alpha=Slider(1, range=0..1), Red=Slider(1, range=0..1), Green=Slider(1, range=0..1), Blue=Slider(0, range=0..1))
srf_5 = Surface(runion_2)
preview_3 = CustomPreview(Geometry=srf_5, Material=frgb_3)

# ---- group: Commercial / Volume
flip = FlipMatrix(Data=runion_2)
lng_3 = ListLength(List=flip)
item_5 = ListItem(List=flip, Index=expr("x-1", lng_3), Wrap=True)
Z_4 = UnitZ(Factor=number_slider_10)
move_3 = Move(Geometry=item_5, Motion=Z_4)  # -> Geometry, Transform
loft_2 = Loft(
    Curves=[flip, move_3.Geometry],
    Options={Adjust=False, Closed=False, LoftEnds=0, LoftSimp=0, LoftType=0, Rebuild=10, Refit=0.01})
cap_2 = CapHoles(Brep=loft_2)
frgb_4 = ColourRGBF(Alpha=Slider(0.426, range=0..1), Red=Slider(1, range=0..1), Green=Slider(1, range=0..1), Blue=Slider(0, range=0..1))
preview_4 = CustomPreview(Geometry=cap_2, Material=frgb_4)

# ---- group: Office
genelist_e = GenePool(Decimals=0, Maximum=40, Minimum=10, Value=[21, 34, 34])
item_6 = ListItem(List=series_2, Index=expr("x-1", number_slider_11), Wrap=True)
addition = Addition(A=number_slider_10, B=item_6)
series_3 = Series(Start=addition, Step=Slider(3.8, range=0..10), Count=graft(genelist_e))  # -> simplify(Series)
Z_5 = UnitZ(Factor=series_3)  # -> simplify(UnitVector)
move_4 = Move(Geometry=crv_6, Motion=Z_5)  # -> simplify(Geometry), Transform
sortbranchaccordingtoheight = CSharpScript(x=move_4.Geometry)  # -> A, B, C; inputs x: tree of Polyline
# ---------- sortbranchaccordingtoheight: C# ----------
    int count = x.BranchCount;

    var treeOut = new DataTree<Polyline>();
    var itemsOfBranch = new int[count];
    var index = new int[count];

    for( int i = 0; i < count; ++i )
    {

      itemsOfBranch[i] = x.Branch(i).Count;
      index[i] = i;

    }

    Array.Sort(itemsOfBranch, index);

    for( int i = 0; i < count; ++i )
    {

      treeOut.AddRange(x.Branch(index[i]), new GH_Path(i));

    }

    A = treeOut;
    B = itemsOfBranch;
    C = count;
# ---------- end sortbranchaccordingtoheight ----------
prune = PruneTree(Tree=sortbranchaccordingtoheight.A, Minimum=Slider(1, range=0..1), Maximum=0)
number_slider_13 = Slider(0.5, range=0..1)
path_mapper = PathMapper(prune, source="{A}", target="{path_index}")
pt_2 = ConstructPoint(XCoordinate=number_slider_13, YCoordinate=number_slider_13, ZCoordinate=0)
evalsrf_2 = EvaluateSurface(Surface=reparameterize(path_mapper), Point=pt_2)  # -> Point, Normal, UDirection, VDirection, Frame
crv_7 = Curve(path_mapper)
colmm = CollisionManyMany(Colliders=flatten(crv_7))  # -> Collision, Indices
ma_3 = MassAddition(Input=colmm.Collision)  # -> Result, PartialResults

# ----
floorsandvolumes = FloorsAndVolumes(Points=evalsrf_2.Point, Frames=evalsrf_2.Frame, Collisions=ma_3.Result, Curves=crv_7)  # -> Floors, Volumes, NumberOfBranches

# ---- group: Office / Volumes
brep = Brep(floorsandvolumes.Volumes)
frgb_5 = ColourRGBF(
    Alpha=[Slider(0.426, range=0..1), Slider(0.426, range=0..1), Slider(0.426, range=0..1)],
    Red=[Slider(1, range=0..1), Slider(0, range=0..1), Slider(0, range=0..1)],
    Green=[Slider(0.103, range=0..1), Slider(1, range=0..1), Slider(0, range=0..1)],
    Blue=[Slider(1, range=0..1), Slider(0, range=0..1), Slider(1, range=0..1)])  # -> simplify(graft(Colour))
prunecolours = CSharpScript(colours=frgb_5, branchCount=floorsandvolumes.NumberOfBranches)  # -> prunedTree; inputs colours: tree, branchCount: Int32
# ---------- prunecolours: C# ----------
    switch( branchCount )
    {

      case 1:

        colours.RemovePath(1);
        colours.RemovePath(2);

        break;

      case 2:

        colours.RemovePath(2);

        break;

    }

    prunedTree = colours;
# ---------- end prunecolours ----------
preview_5 = CustomPreview(Geometry=brep, Material=prunecolours)

# ---- group: Office / Floors
area_3 = Area(Geometry=flatten(floorsandvolumes.Floors), UseTasks=True)  # -> Area, Centroid
srf_6 = Surface(floorsandvolumes.Floors)
ma_4 = MassAddition(Input=area_3.Area)  # -> Result, PartialResults
frgb_6 = ColourRGBF(
    Alpha=Slider(0.426, range=0..1),
    Red=Slider(1, range=0..1),
    Green=Slider(0.071, range=0..1),
    Blue=Slider(0.04, range=0..1))
preview_6 = CustomPreview(Geometry=srf_6, Material=frgb_6)

# ---- group: Fitness / NoFloatingCommercialBuildings
crv_8 = Curve(runion_2)  # disabled
c_script_3 = CSharpScript(x=crv_8)  # -> out, A; inputs x: tree of Polyline; disabled; same code as c_script_2
srf_7 = Surface(<surface referenced from the Rhino model>)  # disabled
item_7 = ListItem(List=c_script_3.A, Index=0, Wrap=True)  # disabled
crv_9 = Curve(srf_7)  # disabled
project = Project(Geometry=item_7, Plane=PlaneXY(0, 0, 0))  # -> Geometry, Transform; disabled
disc_2 = Discontinuity(Curve=flatten(crv_9), Level=1)  # -> Points, Parameters; disabled
rint_2 = RegionIntersection(CurvesA=crv_9, CurvesB=project.Geometry)  # disabled
item_8 = ListItem(List=disc_2.Points, Index=0, Wrap=True)  # -> Item, Item1; disabled
disc_3 = Discontinuity(Curve=flatten(rint_2), Level=1)  # -> Points, Parameters; disabled
dist = Distance(PointA=item_8.Item, PointB=item_8.Item1)  # disabled
item_9 = ListItem(List=disc_3.Points, Index=0, Wrap=True)  # -> Item, Item1; disabled
dist_2 = Distance(PointA=item_9.Item, PointB=item_9.Item1)  # disabled
nullrep = ReplaceNulls(Items=dist_2, Replacements=dist)  # -> Items, Count; disabled
round = Round(Number=dist)  # -> Nearest, Floor, Ceiling; disabled
round_2 = Round(Number=nullrep.Items)  # -> Nearest, Floor, Ceiling; disabled
expression = Expression(x=round.Nearest, y=round_2.Nearest, Expression="If( x = y, 0, -1 )")  # -> flatten(R); disabled
panel_2 = Panel(expression)  # disabled

# ---- group: Fitness / DifferenceBetweenNumberOfFloors
int = Integer(genelist_e)
crossref = CrossReference(ListListA=int, ListListB=int, CrossMode=2)  # -> graft(ListListA), graft(ListListB)
int_2 = Integer(simplify([crossref.ListListA, crossref.ListListB]))
item_10 = ListItem(List=int_2, Index=0, Wrap=True)  # -> Item, Item1
subtraction_2 = Subtraction(A=item_10.Item, B=item_10.Item1)  # -> flatten(Result)
expression_2 = Expression(x=subtraction_2, y=Slider(5, range=0..10), Expression="If( Abs( x ) < y, -5, 0 )")
nullrep_2 = ReplaceNulls(Items=expression_2, Replacements=Slider(0, range=0..100))  # -> Items, Count
panel_3 = Panel(nullrep_2.Items)

# ---- group: Fitness / CloseToEachOtherOffice
flip_2 = FlipMatrix(Data=crv_7)
c_script_4 = CSharpScript(x=flip_2)  # -> A; inputs x: tree of Polyline; same code as c_script_2
crossref_2 = CrossReference(ListListA=c_script_4, ListListB=c_script_4, CrossMode=2)  # -> graft(ListListA), graft(ListListB)
crv_10 = Curve([crossref_2.ListListA, crossref_2.ListListB])
item_11 = ListItem(List=crv_10, Index=0, Wrap=True)  # -> simplify(Item), simplify(Item1)
number_slider_14 = Slider(0.001, range=0..0.001)
crvprox = CurveProximity(CurveA=item_11.Item, CurveB=item_11.Item1)  # -> PointA, PointB, Distance
nullrep_3 = ReplaceNulls(Items=crvprox.Distance, Replacements=number_slider_14)  # -> Items, Count
expression_3 = Expression(x=nullrep_3.Items, y=number_slider_14, z=Slider(5.5, range=0..10), Expression="If( x < z, If( x > y, -7, 0 ), 0 ) ")  # -> flatten(R)
panel_4 = Panel(expression_3)

# ---- group: Fitness / NoOverlappingGeo
crossref_3 = CrossReference(ListListA=c_script_4, ListListB=c_script_4, CrossMode=2)  # -> graft(ListListA), graft(ListListB); disabled
crv_11 = Curve(simplify([crossref_3.ListListA, crossref_3.ListListB]))  # disabled
sdivide_2 = DivideSurface(Surface=crv_11, UCount=10, VCount=10)  # -> simplify(Points), Normals, Parameters; disabled
path_mapper_2 = PathMapper(sdivide_2.Points, source="{A;B;C}", target="{A}")  # disabled
null_2 = NullItem(Item=path_mapper_2)  # -> NullFlags, InvalidFlags, Description; disabled
cull_2 = CullPattern(List=path_mapper_2, CullPattern=invert(null_2.NullFlags))  # disabled
pt_3 = Point(cull_2)  # disabled
item_12 = ListItem(List=crv_11, Index=0, Wrap=True)  # -> Item, Item1; disabled
lng_4 = ListLength(List=pt_3)  # disabled
multiplication_2 = Multiplication(A=lng_4, B=0.5)  # disabled
split = SplitList(List=pt_3, Index=multiplication_2)  # -> simplify(ListA), simplify(ListB); disabled
crv_12 = Curve(item_12.Item)  # disabled
pt_4 = Point(split.ListB)  # disabled
pointinclusion = CSharpScript(pts=pt_4, crv=crv_12)  # -> flatten(A); inputs pts: list of Point3d, crv: Polyline; disabled
# ---------- pointinclusion: C# ----------
    int penalize = 0;

    System.Threading.Tasks.Parallel.ForEach(pts, pt =>
      {

      if( IsInside(pt, crv) )
      {

        System.Threading.Interlocked.Decrement( ref penalize );

      }

      }
      );

    A = penalize;
# ---------- pointinclusion: C# additional code ----------
  bool IsInside (Point3d pt, Polyline crv)
  {
    Point3d pt1, pt2;
    bool oddNodes = false;

    for (int i = 0; i < crv.SegmentCount; i++) //for each contour line
    {

      pt1 = crv.SegmentAt(i).From; //get start and end pt
      pt2 = crv.SegmentAt(i).To;

      if ( (pt1[1] < pt[1] && pt2[1] >= pt[1] || pt2[1] < pt[1] && pt1[1] >= pt[1]) && (pt1[0] <= pt[0] || pt2[0] <= pt[0]) ) //if pt is between pts in y, and either of pts is before pt in x
        oddNodes ^= ( pt2[0] + (pt[1] - pt2[1]) * (pt1[0] - pt2[0]) / (pt1[1] - pt2[1]) < pt[0] ); //^= is xor
      //end.X + (pt-end).Y   * (start-end).X  /(start-end).Y   <   pt.X
    }


    if (!oddNodes)
    {
      double minDist = 1e10;
      for (int i = 0; i < crv.SegmentCount; i++) {
        Point3d cp = crv.SegmentAt(i).ClosestPoint(pt, true);
        //Point3d cp = mvContour[i].closestPoint(pt);
        //minDist = min(minDist, cp.distance(pt));
        minDist = Math.Min(minDist, cp.DistanceTo(pt));
      }
      if (minDist < 1e-10)
        return true;
    }

    if(oddNodes) return true;

    return false;
  }
# ---------- end pointinclusion ----------
panel_5 = Panel(pointinclusion)  # disabled

# ---- group: Fitness / CloseToEachOtherCommercial
c_script_5 = CSharpScript(x=runion_2)  # -> A; inputs x: tree of Polyline; disabled; same code as c_script_2
crossref_4 = CrossReference(ListListA=c_script_5, ListListB=c_script_5, CrossMode=2)  # -> graft(ListListA), graft(ListListB); disabled
crv_13 = Curve([crossref_4.ListListA, crossref_4.ListListB])  # disabled
item_13 = ListItem(List=crv_13, Index=0, Wrap=True)  # -> Item, Item1; disabled
number_slider_15 = Slider(0, range=0..10)  # disabled
number_slider_16 = Slider(0.001, range=0..0.001)  # disabled
crvprox_2 = CurveProximity(CurveA=item_13.Item, CurveB=item_13.Item1)  # -> PointA, PointB, Distance; disabled
nullrep_4 = ReplaceNulls(Items=crvprox_2.Distance, Replacements=number_slider_15)  # -> Items, Count; disabled
expression_4 = Expression(x=nullrep_4.Items, y=number_slider_16, Expression="If( x > y, -7, 0 )")  # -> flatten(R); disabled
panel_6 = Panel(expression_4)  # disabled

# ----
number_slider_17 = Slider(2, range=0..10)

# ---- group: Fitness / CommercialAreaRange
area_4 = Area(Geometry=flatten(runion_2), UseTasks=False)  # -> Area, Centroid
ma_5 = MassAddition(Input=area_4.Area)  # -> Result, PartialResults
addition_2 = Addition(A=ma.Result, B=ma_5.Result)
number_slider_18 = Slider(23000, range=0..100000)  # disabled
number_slider_19 = Slider(25000, range=0..100000)  # disabled
expression_5 = Expression(x=addition_2, y=number_slider_18, z=number_slider_19, Expression="If( ( x ≤ z ) And ( x ≥ y ), 0, -100 )")  # -> flatten(Result); disabled
panel_7 = Panel(addition_2)  # disabled

# ---- group: Fitness / RectangularFloorPlans
crv_14 = Curve(crv_6)
disc_4 = Discontinuity(Curve=crv_14, Level=3)  # -> Points, Parameters
lng_5 = ListLength(List=disc_4.Points)
expression_6 = Expression(x=lng_5, y=Slider(4, range=0..10), Expression="If( x ≠ y, -50, 0 )")  # -> flatten(R)
panel_8 = Panel(expression_6)

# ---- group: Fitness / TotalArea
addition_3 = Addition(A=addition_2, B=ma_4.Result)
expression_7 = Expression(
    x=addition_3,
    y=Slider(83000, range=0..100000),
    z=Slider(85799, range=0..100000),
    Expression="If( ( x ≤ z ) And ( x ≥ y ), 0, -100 )")  # -> flatten(Result)
panel_9 = Panel(addition_3)

# ---- group: Fitness / NoSmallBuildings
area_5 = Area(Geometry=crv_6)  # -> Area, Centroid
expression_8 = Expression(x=area_5.Area, y=Slider(695, range=0..1000), Expression="If( x < y, -2, 0 )")  # -> flatten(R)
panel_10 = Panel(expression_8)

# ---- group: Fitness / UniformCommercialArea
disc_5 = Discontinuity(Curve=item_5, Level=3)  # -> Points, Parameters; disabled
penalizemorepoints = CSharpScript(points=disc_5.Points)  # -> penalty; inputs points: list of Point3d; disabled
# ---------- penalizemorepoints: C# ----------
    int penalizer = 0;

    for( int i = 4; i < points.Count; ++i )
    {

      penalizer -= 1;

    }

    penalty = penalizer;
# ---------- end penalizemorepoints ----------
panel_11 = Panel(penalizemorepoints)  # disabled

# ---- group: Fitness / PenalizeBranches
penalizebranches = CSharpScript(x=item_5)  # -> A; inputs x: tree of Polyline; disabled
# ---------- penalizebranches: C# ----------
    int counter = 0;
    
    if( x.BranchCount != 1 )
    {
    
      counter -= 5;
      
    }
    
    A = counter;
# ---------- end penalizebranches ----------
panel_12 = Panel(penalizebranches)  # disabled

# ----
galapagos = Galapagos(fitness=ma_6, gene=[genelist_c, genelist_d, genelist_e, number_slider_3, genelist_f])

# ---- group: Fitness / NoFloatingOfficeBuildings
srf_8 = Surface(<surface referenced from the Rhino model>)
rint_3 = RegionIntersection(CurvesA=srf, CurvesB=srf_8)
crv_15 = Curve(rint_3)
offset = OffsetCurve(Curve=crv_15, Distance=Slider(3.5, range=0..10), Plane=PlaneXY(0, 0, 0), Corners=1)
project_2 = Project(Geometry=crv_7, Plane=PlaneXY(0, 0, 0))  # -> Geometry, Transform
disc_6 = Discontinuity(Curve=flatten(offset), Level=1)  # -> Points, Parameters
rint_4 = RegionIntersection(CurvesA=offset, CurvesB=project_2.Geometry)
item_14 = ListItem(List=disc_6.Points, Index=0, Wrap=True)  # -> Item, Item1, Item2
disc_7 = Discontinuity(Curve=rint_4, Level=3)  # -> simplify(Points), Parameters
sortbranchaccordingtonumberofpoints = CSharpScript(x=disc_7.Points)  # -> A, B, C; inputs x: tree of Point3d
# ---------- sortbranchaccordingtonumberofpoints: C# ----------
    int count = x.BranchCount;

    var treeOut = new DataTree<Point3d>();
    var itemsOfBranch = new int[count];
    var index = new int[count];

    for( int i = 0; i < count; ++i )
    {

      itemsOfBranch[i] = x.Branch(i).Count;
      index[i] = i;

    }

    Array.Sort(itemsOfBranch, index);

    for( int i = 0; i < count; ++i )
    {

      treeOut.AddRange(x.Branch(index[i]), new GH_Path(i));

    }

    A = treeOut;
    B = itemsOfBranch;
    C = count;
# ---------- end sortbranchaccordingtonumberofpoints ----------
pdecon = Deconstruct(Point=disc_7.Points)  # -> XComponent, YComponent, ZComponent
ln = Line(StartPoint=item_14.Item1, EndPoint=item_14.Item2)
dist_3 = Distance(PointA=item_14.Item1, PointB=item_14.Item2)
path = ConstructPath(Indices=expr("x-1", sortbranchaccordingtonumberofpoints.C))
addition_4 = Addition(A=pdecon.XComponent, B=Slider(1000, range=0..1000))
multiplication_3 = Multiplication(A=pdecon.YComponent, B=addition_4)
branch = TreeBranch(Tree=sortbranchaccordingtonumberofpoints.A, Path=path, MaintainPaths=True)
sort = SortList(Keys=multiplication_3, ValuesA=disc_7.Points)  # -> Keys, ValuesA
round_3 = Round(Number=dist_3)  # -> Nearest, Floor, Ceiling

# ----
lng_6 = ListLength(List=branch)
item_15 = ListItem(List=sort.ValuesA, Index=expr("x-2", lng_6), Wrap=True)
item_16 = ListItem(List=sort.ValuesA, Index=expr("x-1", lng_6), Wrap=True)

# ---- group: Fitness / NoFloatingOfficeBuildings (continued)
dist_4 = Distance(PointA=item_15, PointB=item_16)
ln_2 = Line(StartPoint=item_15, EndPoint=item_16)
nullrep_5 = ReplaceNulls(Items=dist_4, Replacements=dist_3)  # -> Items, Count
round_4 = Round(Number=nullrep_5.Items)  # -> Nearest, Floor, Ceiling
expression_9 = Expression(x=round_3.Nearest, y=round_4.Nearest, Expression="If( x = y, 0, -50 )")  # -> flatten(R)
panel_13 = Panel(expression_9)

# ---- group: Fitness
ma_6 = MassAddition(Input=flatten([expression_6, expression_8, expression_9, expression_5, expression_7, nullrep_2.Items, penalizemorepoints, penalizebranches, expression_4, expression, expression_3, pointinclusion]))  # -> Result, PartialResults
panel_14 = Panel(ma_6.Result)

# ==== cluster ReparametrizeCurve
curve = ClusterInput()
discontinuity = Discontinuity(Curve=curve, Level=1)  # -> Points, Parameters
area = Area(Geometry=curve, UseTasks=False)  # -> Area, Centroid
list_item = ListItem(List=discontinuity.Points, Index=0, Wrap=True)  # -> Item, Item1, Item2, Item3
point = Point(list_item.Item)
point_2 = Point(list_item.Item1)
point_3 = Point(list_item.Item2)
point_4 = Point(list_item.Item3)
point_5 = Point(area.Centroid)
vector_2pt = Vector2Pt(PointA=point, PointB=point_2, Unitize=False)  # -> Vector, Length
vector_2pt_2 = Vector2Pt(PointA=point, PointB=point_5, Unitize=False)  # -> Vector, Length
move = Move(Geometry=point_5, Motion=expr("x*0.5", vector_2pt.Vector))  # -> Geometry, Transform
move_2 = Move(Geometry=point, Motion=expr("x*0.5", vector_2pt_2.Vector))  # -> Geometry, Transform
move_3 = Move(Geometry=point, Motion=expr("x*0.5", vector_2pt.Vector))  # -> Geometry, Transform
domain_start = ClusterInput()
domain_end = ClusterInput()
domain_start_2 = ClusterInput()
domain_end_2 = ClusterInput()
construct_domain = ConstructDomain(DomainStart=expr("-x", domain_start), DomainEnd=domain_end)
construct_domain_2 = ConstructDomain(DomainStart=expr("-x", domain_start_2), DomainEnd=domain_end_2)
plane_3pt = Plane3Pt(PointA=point_5, PointB=move_3.Geometry, PointC=move.Geometry)
domain = ClusterOutput(construct_domain)
domain_2 = ClusterOutput(construct_domain_2)
plane = ClusterOutput(plane_3pt)
