# Grasshopper definition Final[2] .gh (Grasshopper 1.0.7)
# plug-ins: FloorsAndVolumes

# ---- group: ModifyGenePools / NumberOfTowers
numberoftowers = Slider(3, range=1..3)

# ---- group: Platform / TamañoPlanta
number_slider = Slider(37.442, range=0..100)
number_slider_2 = Slider(7.676, range=0..100)

# ----
number_slider_3 = Slider(0.33, range=0..0.7)  # disabled
number_slider_4 = Slider(0.35, range=0..0.5)  # disabled

# ---- group: SizeOfRectangles
genelist_c = GenePool(Decimals=2, Maximum=40, Minimum=10, Value=[29.49578118, 21.80843574, 37.95997168])  # disabled
genelist_d = GenePool(Decimals=2, Maximum=40, Minimum=10, Value=[24.39375121, 23.20426965, 32.45218124])  # disabled
dom = ConstructDomain(DomainStart=expr("-x", genelist_c), DomainEnd=genelist_c)  # -> graft(Domain); disabled
dom_2 = ConstructDomain(DomainStart=expr("-x", genelist_d), DomainEnd=genelist_d)  # -> graft(Domain); disabled

# ---- group: Platform / NumeroDePisosAlturaEntreFinoYFino
number_slider_5 = Slider(3, range=0..10)
number_slider_6 = Slider(5.797, range=0..10)

# ---- group: Platform
dom_3 = ConstructDomain(DomainStart=expr("-x", number_slider), DomainEnd=number_slider)
dom_4 = ConstructDomain(DomainStart=expr("-x", number_slider_2), DomainEnd=number_slider_2)
srf = Surface(<surface referenced from the Rhino model>)
reparametrizecurve = ReparametrizeCurve(curve=srf, domain_start_2=dom_3, domain_end_2=dom_3, domain_start=dom_4, domain_end=dom_4)  # -> plane, domain_2, domain
rectangle = Rectangle(Plane=reparametrizecurve.plane, XSize=reparametrizecurve.domain_2, YSize=reparametrizecurve.domain, Radius=0)  # -> Rectangle, Length
srf_2 = Surface(<surface referenced from the Rhino model>)
sint = SolidIntersection(BrepsA=rectangle.Rectangle, BrepsB=srf_2)
item = ListItem(List=sint, Index=Slider(1, range=0..1), Wrap=True)
subtraction = Subtraction(A=number_slider_5, B=1)
series = Series(Start=0, Step=number_slider_6, Count=number_slider_5)
multiplication = Multiplication(A=number_slider_6, B=subtraction)
Z = UnitZ(Factor=series)
move = Move(Geometry=item, Motion=Z)  # -> Geometry, Transform
Z_2 = UnitZ(Factor=multiplication)
lng = ListLength(List=move.Geometry)
srf_3 = Surface(move.Geometry)
cull_i = CullIndex(List=move.Geometry, Indices=expr("x-1", lng), Wrap=True)
area = Area(Geometry=cull_i, UseTasks=False)  # -> Area, Centroid
loft = Loft(Curves=move.Geometry, Options={Adjust=False, Closed=False, LoftEnds=0, LoftSimp=0, LoftType=0, Rebuild=10, Refit=0.01})
ma = MassAddition(Input=flatten(area.Area))  # -> Result, PartialResults
area_2 = Area(Geometry=move.Geometry, UseTasks=False)  # -> Area, Centroid
item_2 = ListItem(List=area_2.Area, Index=0, Wrap=True)  # -> Item, Item1
ma_2 = MassAddition(Input=flatten([item_2.Item, item_2.Item1]))  # -> Result, PartialResults
cap = CapHoles(Brep=loft)
number_slider_7 = Slider(1, range=0..1)
number_slider_8 = Slider(0, range=0..1)
number_slider_9 = Slider(0, range=0..1)
frgb = ColourRGBF(Alpha=Slider(0.191, range=0..1), Red=number_slider_7, Green=number_slider_9, Blue=number_slider_8)
frgb_2 = ColourRGBF(Alpha=Slider(0.223, range=0..1), Red=number_slider_7, Green=number_slider_9, Blue=number_slider_8)
preview = CustomPreview(Geometry=srf_3, Material=frgb)
preview_2 = CustomPreview(Geometry=cap, Material=frgb_2)
panel = Panel(ma_2.Result)

# ----
Z_3 = UnitZ(Factor=1)
panel_2 = Panel("{0}")  # disabled
number_slider_10 = Slider(0.484, range=0..1)  # disabled
number_slider_11 = Slider(0.49, range=0..1)  # disabled
number_slider_12 = Slider(0.5945, range=0..1)  # disabled
c_script = CSharpScript(percentage=number_slider_11)  # -> domains; inputs pointOne: Point3d, pointTwo: Point3d, percentage: Double; disabled
# ---------- c_script: C# ----------
    Point3d point = new Point3d(dist(pointOne.X, pointTwo.X), dist(pointOne.Y, pointTwo.Y), 0);
    NurbsCurve line = new Line(pointOne, point).ToNurbsCurve();

    double t = 0;

    line.ClosestPoint(pointTwo, out t);

    Point3d pointOut = line.PointAt(t);

    double total = 1.0 - percentage;
    
    double distance = pointOut.DistanceTo(pointOne);
    double distanceOne = distance * percentage;
    double distanceTwo = distance * total;

    Interval[] interval = new Interval[2];
    interval[0] = new Interval(-distanceOne, distanceOne);
    interval[1] = new Interval(-distanceTwo, distanceTwo);
    
    domains = interval;
# ---------- c_script: C# additional code ----------
  private double dist(double x, double y)
  {

    return Math.Abs(x - y);

  }
# ---------- end c_script ----------
number_slider_13 = Slider(29, range=0..100)  # disabled
number_slider_14 = Slider(20, range=0..100)
dom_5 = ConstructDomain(DomainStart=expr("-x", number_slider_13), DomainEnd=number_slider_13)  # disabled
number_slider_15 = Slider(0.4997, range=0..1)  # disabled
dom_6 = ConstructDomain(DomainStart=expr("-x", number_slider_14), DomainEnd=number_slider_14)  # -> graft(Domain)
number_slider_16 = Slider(1.5, range=0..10)  # disabled
addition = Addition()
number_slider_17 = Slider(1.4, range=0.8..1.4)  # disabled
number_slider_18 = Slider(0.8, range=0.8..1.4)  # disabled
number_slider_19 = Slider(1.4, range=0.8..1.4)  # disabled
number_slider_20 = Slider(0.8, range=0.8..1.4)  # disabled
number_slider_21 = Slider(40, range=0..100)
panel_3 = Panel("""7
8
3
5""")
panel_4 = Panel("GenePool H")  # disabled
panel_5 = Panel("GenePool G")  # disabled
dom_7 = ConstructDomain(DomainStart=number_slider_18, DomainEnd=number_slider_17)  # disabled
dom_8 = ConstructDomain(DomainStart=number_slider_20, DomainEnd=number_slider_19)  # disabled

# ---- group: Commercial
number_slider_22 = Slider(6, range=0..10)
number_slider_23 = Slider(4, range=4..8)
series_2 = Series(Start=Z_2, Step=number_slider_22, Count=number_slider_23)
Z_4 = UnitZ(Factor=series_2)

# ----
construct_domain = ConstructDomain(DomainStart=expr("-x", number_slider_21), DomainEnd=number_slider_21)
genepool_g = GenePool(Decimals=2, Maximum=1.4, Minimum=0.8, Value=[1.4, 1.4, 1.4])  # disabled
genemodifier = GenePoolModifier(GeneList=panel_4, Count=numberoftowers, Domain=dom_7)  # disabled
genepool_h = GenePool(Decimals=2, Maximum=1.4, Minimum=0.8, Value=[1.4, 1.4, 1.4])  # disabled
genemodifier_2 = GenePoolModifier(GeneList=panel_5, Count=numberoftowers, Domain=dom_8)  # disabled
number_slider_24 = Slider(0.5, range=0..1)  # disabled
number_slider_25 = Slider(24.676, range=0..30)
number_slider_26 = Slider(0.6, range=0..1)
number_slider_27 = Slider(0.4, range=0..1)
number_slider_28 = Slider(1, range=0..2)
number_slider_29 = Slider(0.3, range=0..1)
dom_9 = ConstructDomain(DomainStart=expr("-x", number_slider_25), DomainEnd=number_slider_25)
number_slider_30 = Slider(1, range=0..2)
subtraction_2 = Subtraction(A=Slider(1, range=0..1.4), B=number_slider_26)
golden_ratio = GoldenRatio(Factor=1)
golden_ratio_2 = GoldenRatio(Factor=1)
subtraction_3 = Subtraction(A=number_slider_28, B=number_slider_27)
subtraction_4 = Subtraction(A=number_slider_28, B=number_slider_29)
number_slider_31 = Slider(10, range=0..50)
construct_domain_2 = ConstructDomain(DomainStart=expr("-x", number_slider_31), DomainEnd=number_slider_31)
number_slider_32 = Slider(100, range=0..100)
number_slider_33 = Slider(0.89, range=0..1)
number_slider_34 = Slider(1, range=0..1)
subtraction_5 = Subtraction()
number_slider_35 = Slider(1, range=0..1)
galapagos = Galapagos(fitness=ma_6, gene=[genelist_c, genelist_d, genelist_e, number_slider_36, genelist_f])

# ---- group: WhereToPlaceRectangles
crv = Curve(<curve referenced from the Rhino model>)
crv_2 = Curve(<curve referenced from the Rhino model>)
crv_3 = Curve(<curve referenced from the Rhino model>)
number_slider_36 = Slider(7, range=0..10)
crv_4 = Curve([crv, crv_2, crv_3])
shift = ShiftList(List=crv_4, Shift=number_slider_36, Wrap=True)
genelist_f = GenePool(Decimals=0, Maximum=1825, Minimum=0, Value=[1685.867013, 541.6217538, 702.1719988])
crv_5 = Curve(flatten(shift))
number_slider_37 = Slider(50, range=0..100)
runion = RegionUnion(Curves=crv_5)
srf_4 = Surface(runion)
sdivide = DivideSurface(Surface=srf_4, UCount=number_slider_37, VCount=number_slider_37)  # -> Points, Normals, Parameters
disc = Discontinuity(Curve=runion, Level=1)  # -> Points, Parameters
null = NullItem(Item=sdivide.Points)  # -> NullFlags, InvalidFlags, Description
cull = CullPattern(List=sdivide.Points, CullPattern=invert(null.NullFlags))
item_3 = ListItem(List=disc.Points, Index=0, Wrap=True)  # -> Item, Item1, Item2
item_4 = ListItem(List=flatten(cull), Index=genelist_f, Wrap=True)
vec2pt = Vector2Pt(PointA=item_3.Item, PointB=item_3.Item1, Unitize=False)  # -> Vector, Length
vec2pt_2 = Vector2Pt(PointA=item_3.Item1, PointB=item_3.Item2, Unitize=False)  # -> Vector, Length

# ---- group: ModifyGenePools
lng_2 = ListLength(List=flatten(cull))
dom_10 = ConstructDomain(DomainStart=Slider(10, range=0..100), DomainEnd=Slider(40, range=0..40))
dom_11 = ConstructDomain(DomainStart=Slider(10, range=0..100), DomainEnd=Slider(40, range=0..40))
dom_12 = ConstructDomain(DomainStart=Slider(0, range=0..100), DomainEnd=lng_2)
genemodifier_3 = GenePoolModifier(GeneList="GeneList C", Count=numberoftowers, Domain=dom_10)
genemodifier_4 = GenePoolModifier(GeneList="GeneList D", Count=numberoftowers, Domain=dom_10)
genemodifier_5 = GenePoolModifier(GeneList="GeneList E", Count=numberoftowers, Domain=dom_11)
genemodifier_6 = GenePoolModifier(GeneList="GeneList F", Count=numberoftowers, Domain=dom_12)

# ----
multiplication_2 = Multiplication(A=vec2pt.Vector, B=number_slider_3)  # disabled
area_3 = Area(Geometry=crv_2, UseTasks=False)  # -> Area, Centroid; disabled
move_2 = Move(Geometry=area_3.Centroid, Motion=multiplication_2)  # -> Geometry, Transform; disabled
graft = GraftTree(Tree=item_4, IncludeEmptyLists=True, IncludeNullItems=True)
shift_2 = ShiftList(List=flatten(graft), Shift=1, Wrap=True)  # disabled
panel_6 = Panel(item_4)

# ---- group: WhereToPlaceRectangles (continued)
pl = ConstructPlane(Origin=graft, XAxis=vec2pt.Vector, YAxis=vec2pt_2.Vector)  # -> simplify(Plane)

# ----
vec2pt_3 = Vector2Pt(PointA=item_4, PointB=shift_2, Unitize=False)  # -> Vector, Length; disabled
xprod = CrossProduct(VectorA=vec2pt.Vector, VectorB=Z_3, Unitize=False)  # -> expr("-x", Vector), Length
multiplication_3 = Multiplication(A=xprod.Vector, B=number_slider_4)  # disabled
addition_2 = Addition(A=multiplication_2, B=multiplication_3)  # disabled
move_3 = Move(Geometry=area_3.Centroid, Motion=multiplication_3)  # -> Geometry, Transform; disabled
pt = Point([area_3.Centroid, move_2.Geometry, move_3.Geometry])  # disabled
vdis = VectorDisplay(Anchor=area_3.Centroid, Vector=vec2pt.Vector)  # disabled
pt_2 = Point(pl)  # disabled
vdis_2 = VectorDisplay(Anchor=area_3.Centroid, Vector=xprod.Vector)  # disabled
branch = TreeBranch(Tree=pl, Path=panel_2, MaintainPaths=True)  # disabled
pln = Plane(pl)
pt_3 = Point(flatten([area_3.Centroid, move_2.Geometry]))  # disabled
vdis_3 = VectorDisplay(Anchor=item_4, Vector=vec2pt_3.Vector)
item_5 = ListItem(List=pln, Index=0, Wrap=True)  # -> Item, Item1, Item2
c_script_2 = CSharpScript(points=pt_3, vector=vec2pt.Vector, percentage=number_slider_12)  # -> rectangles; inputs points: list of Point3d, vector: Vector3d, percentage: Double; disabled
# ---------- c_script_2: C# ----------
    Point3d pointOne = points[0];
    Point3d pointTwo = points[1];
    
    Rhino.Geometry.Point p = new Point( pointOne );
    p.Translate( -vector );
    
    Point3d pointTranslate = p.Location;
    
    NurbsCurve curve = new Line( pointTwo, pointTranslate ).ToNurbsCurve();
    double t = 0.0;
    curve.ClosestPoint( pointOne, out t );
    Point3d pt = curve.PointAt( t );
    
    double total = 1.0 - percentage;
    
    double distance = pt.DistanceTo( pointTwo );
    double distanceOne = distance * percentage;
    double distanceTwo = distance * total;
    
    Interval[] inter = new Interval[2];
    
    inter[0] = new Interval( -distanceOne, distanceOne );
    inter[1] = new Interval( -distanceTwo, distanceTwo );
    
    rectangles = inter;
# ---------- end c_script_2 ----------
pt_4 = Point(pln)
flatten_tree = FlattenTree(Tree=pt_4, Path="{0}")
pline = PolyLine(Vertices=flatten(flatten_tree), Closed=True)
deconstruct = Deconstruct(Point=pt_4)  # -> XComponent, YComponent, ZComponent
pl_2 = ConstructPlane(Origin=[area_3.Centroid, move_2.Geometry], XAxis=vec2pt.Vector, YAxis=vec2pt_2.Vector)  # disabled
bbox = BoundingBox(Content=flatten(pline), Plane=branch, UnionBox=False)  # -> Box, Box_2
addition_3 = Addition(A=deconstruct.YComponent, B=Slider(1000, range=0..1000))
debox = DeconstructBox(Box=bbox.Box)  # -> Plane, X, Y, Z
dedomain = DeconstructDomain(Domain=debox.Y)  # -> Start, End
dedomain_2 = DeconstructDomain(Domain=debox.X)  # -> Start, End
pt_5 = Point(debox.Plane)
multiplication_4 = Multiplication(A=dedomain.Start, B=0.5)
pdecon = Deconstruct(Point=pt_5)  # -> XComponent, YComponent, ZComponent
multiplication_5 = Multiplication(A=dedomain.End, B=0.5)
item_6 = ListItem(List=pt_4, Index=0, Wrap=True)  # -> Item, Item1, Item2
multiplication_6 = Multiplication(A=dedomain_2.Start, B=0.5)
item_7 = ListItem(List=pt_4, Index=0, Wrap=True)  # -> Item, Item1, Item2
multiplication_7 = Multiplication(A=dedomain_2.End, B=0.5)
flatten = FlattenTree(Tree=pl, Path="{0}")  # disabled
shift_3 = ShiftList(List=pt_4, Shift=1, Wrap=True)
bnd = Bounds2D(Coordinates=flatten(pt_2))  # disabled
sort_list = SortList(Keys=addition_3, ValuesA=pt_4)  # -> Keys, ValuesA
runion_2 = RegionUnion(Curves=crv_5)
srf_5 = Surface(runion_2)
rectangle_2 = Rectangle(Plane=flatten(pl_2), XSize=c_script_2, YSize=c_script_2, Radius=0)  # -> Rectangle, Length; disabled
rectangle_3 = Rectangle(Plane=debox.Plane, XSize=debox.X, YSize=debox.Y, Radius=0)  # -> Rectangle, Length
pt_6 = Point(item_6.Item2)
pt_7 = Point(item_6.Item1)
pt_8 = Point(item_6.Item)
vdis_4 = VectorDisplay(Anchor=area_3.Centroid, Vector=xprod.Vector)  # disabled
dom_13 = ConstructDomain(DomainStart=multiplication_4, DomainEnd=multiplication_5)
dom_14 = ConstructDomain(DomainStart=multiplication_6, DomainEnd=multiplication_7)
item_8 = ListItem(List=flatten, Index=0, Wrap=True)  # -> Item, Item1, Item2; disabled
pt_9 = Point(item_8.Item1)  # disabled
pt_10 = Point(item_8.Item2)  # disabled
pt_11 = Point(item_8.Item1)  # disabled
pt_12 = Point(item_8.Item)  # disabled
pt_13 = Point([pt_12, pt_11])  # disabled
move_4 = Move(Geometry=pt_11, Motion=xprod.Vector)  # -> Geometry, Transform; disabled
rectangle_4 = Rectangle(Plane=flatten([item_8.Item, item_8.Item2]), XSize=c_script, YSize=c_script, Radius=0)  # -> Rectangle, Length; disabled
pt_14 = Point(flatten)  # disabled
deconstruct_2 = Deconstruct(Point=pt_8)  # -> XComponent, YComponent, ZComponent
shift_4 = ShiftList(List=pt_14, Shift=1, Wrap=True)  # disabled
vector = Vector(expr("-x", [vec2pt.Vector, xprod.Vector]))
pt_15 = ConstructPoint(XCoordinate=dom_14, YCoordinate=dom_13, ZCoordinate=0)
vector_2 = Vector([vec2pt.Vector, xprod.Vector])
disc_2 = Discontinuity(Curve=rectangle_3.Rectangle, Level=1)  # -> flatten(Points), Parameters
rectangle_5 = Rectangle(Plane=debox.Plane, XSize=debox.X, YSize=debox.Y, Radius=0)  # -> Rectangle, Length
rectangle_6 = Rectangle(Plane=pl, XSize=dom_6, YSize=dom_6, Radius=0)  # -> Rectangle, Length
points = PointList(Points=pt_14, Size=number_slider_16)  # disabled
points_2 = PointList(Points=shift_4, Size=number_slider_16)  # disabled

# ---- group: y
vector_3 = Vector(expr("x*10.0", vec2pt.Vector))
vector_4 = Vector(expr("-x", vector_3))

# ---- group: x
vector_5 = Vector(expr("x*10.0", vec2pt_2.Vector))
vector_6 = Vector(expr("-x", vector_5))

# ----
item_9 = ListItem(List=sort_list.ValuesA, Index=0, Wrap=True)  # -> Item, Item1, Item2
ln = Line(StartPoint=pt_15)
pt_16 = Point(item_8.Item)  # disabled
c_script_3 = CSharpScript(pointOne=pt_16, pointTwo=pt_9, percentage=number_slider_10)  # -> domains; inputs pointOne: Point3d, pointTwo: Point3d, percentage: Double; disabled
# ---------- c_script_3: C# ----------
    Point3d point = new Point3d(dist(pointOne.X, pointTwo.X), dist(pointOne.Y, pointTwo.Y), 0);
    NurbsCurve line = new Line(pointOne, point).ToNurbsCurve();

    double t = 0;

    line.ClosestPoint(pointTwo, out t);

    Point3d pointOut = line.PointAt(t);

    double total = 1.0 - percentage;

    double distance = pointOut.DistanceTo(pointOne);
    double distanceOne = distance * percentage;
    double distanceTwo = distance * total;

    Interval[] interval = new Interval[2];
    interval[0] = new Interval(-distanceOne, distanceOne);
    interval[1] = new Interval(-distanceTwo, distanceTwo);

    domains = line;
# ---------- c_script_3: C# additional code ----------
  private double dist(double x, double y)
  {

    return Math.Abs(x - y);

  }
# ---------- end c_script_3 ----------
pt_17 = Point([pt_16, pt_9])  # disabled
c_script_4 = CSharpScript(points=pt_17, vector=vec2pt.Vector, percentage=number_slider_15)  # -> rectangles; inputs points: list of Point3d, vector: Vector3d, percentage: Double; disabled
# ---------- c_script_4: C# ----------
    Point3d pointOne = points[0];
    Point3d pointTwo = points[1];

    Rhino.Geometry.Point p = new Point(pointOne);
    p.Translate(-vector);

    Point3d pointTranslate = p.Location;

    NurbsCurve curve = new Line(pointTwo, pointTranslate).ToNurbsCurve();
    double t = 0.0;
    curve.ClosestPoint(pointOne, out t);
    Point3d pt = curve.PointAt(t);

    double total = 1.0 - percentage;

    double distance = pt.DistanceTo(pointTwo);
    double distanceOne = distance * percentage;
    double distanceTwo = distance * total;

    Interval[] inter = new Interval[2];

    inter[0] = new Interval(-distanceOne, distanceOne);
    inter[1] = new Interval(-distanceTwo, distanceTwo);

    rectangles = inter;
# ---------- end c_script_4 ----------
pt_18 = Point(item_8.Item1)  # disabled
pt_19 = Point(item_8.Item2)  # disabled
vec2pt_4 = Vector2Pt(PointA=pt_8, PointB=[pt_7, pt_6], Unitize=False)  # -> Vector, Length
vector_7 = Vector([vector_5, vector_6, vector_3, vector_4])
pt_20 = Point(pln)
shift_5 = ShiftList(List=disc_2.Points, Shift=1, Wrap=True)
point_list = PointList(Points=flatten_tree, Size=Slider(1.5, range=0..10))
vdis_5 = VectorDisplay(Anchor=pt_8, Vector=vec2pt_4.Vector)
curve = Curve(runion)
points_3 = PointList(Points=disc_2.Points, Size=Slider(1.5, range=0..10))
move_5 = Move(Geometry=pt_20, Motion=vector_7)  # -> Geometry, Transform
rectangle_7 = Rectangle(Plane=flatten(pl_2), XSize=c_script_4, YSize=c_script_4, Radius=0)  # -> Rectangle, Length; disabled
pdecon_2 = Deconstruct(Point=vec2pt_4.Vector)  # -> XComponent, YComponent, ZComponent
explode_tree = ExplodeTree(Data=pt_20)  # -> Branch0, Branch1, Branch2
region_intersection = RegionIntersection(CurvesA=rectangle_6.Rectangle, CurvesB=curve)
pdecon_3 = Deconstruct(Point=shift_4)  # -> XComponent, YComponent, ZComponent; disabled
brep_wireframe = BrepWireframe(Brep=curve, Density=-1)
pdecon_4 = Deconstruct(Point=pt_14)  # -> XComponent, YComponent, ZComponent; disabled
surface = Surface(curve)
rectangle_8 = Rectangle(Plane=pln, XSize=construct_domain, YSize=construct_domain, Radius=0)  # -> Rectangle, Length
ln_2 = Line(StartPoint=disc_2.Points, EndPoint=shift_5)
point = Point(explode_tree.Branch0)
expression = Expression(x=pdecon_3.YComponent, y=pdecon_4.YComponent, Expression="(x-y)")  # disabled
expression_2 = Expression(x=pdecon_3.XComponent, y=pdecon_4.XComponent, Expression="(x-y)")  # disabled
panel_7 = Panel(expression_2)  # disabled
vec2pt_5 = Vector2Pt(PointA=pt_14, PointB=shift_4, Unitize=False)  # -> Vector, Length; disabled
list_item = ListItem(List=brep_wireframe, Index=Slider(7, range=0..10), Wrap=True)  # -> Item, Item1
list_item_2 = ListItem(List=brep_wireframe, Index=Slider(3, range=0..10), Wrap=True)  # -> Item, Item1, Item2
curve_closest_point = CurveClosestPoint(Point=pt_4, Curve=curve)  # -> flatten(Point), Parameter, Distance
curve_closest_point_2 = CurveClosestPoint(Point=pt_4, Curve=curve)  # -> flatten(Point), Parameter, Distance
list_item_3 = ListItem(List=brep_wireframe, Index=Slider(7, range=0..10), Wrap=True)  # -> Item, Item1
list_item_4 = ListItem(List=brep_wireframe, Index=Slider(6, range=0..10), Wrap=True)
list_item_5 = ListItem(List=ln_2, Index=0, Wrap=True)  # -> Item, Item1
cull_index = CullIndex(List=brep_wireframe, Indices=panel_3, Wrap=True)
dom_15 = ConstructDomain(DomainStart=expr("-x", pdecon_2.XComponent), DomainEnd=pdecon_2.XComponent)  # -> graft(Domain)
dom_16 = ConstructDomain(DomainStart=expr("-x", pdecon_2.YComponent), DomainEnd=pdecon_2.YComponent)  # -> graft(Domain)
pt_21 = ConstructPoint(XCoordinate=expression_2, YCoordinate=expression, ZCoordinate=0)  # disabled
num = Number(expression)  # disabled
list_item_6 = ListItem(List=move_5.Geometry, Index=0, Wrap=True)  # -> Item, Item1, Item2, Item3
join_curves = JoinCurves(Curves=[list_item_3.Item, list_item_3.Item1], Preserve=False)
join_curves_2 = JoinCurves(Curves=[list_item.Item, list_item.Item1], Preserve=False)
c_script_5 = CSharpScript(pointOne=item_9.Item, pointTwo=item_9.Item1)  # -> pointOut; inputs pointOne: Point3d, pointTwo: Point3d
# ---------- c_script_5: C# ----------
    double slope = gradient(pointOne, pointTwo);

    Point3d point = new Point3d();

    if( slope <= 0.0 )
    {

      point.X = Math.Max(pointOne.X, pointTwo.X);
      point.Y = Math.Max(pointOne.Y, pointTwo.Y);

    }

    else
    {

      point.X = Math.Min(pointOne.X, pointTwo.X);
      point.Y = Math.Max(pointOne.Y, pointTwo.Y);

    }

    pointOut = point;
# ---------- c_script_5: C# additional code ----------
  private double gradient(Point3d pointOne, Point3d pointTwo)
  {

    double y = pointTwo.Y - pointOne.Y;
    double x = pointTwo.X - pointOne.X;

    return y / x;

  }
# ---------- end c_script_5 ----------
c_script_6 = CSharpScript(pointOne=item_9.Item1, pointTwo=item_9.Item2)  # -> pointOut; inputs pointOne: Point3d, pointTwo: Point3d; same code as c_script_5
rectangle_9 = Rectangle(Plane=graft([item_5.Item1, item_5.Item2, item_5.Item]), XSize=dom_15, YSize=dom_16, Radius=0)  # -> Rectangle, Length
ln_3 = Line(StartPoint=pt_16, EndPoint=pt_21)  # disabled
line = Line(StartPoint=[list_item_6.Item, list_item_6.Item2], EndPoint=[list_item_6.Item1, list_item_6.Item3])
curve_2 = Curve(reparameterize([list_item_2.Item, list_item_2.Item2, join_curves_2]))
curve_closest_point_3 = CurveClosestPoint(Point=flatten(pt_4), Curve=join_curves)  # -> flatten(Point), Parameter, Distance
deconstruct_3 = Deconstruct(Point=curve_closest_point_3.Point)  # -> XComponent, YComponent, ZComponent
curve_closest_point_4 = CurveClosestPoint(Point=flatten(pt_4), Curve=list_item_4)  # -> flatten(Point), Parameter, Distance
deconstruct_4 = Deconstruct(Point=curve_closest_point_4.Point)  # -> XComponent, YComponent, ZComponent
point_2 = Point(flatten(pt_4))
rectangle_10 = Rectangle(Plane=flatten([item_8.Item, item_8.Item2]), XSize=c_script_3, YSize=c_script_3, Radius=0)  # -> Rectangle, Length; disabled
sort_list_2 = SortList(Keys=deconstruct_3.XComponent, ValuesA=curve_closest_point_3.Point)  # -> Keys, ValuesA
sort_list_3 = SortList(Keys=deconstruct_4.YComponent, ValuesValuesA=curve_closest_point_4.Point)  # -> Keys, ValuesValuesA
crv_cp = CurveClosestPoint(Point=pt_11, Curve=ln_3)  # -> Point, Parameter, Distance; disabled
curve_closest_point_5 = CurveClosestPoint(Curve=simplify(graft(cull_index)))  # -> Point, Parameter, Distance

# ---- group: Commercial / Floors
number_slider_38 = Slider(0.5, range=0..1)
pt_22 = ConstructPoint(XCoordinate=number_slider_38, YCoordinate=number_slider_38, ZCoordinate=0)
move_6 = Move(Geometry=runion, Motion=Z_4)  # -> simplify(Geometry), Transform
c_script_7 = CSharpScript(x=move_6.Geometry)  # -> A; inputs x: tree of Polyline
# ---------- c_script_7: C# ----------
    var treeOut = new DataTree<Polyline>();

    for( int i = 0; i < 1; ++i )
      for( int j = 0; j < x.Branch(i).Count; ++j )
      {

        treeOut.Add(x.Branch(i)[j], new GH_Path(i));

      }

    A = treeOut;
# ---------- end c_script_7 ----------
evalsrf = EvaluateSurface(Surface=reparameterize(c_script_7), Point=pt_22)  # -> Point, Normal, UDirection, VDirection, Frame
runion_3 = RegionUnion(Curves=flatten(move_6.Geometry), Plane=flatten(evalsrf.Point))  # -> simplify(Result)
frgb_3 = ColourRGBF(Alpha=Slider(1, range=0..1), Red=Slider(1, range=0..1), Green=Slider(1, range=0..1), Blue=Slider(0, range=0..1))
srf_6 = Surface(runion_3)
preview_3 = CustomPreview(Geometry=srf_6, Material=frgb_3)

# ---- group: Commercial / Volume
flip = FlipMatrix(Data=runion_3)
lng_3 = ListLength(List=flip)
item_10 = ListItem(List=flip, Index=expr("x-1", lng_3), Wrap=True)
Z_5 = UnitZ(Factor=number_slider_22)
move_7 = Move(Geometry=item_10, Motion=Z_5)  # -> Geometry, Transform
loft_2 = Loft(
    Curves=[flip, move_7.Geometry],
    Options={Adjust=False, Closed=False, LoftEnds=0, LoftSimp=0, LoftType=0, Rebuild=10, Refit=0.01})
cap_2 = CapHoles(Brep=loft_2)
frgb_4 = ColourRGBF(Alpha=Slider(0.426, range=0..1), Red=Slider(1, range=0..1), Green=Slider(1, range=0..1), Blue=Slider(0, range=0..1))
preview_4 = CustomPreview(Geometry=cap_2, Material=frgb_4)

# ----
repeat_data = RepeatData(Data=point_2, Length=Slider(9, range=0..10))
curve_closest_point_6 = CurveClosestPoint(Point=pt_4, Curve=simplify(graft(curve_2)))  # -> Point, Parameter, Distance
multiplication_8 = Multiplication(A=vec2pt_5.Length, B=genepool_g)  # disabled
multiplication_9 = Multiplication(A=vec2pt_5.Length, B=genepool_h)  # disabled
curve_curve = CurveCurve(CurveA=line, CurveB=runion_2)  # -> Points, ParamsA, ParamsB
shift_list = ShiftList(List=curve_closest_point_4.Point, Shift=1, Wrap=True)
dist = Distance(PointA=crv_cp.Point, PointB=pt_19)  # disabled
ln_4 = Line(StartPoint=crv_cp.Point, EndPoint=pt_19)  # disabled
list_item_7 = ListItem(List=sort_list_2.ValuesA, Index=0, Wrap=True)  # -> Item, Item1, Item2
list_item_8 = ListItem(List=sort_list_3.ValuesValuesA, Index=0, Wrap=True)  # -> Item, Item1, Item2
multiplication_10 = Multiplication(A=multiplication_8, B=0.5)  # disabled
multiplication_11 = Multiplication(A=multiplication_9, B=0.5)  # disabled
multiplication_12 = Multiplication(A=dist, B=number_slider_24)  # disabled
vector_2pt = Vector2Pt(PointA=curve_closest_point_4.Point, PointB=shift_list, Unitize=False)  # -> Vector, Length
distance = Distance(PointA=item_9.Item, PointB=c_script_5)
distance_2 = Distance(PointA=item_9.Item1, PointB=c_script_6)
list_item_9 = ListItem(List=curve_curve.Points, Index=0, Wrap=True)  # -> Item, Item1
line_2 = Line(StartPoint=list_item_7.Item1, EndPoint=list_item_7.Item2)
line_3 = Line(StartPoint=list_item_8.Item1, EndPoint=list_item_8.Item2)
dom_17 = ConstructDomain(DomainStart=expr("-x", multiplication_10), DomainEnd=multiplication_10)  # disabled
panel_8 = Panel(dom_17)  # disabled
distance_3 = Distance(PointA=list_item_7.Item, PointB=list_item_7.Item1)
line_4 = Line(StartPoint=list_item_7.Item, EndPoint=list_item_7.Item1)
distance_4 = Distance(PointA=list_item_8.Item, PointB=list_item_8.Item1)
distance_5 = Distance(PointA=list_item_7.Item1, PointB=list_item_7.Item2)
distance_6 = Distance(PointA=list_item_8.Item1, PointB=list_item_8.Item2)
dom_18 = ConstructDomain(DomainStart=expr("-x", multiplication_11), DomainEnd=multiplication_11)  # disabled
panel_9 = Panel(dom_18)  # disabled
line_5 = Line(StartPoint=list_item_8.Item, EndPoint=list_item_8.Item1)
rectangle_11 = Rectangle(Plane=graft(flatten), XSize=graft(dom_17), YSize=graft(dom_18), Radius=0)  # -> Rectangle, Length; disabled
number = Number([distance_4, distance_6])
line_6 = Line(StartPoint=list_item_9.Item, EndPoint=list_item_9.Item1)  # -> simplify(Line)
path_mapper = PathMapper(line_6, source="{A;B}", target="{A}")
panel_10 = Panel(path_mapper)
tree_branch = TreeBranch(Tree=path_mapper, Path="{1}", MaintainPaths=True)
plane = Plane(pln)
multiplication_13 = Multiplication(A=distance_2, B=Slider(0.7, range=0..1))
multiplication_14 = Multiplication(A=distance, B=subtraction_2)
subtraction_6 = Subtraction(A=distance_2, B=multiplication_14)
multiplication_15 = Multiplication(A=distance, B=number_slider_26)
explode_tree_2 = ExplodeTree(Data=plane)  # -> Branch0, Branch1, Branch2
length = Length(Curve=path_mapper)
multiplication_16 = Multiplication(A=distance_3, B=number_slider_27)
subtraction_7 = Subtraction(A=multiplication_16, B=distance_5)
multiplication_17 = Multiplication(A=distance_3, B=subtraction_3)
multiplication_18 = Multiplication(A=distance_4, B=number_slider_29)
subtraction_8 = Subtraction(A=multiplication_18, B=distance_6)
multiplication_19 = Multiplication(A=distance_4, B=subtraction_4)
curve_closest_point_7 = CurveClosestPoint(Point=pt_20, Curve=reparameterize(path_mapper))  # -> simplify(Point), Parameter, Distance
dom_19 = ConstructDomain(DomainStart=expr("-x", multiplication_14), DomainEnd=multiplication_14)
dom_20 = ConstructDomain(DomainStart=expr("-x", multiplication_15), DomainEnd=multiplication_15)
dom_21 = ConstructDomain(DomainStart=expr("-x", subtraction_6), DomainEnd=subtraction_6)
construct_domain_3 = ConstructDomain(DomainStart=expr("-x", multiplication_17), DomainEnd=multiplication_17)
construct_domain_4 = ConstructDomain(DomainStart=expr("-x", multiplication_16), DomainEnd=multiplication_16)
construct_domain_5 = ConstructDomain(DomainStart=expr("-x", multiplication_19), DomainEnd=multiplication_19)
construct_domain_6 = ConstructDomain(DomainStart=expr("-x", multiplication_18), DomainEnd=multiplication_18)
rectangle_12 = Rectangle(Plane=[item_5.Item, item_5.Item1], XSize=dom_9, YSize=[dom_19, dom_20], Radius=0)  # -> Rectangle, Length
dom_22 = ConstructDomain(DomainStart=expr("-x", subtraction_7), DomainEnd=subtraction_7)
dom_23 = ConstructDomain(DomainStart=expr("-x", subtraction_8), DomainEnd=subtraction_8)
domain = Domain([construct_domain_4, construct_domain_3, dom_22])
domain_2 = Domain([construct_domain_6, construct_domain_5, dom_23])
number_2 = Number(length)
list_item_10 = ListItem(List=number_2, Index=0, Wrap=True)  # -> Item, Item1
panel_12 = Panel(length)
list_item_11 = ListItem(List=curve_closest_point_7.Parameter, Index=0, Wrap=True)  # -> Item, Item1
panel_13 = Panel(list_item_10.Item)
subtraction_9 = Subtraction(A=Slider(1, range=0..1), B=list_item_11.Item1)
subtraction_10 = Subtraction(A=Slider(1, range=0..1), B=list_item_11.Item)
multiplication_20 = Multiplication(A=list_item_11.Item, B=list_item_10.Item)
multiplication_21 = Multiplication(A=subtraction_9, B=list_item_10.Item1)
multiplication_22 = Multiplication(A=subtraction_10, B=list_item_10.Item)
multiplication_23 = Multiplication(A=list_item_11.Item1, B=list_item_10.Item1)
dom_24 = ConstructDomain(DomainStart=expr("-x", multiplication_22), DomainEnd=multiplication_20)
dom_25 = ConstructDomain(DomainStart=multiplication_21, DomainEnd=expr("-x", multiplication_23))
plane_2 = Plane(pl)
rectangle_13 = Rectangle(Plane=flatten(plane_2), XSize=domain, YSize=domain_2, Radius=0)  # -> Rectangle, Length
panel_14 = Panel(dom_25)
rectangle_14 = Rectangle(Plane=plane_2, XSize=dom_25, YSize=dom_24, Radius=0)  # -> Rectangle, Length

# ---- group: CreateOurInitialFloorPlan
rectangle_15 = Rectangle(Plane=pl, XSize=dom, YSize=dom_2, Radius=0)  # -> Rectangle, Length; disabled
flatten_2 = FlattenTree(Tree=rectangle_14.Rectangle, Path="{0}")
graft_2 = GraftTree(Tree=flatten_2, IncludeEmptyLists=True, IncludeNullItems=True)
rint = RegionIntersection(CurvesA=runion, CurvesB=graft_2)  # -> simplify(Result)
c_script_8 = CSharpScript(x=rint)  # -> A; inputs x: tree of Polyline
# ---------- c_script_8: C# ----------
    var treeOut = new DataTree<Polyline>();

    for( int i = 0; i < x.BranchCount; ++i )
      for( int j = 0; j < x.Branch(i).Count; ++j )
      {

        treeOut.Add(x.Branch(i)[j], new GH_Path(i));

      }

    A = treeOut;
# ---------- end c_script_8 ----------
crv_6 = Curve(simplify(c_script_8))

# ---- group: Office
genelist_e = GenePool(Decimals=0, Maximum=40, Minimum=10, Value=[13, 19, 31])
item_11 = ListItem(List=series_2, Index=expr("x-1", number_slider_23), Wrap=True)
addition_4 = Addition(A=number_slider_22, B=item_11)
series_3 = Series(Start=addition_4, Step=Slider(3.8, range=0..10), Count=graft(genelist_e))  # -> simplify(Series)
Z_6 = UnitZ(Factor=series_3)  # -> simplify(UnitVector)
move_8 = Move(Geometry=crv_6, Motion=Z_6)  # -> simplify(Geometry), Transform
sortbranchaccordingtoheight = CSharpScript(x=move_8.Geometry)  # -> A, B, C; inputs x: tree of Polyline
# ---------- sortbranchaccordingtoheight: C# ----------
    int count = x.BranchCount;

    var treeOut = new DataTree<Polyline>();
    var itemsOfBranch = new int[count];
    var index = new int[count];

    for( int i = 0; i < count; ++i )
    {

      itemsOfBranch[i] = x.Branch(i).Count;
      index[i] = i;

    }

    Array.Sort(itemsOfBranch, index);

    for( int i = 0; i < count; ++i )
    {

      treeOut.AddRange(x.Branch(index[i]), new GH_Path(i));

    }

    A = treeOut;
    B = itemsOfBranch;
    C = count;
# ---------- end sortbranchaccordingtoheight ----------
prune = PruneTree(Tree=sortbranchaccordingtoheight.A, Minimum=Slider(1, range=0..1), Maximum=0)
number_slider_39 = Slider(0.5, range=0..1)
path_mapper_2 = PathMapper(prune, source="{A}", target="{path_index}")
pt_23 = ConstructPoint(XCoordinate=number_slider_39, YCoordinate=number_slider_39, ZCoordinate=0)
evalsrf_2 = EvaluateSurface(Surface=reparameterize(path_mapper_2), Point=pt_23)  # -> Point, Normal, UDirection, VDirection, Frame
crv_7 = Curve(path_mapper_2)
colmm = CollisionManyMany(Colliders=flatten(crv_7))  # -> Collision, Indices
ma_3 = MassAddition(Input=colmm.Collision)  # -> Result, PartialResults

# ----
floorsandvolumes = FloorsAndVolumes(Points=evalsrf_2.Point, Frames=evalsrf_2.Frame, Collisions=ma_3.Result, Curves=crv_7)  # -> Floors, Volumes, NumberOfBranches
multiplication_24 = Multiplication(A=list_item_10.Item1, B=0.5)
multiplication_25 = Multiplication(A=list_item_10.Item, B=0.5)

# ---- group: Office / Volumes
brep = Brep(floorsandvolumes.Volumes)
frgb_5 = ColourRGBF(
    Alpha=[Slider(0.426, range=0..1), Slider(0.426, range=0..1), Slider(0.426, range=0..1)],
    Red=[Slider(1, range=0..1), Slider(0, range=0..1), Slider(0, range=0..1)],
    Green=[Slider(0.103, range=0..1), Slider(1, range=0..1), Slider(0, range=0..1)],
    Blue=[Slider(1, range=0..1), Slider(0, range=0..1), Slider(1, range=0..1)])  # -> simplify(graft(Colour))
prunecolours = CSharpScript(colours=frgb_5, branchCount=floorsandvolumes.NumberOfBranches)  # -> prunedTree; inputs colours: tree, branchCount: Int32
# ---------- prunecolours: C# ----------
    switch( branchCount )
    {

      case 1:

        colours.RemovePath(1);
        colours.RemovePath(2);

        break;

      case 2:

        colours.RemovePath(2);

        break;

    }

    prunedTree = colours;
# ---------- end prunecolours ----------
preview_5 = CustomPreview(Geometry=brep, Material=prunecolours)

# ----
explode_tree_3 = ExplodeTree(Data=rectangle_14.Rectangle)  # -> Branch0, Branch1, Branch2
scale_nu = ScaleNU(Geometry=rectangle_14.Rectangle, Plane=plane, ScaleX=list_item_11.Item, ScaleY=list_item_11.Item1, ScaleZ=1)  # -> Geometry, Transform
curve_3 = Curve([explode_tree_3.Branch0, explode_tree_3.Branch1, explode_tree_3.Branch2])
rectangle_16 = Rectangle(Plane=plane_2, XSize=dom_25, YSize=dom_24, Radius=0)  # -> Rectangle, Length

# ---- group: Office / Floors
area_4 = Area(Geometry=flatten(floorsandvolumes.Floors), UseTasks=True)  # -> Area, Centroid
srf_7 = Surface(floorsandvolumes.Floors)
ma_4 = MassAddition(Input=area_4.Area)  # -> Result, PartialResults
frgb_6 = ColourRGBF(
    Alpha=Slider(0.426, range=0..1),
    Red=Slider(1, range=0..1),
    Green=Slider(0.071, range=0..1),
    Blue=Slider(0.04, range=0..1))
preview_6 = CustomPreview(Geometry=srf_7, Material=frgb_6)

# ---- group: Fitness / DifferenceBetweenNumberOfFloors
int = Integer(genelist_e)
crossref = CrossReference(ListA=int, ListB=int, CrossMode=2)  # -> graft(ListA), graft(ListB)
int_2 = Integer(simplify([crossref.ListA, crossref.ListB]))
item_12 = ListItem(List=int_2, Index=0, Wrap=True)  # -> Item, Item1
subtraction_11 = Subtraction(A=item_12.Item, B=item_12.Item1)  # -> flatten(Result)
expression_3 = Expression(x=subtraction_11, y=Slider(5, range=0..10), Expression="If( Abs( x ) < y, -5, 0 )")
nullrep = ReplaceNulls(Items=expression_3, Replacements=Slider(0, range=0..100))  # -> Items, Count
panel_15 = Panel(nullrep.Items)

# ---- group: Fitness / CloseToEachOtherOffice
flip_2 = FlipMatrix(Data=crv_7)
c_script_9 = CSharpScript(x=flip_2)  # -> A; inputs x: tree of Polyline; same code as c_script_7
crossref_2 = CrossReference(ListA=c_script_9, ListB=c_script_9, CrossMode=2)  # -> graft(ListA), graft(ListB)
crv_8 = Curve([crossref_2.ListA, crossref_2.ListB])
item_13 = ListItem(List=crv_8, Index=0, Wrap=True)  # -> simplify(Item), simplify(Item1)
number_slider_40 = Slider(0.001, range=0..0.001)
crvprox = CurveProximity(CurveA=item_13.Item, CurveB=item_13.Item1)  # -> PointA, PointB, Distance
nullrep_2 = ReplaceNulls(Items=crvprox.Distance, Replacements=number_slider_40)  # -> Items, Count
expression_4 = Expression(x=nullrep_2.Items, y=number_slider_40, z=Slider(3.4, range=0..10), Expression="If( x < z, If( x > y, -7, 0 ), 0 ) ")  # -> flatten(R)
panel_16 = Panel(expression_4)

# ---- group: Fitness / NoOverlappingGeo
crossref_3 = CrossReference(ListA=c_script_9, ListB=c_script_9, CrossMode=2)  # -> graft(ListA), graft(ListB); disabled
crv_9 = Curve(simplify([crossref_3.ListA, crossref_3.ListB]))  # disabled
sdivide_2 = DivideSurface(Surface=crv_9, UCount=10, VCount=10)  # -> simplify(Points), Normals, Parameters; disabled
path_mapper_3 = PathMapper(sdivide_2.Points, source="{A;B;C}", target="{A}")  # disabled
null_2 = NullItem(Item=path_mapper_3)  # -> NullFlags, InvalidFlags, Description; disabled
cull_2 = CullPattern(List=path_mapper_3, CullPattern=invert(null_2.NullFlags))  # disabled
pt_24 = Point(cull_2)  # disabled
number_slider_41 = Slider(15, range=0..100)  # disabled
number_slider_42 = Slider(30, range=0..100)  # disabled
item_14 = ListItem(List=crv_9, Index=0, Wrap=True)  # -> Item, Item1; disabled
lng_4 = ListLength(List=pt_24)  # disabled
multiplication_26 = Multiplication(A=lng_4, B=0.5)  # disabled
split = SplitList(List=pt_24, Index=multiplication_26)  # -> simplify(ListA), simplify(ListB); disabled
crv_10 = Curve(item_14.Item)  # disabled
pt_25 = Point(split.ListB)  # disabled
pointinclusion = CSharpScript(pts=pt_25, crv=crv_10)  # -> flatten(A); inputs pts: list of Point3d, crv: Polyline; disabled
# ---------- pointinclusion: C# ----------
    int penalize = 0;

    System.Threading.Tasks.Parallel.ForEach(pts, pt =>
      {

      if( IsInside(pt, crv) )
      {

        System.Threading.Interlocked.Decrement( ref penalize );

      }

      }
      );

    A = penalize;
# ---------- pointinclusion: C# additional code ----------
  bool IsInside (Point3d pt, Polyline crv)
  {
    Point3d pt1, pt2;
    bool oddNodes = false;

    for (int i = 0; i < crv.SegmentCount; i++) //for each contour line
    {

      pt1 = crv.SegmentAt(i).From; //get start and end pt
      pt2 = crv.SegmentAt(i).To;

      if ( (pt1[1] < pt[1] && pt2[1] >= pt[1] || pt2[1] < pt[1] && pt1[1] >= pt[1]) && (pt1[0] <= pt[0] || pt2[0] <= pt[0]) ) //if pt is between pts in y, and either of pts is before pt in x
        oddNodes ^= ( pt2[0] + (pt[1] - pt2[1]) * (pt1[0] - pt2[0]) / (pt1[1] - pt2[1]) < pt[0] ); //^= is xor
      //end.X + (pt-end).Y   * (start-end).X  /(start-end).Y   <   pt.X
    }


    if (!oddNodes)
    {
      double minDist = 1e10;
      for (int i = 0; i < crv.SegmentCount; i++) {
        Point3d cp = crv.SegmentAt(i).ClosestPoint(pt, true);
        //Point3d cp = mvContour[i].closestPoint(pt);
        //minDist = min(minDist, cp.distance(pt));
        minDist = Math.Min(minDist, cp.DistanceTo(pt));
      }
      if (minDist < 1e-10)
        return true;
    }

    if(oddNodes) return true;

    return false;
  }
# ---------- end pointinclusion ----------
expression_5 = Expression(x=pointinclusion, y=number_slider_41, z=number_slider_42, Expression="If( ( x ≥ y ) And ( x ≤ z ), 0, -10 )")  # disabled
panel_17 = Panel(pointinclusion)  # disabled
panel_18 = Panel(expression_5)  # disabled

# ---- group: Fitness / TotalArea
area_5 = Area(Geometry=flatten(runion_3), UseTasks=False)  # -> Area, Centroid
ma_5 = MassAddition(Input=area_5.Area)  # -> Result, PartialResults
addition_5 = Addition(A=ma.Result, B=ma_5.Result)
addition_6 = Addition(A=addition_5, B=ma_4.Result)
panel_19 = Panel(addition_5)
expression_6 = Expression(
    x=addition_6,
    y=Slider(83000, range=0..100000),
    z=Slider(85799, range=0..100000),
    Expression="If( ( x ≤ z ) And ( x ≥ y ), 0, -100 )")  # -> flatten(Result)
panel_20 = Panel(addition_6)

# ---- group: PenalizeFloorPlan
crv_11 = Curve(c_script_9)
disc_3 = Discontinuity(Curve=crv_11, Level=1)  # -> Points, Parameters
lng_5 = ListLength(List=disc_3.Points)
expression_7 = Expression(x=lng_5, y=Slider(4, range=0..10), Expression="If( x ≠ y, -50, 0 )")  # -> flatten(R)
panel_21 = Panel(expression_7)

# ---- group: Fitness / RectangularFloorPlans
crv_12 = Curve(crv_6)
disc_4 = Discontinuity(Curve=crv_12, Level=1)  # -> Points, Parameters
lng_6 = ListLength(List=disc_4.Points)
expression_8 = Expression(x=lng_6, y=Slider(4, range=0..10), Expression="If( x ≠ y, -50, 0 )")  # -> flatten(R)
panel_22 = Panel(expression_8)

# ---- group: Fitness / NoSmallBuildings
area_6 = Area(Geometry=crv_6)  # -> Area, Centroid
expression_9 = Expression(x=area_6.Area, y=Slider(400, range=0..1000), Expression="If( x < y, -2, 0 )")  # -> flatten(R)
panel_23 = Panel(expression_9)

# ---- group: Fitness / NoFloatingOfficeBuildings
srf_8 = Surface(<surface referenced from the Rhino model>)
rint_2 = RegionIntersection(CurvesA=srf_4, CurvesB=srf_8)
crv_13 = Curve(rint_2)
offset = OffsetCurve(Curve=crv_13, Distance=Slider(2, range=0..10), Plane=PlaneXY(0, 0, 0), Corners=1)
project = Project(Geometry=crv_7, Plane=PlaneXY(0, 0, 0))  # -> Geometry, Transform
disc_5 = Discontinuity(Curve=flatten(offset), Level=1)  # -> Points, Parameters
rint_3 = RegionIntersection(CurvesA=offset, CurvesB=project.Geometry)
item_15 = ListItem(List=disc_5.Points, Index=0, Wrap=True)  # -> Item, Item1, Item2
disc_6 = Discontinuity(Curve=rint_3, Level=3)  # -> simplify(Points), Parameters
sortbranchaccordingtonumberofpoints = CSharpScript(x=disc_6.Points)  # -> A, B, C; inputs x: tree of Point3d
# ---------- sortbranchaccordingtonumberofpoints: C# ----------
    int count = x.BranchCount;

    var treeOut = new DataTree<Point3d>();
    var itemsOfBranch = new int[count];
    var index = new int[count];

    for( int i = 0; i < count; ++i )
    {

      itemsOfBranch[i] = x.Branch(i).Count;
      index[i] = i;

    }

    Array.Sort(itemsOfBranch, index);

    for( int i = 0; i < count; ++i )
    {

      treeOut.AddRange(x.Branch(index[i]), new GH_Path(i));

    }

    A = treeOut;
    B = itemsOfBranch;
    C = count;
# ---------- end sortbranchaccordingtonumberofpoints ----------
pdecon_5 = Deconstruct(Point=disc_6.Points)  # -> XComponent, YComponent, ZComponent
ln_5 = Line(StartPoint=item_15.Item1, EndPoint=item_15.Item2)
dist_2 = Distance(PointA=item_15.Item1, PointB=item_15.Item2)
path = ConstructPath(Indices=expr("x-1", sortbranchaccordingtonumberofpoints.C))
addition_7 = Addition(A=pdecon_5.XComponent, B=Slider(1000, range=0..1000))
multiplication_27 = Multiplication(A=pdecon_5.YComponent, B=addition_7)
branch_2 = TreeBranch(Tree=sortbranchaccordingtonumberofpoints.A, Path=path, MaintainPaths=True)
sort = SortList(Keys=multiplication_27, ValuesA=disc_6.Points)  # -> Keys, ValuesA
round = Round(Number=dist_2)  # -> Nearest, Floor, Ceiling

# ----
lng_7 = ListLength(List=branch_2)
item_16 = ListItem(List=sort.ValuesA, Index=expr("x-2", lng_7), Wrap=True)
item_17 = ListItem(List=sort.ValuesA, Index=expr("x-1", lng_7), Wrap=True)

# ---- group: Fitness / NoFloatingOfficeBuildings (continued)
dist_3 = Distance(PointA=item_16, PointB=item_17)
ln_6 = Line(StartPoint=item_16, EndPoint=item_17)
nullrep_3 = ReplaceNulls(Items=dist_3, Replacements=dist_2)  # -> Items, Count
round_2 = Round(Number=nullrep_3.Items)  # -> Nearest, Floor, Ceiling
expression_10 = Expression(x=round.Nearest, y=round_2.Nearest, Expression="If( x = y, 0, -50 )")  # -> flatten(R)
panel_24 = Panel(expression_10)

# ---- group: Fitness
ma_6 = MassAddition(Input=flatten([expression_8, expression_9, expression_10, expression_6, nullrep.Items, expression_4, pointinclusion, expression_5]))  # -> Result, PartialResults
panel_25 = Panel(ma_6.Result)

# ==== cluster ReparametrizeCurve
curve = ClusterInput()
discontinuity = Discontinuity(Curve=curve, Level=1)  # -> Points, Parameters
area = Area(Geometry=curve, UseTasks=False)  # -> Area, Centroid
list_item = ListItem(List=discontinuity.Points, Index=0, Wrap=True)  # -> Item, Item1, Item2, Item3
point = Point(list_item.Item)
point_2 = Point(list_item.Item1)
point_3 = Point(list_item.Item2)
point_4 = Point(list_item.Item3)
point_5 = Point(area.Centroid)
vector_2pt = Vector2Pt(PointA=point, PointB=point_2, Unitize=False)  # -> Vector, Length
vector_2pt_2 = Vector2Pt(PointA=point, PointB=point_5, Unitize=False)  # -> Vector, Length
move = Move(Geometry=point_5, Motion=expr("x*0.5", vector_2pt.Vector))  # -> Geometry, Transform
move_2 = Move(Geometry=point, Motion=expr("x*0.5", vector_2pt_2.Vector))  # -> Geometry, Transform
move_3 = Move(Geometry=point, Motion=expr("x*0.5", vector_2pt.Vector))  # -> Geometry, Transform
domain_start = ClusterInput()
domain_end = ClusterInput()
domain_start_2 = ClusterInput()
domain_end_2 = ClusterInput()
construct_domain = ConstructDomain(DomainStart=expr("-x", domain_start), DomainEnd=domain_end)
construct_domain_2 = ConstructDomain(DomainStart=expr("-x", domain_start_2), DomainEnd=domain_end_2)
plane_3pt = Plane3Pt(PointA=point_5, PointB=move_3.Geometry, PointC=move.Geometry)
domain = ClusterOutput(construct_domain)
domain_2 = ClusterOutput(construct_domain_2)
plane = ClusterOutput(plane_3pt)
