# Grasshopper definition Final[3] .gh (Grasshopper 1.0.7)
# plug-ins: FloorsAndVolumes, Centipede, horsterCameraControl, MetaHopper

# ---- group: ModifyGenePools / NumberOfTowers
numberoftowers = Slider(3, range=1..3)

# ---- group: Platform / TamañoPlanta
number_slider = Slider(37.442, range=0..100)
number_slider_2 = Slider(7.676, range=0..100)

# ---- group: Platform / NumeroDePisosAlturaEntreFinoYFino
number_slider_3 = Slider(3, range=0..10)
number_slider_4 = Slider(5.797, range=0..10)

# ----
number_slider_5 = Slider(0.4997, range=0..1)  # disabled
pt = Point()  # disabled
number_slider_6 = Slider(2400, range=0..2400)
number_slider_7 = Slider(2000, range=0..10000)
number_slider_8 = Slider(1600, range=0..10000)
number_slider_9 = Slider(1200, range=0..1200)
number_slider_10 = Slider(754, range=0..1000)
number_slider_11 = Slider(375, range=0..500)
number_slider_12 = Slider(1, range=0..1)
number_slider_13 = Slider(0, range=0..1)
number_slider_14 = Slider(0.448, range=0..1)
get_object_by_nickname = GetObjectByNickname(NickName="PreviewOffice")
get_object_by_nickname_2 = GetObjectByNickname(NickName="PreviewPlatform")
get_object_by_nickname_3 = GetObjectByNickname(NickName="PreviewBuildings")
centipede = Centipede(
    Double=number_slider_13,
    Double_2=number_slider_12,
    Integer=Slider(0, range=0..100),
    Integer_2=number_slider_11,
    Integer_3=number_slider_6)

# ---- group: Lote
expression = Expression(x=centipede, Expression="If( x = 0, False, True )")
colour_rgb_f = ColourRGBF(Alpha=centipede, Red=Slider(0.215, range=0..1), Green=Slider(0.682, range=0..1), Blue=Slider(0.78, range=0..1))
get_object_by_nickname_4 = GetObjectByNickname(NickName="CustomLote")
surface = Surface(<surface referenced from the Rhino model>)
customlote = CustomPreview(CustomMaterial=surface, Material=colour_rgb_f)
enable_disable_object = EnableDisableObject(Objects=get_object_by_nickname_4, Enabled=expression, AllObjects_Object=customlote)

# ----
centipede_2 = Centipede(
    Double=number_slider_13,
    Double_2=number_slider_14,
    Integer=number_slider_10,
    Integer_2=number_slider_9,
    Integer_3=number_slider_6)
expression_2 = Expression(x=centipede_2, Expression="If( x = 0, False, True )")
centipede_3 = Centipede(
    Double=number_slider_13,
    Double_2=number_slider_12,
    Integer=number_slider_11,
    Integer_2=number_slider_10,
    Integer_3=number_slider_6)

# ---- group: Platform
dom = ConstructDomain(DomainStart=expr("-x", number_slider), DomainEnd=number_slider)
dom_2 = ConstructDomain(DomainStart=expr("-x", number_slider_2), DomainEnd=number_slider_2)
srf = Surface(<surface referenced from the Rhino model>)
reparametrizecurve = ReparametrizeCurve(curve=srf, domain_start_2=dom, domain_end_2=dom, domain_start=dom_2, domain_end=dom_2)  # -> plane, domain_2, domain
unit_z = UnitZ(Factor=Slider(0.1, range=0..1))
colour_rgb_f_2 = ColourRGBF(Alpha=centipede_3, Red=Slider(1, range=0..1), Green=Slider(0.462, range=0..1), Blue=Slider(0.729, range=0..1))
rectangle = Rectangle(Plane=reparametrizecurve.plane, XSize=reparametrizecurve.domain_2, YSize=reparametrizecurve.domain, Radius=0)  # -> Rectangle, Length
move = Move(Geometry=srf, Motion=unit_z)  # -> Geometry, Transform
expression_3 = Expression(x=centipede_3, Expression="If( x = 0, False, True )")
customagora = CustomPreview(CustomMaterial=move.Geometry, Material=colour_rgb_f_2)
srf_2 = Surface(<surface referenced from the Rhino model>)
get_object_by_nickname_5 = GetObjectByNickname(NickName="CustomAgora")
sint = SolidIntersection(BrepsA=rectangle.Rectangle, BrepsB=srf_2)
enable_disable_object_2 = EnableDisableObject(Objects=get_object_by_nickname_5, Enabled=expression_3, AllObjects_Object=customagora)
item = ListItem(List=sint, Index=Slider(1, range=0..1), Wrap=True)
subtraction = Subtraction(A=number_slider_3, B=1)
series = Series(Start=0, Step=number_slider_4, Count=number_slider_3)
multiplication = Multiplication(A=number_slider_4, B=subtraction)
Z = UnitZ(Factor=series)
move_2 = Move(Geometry=item, Motion=Z)  # -> Geometry, Transform
Z_2 = UnitZ(Factor=multiplication)
lng = ListLength(List=move_2.Geometry)
srf_3 = Surface(move_2.Geometry)
cull_i = CullIndex(List=move_2.Geometry, Indices=expr("x-1", lng), Wrap=True)
area = Area(Geometry=cull_i, UseTasks=False)  # -> Area, Centroid
loft = Loft(Curves=move_2.Geometry, Options={Adjust=False, Closed=False, LoftEnds=0, LoftSimp=0, LoftType=0, Rebuild=10, Refit=0.01})
ma = MassAddition(Input=flatten(area.Area))  # -> Result, PartialResults
area_2 = Area(Geometry=move_2.Geometry, UseTasks=False)  # -> Area, Centroid
item_2 = ListItem(List=area_2.Area, Index=0, Wrap=True)  # -> Item, Item1
ma_2 = MassAddition(Input=flatten([item_2.Item, item_2.Item1]))  # -> Result, PartialResults
cap = CapHoles(Brep=loft)
number_slider_15 = Slider(1, range=0..1)
number_slider_16 = Slider(0, range=0..1)
number_slider_17 = Slider(0, range=0..1)
frgb = ColourRGBF(Alpha=Slider(0.191, range=0..1), Red=number_slider_15, Green=number_slider_17, Blue=number_slider_16)
frgb_2 = ColourRGBF(Alpha=centipede_2, Red=number_slider_15, Green=number_slider_17, Blue=number_slider_16)
preview = CustomPreview(Geometry=srf_3, Material=frgb)
previewplatform = CustomPreview(Geometry=cap, Material=frgb_2)
panel = Panel(ma_2.Result)

# ---- group: Commercial
number_slider_18 = Slider(6, range=0..10)
number_slider_19 = Slider(4, range=4..8)
series_2 = Series(Start=Z_2, Step=number_slider_18, Count=number_slider_19)
Z_3 = UnitZ(Factor=series_2)

# ----
centipede_4 = Centipede(
    Double=number_slider_13,
    Double_2=number_slider_14,
    Integer=number_slider_8,
    Integer_2=number_slider_7,
    Integer_3=number_slider_6)
expression_4 = Expression(x=centipede_4, Expression="If( x = 0, False, True )")
hide_show_object_preview = HideShowObjectPreview(Objects=get_object_by_nickname_3, Visible=expression_4)
centipede_5 = Centipede(
    Double=number_slider_13,
    Double_2=number_slider_14,
    Integer=number_slider_9,
    Integer_2=number_slider_8,
    Integer_3=number_slider_6)
expression_5 = Expression(x=centipede_5, Expression="If( x = 0, False, True )")
enable_disable_object_3 = EnableDisableObject(Objects=get_object_by_nickname, Enabled=expression_5, AllObjects_Object=previewoffice)
enable_disable_object_4 = EnableDisableObject(Objects=get_object_by_nickname_2, Enabled=expression_2, AllObjects_Object=previewplatform)
number_slider_20 = Slider(2400, range=0..2400)
centipede_6 = Centipede(
    Double=number_slider_13,
    Double_2=number_slider_12,
    Integer=number_slider_7,
    Integer_2=number_slider_20,
    Integer_3=number_slider_6)

# ---- group: Edificios
number_slider_21 = Slider(0.807, range=0..1)
number_slider_22 = Slider(1, range=0..1)
number_slider_23 = Slider(1, range=0..1)
expression_6 = Expression(x=centipede_6, Expression="If( x = 0, False, True )")
colour_rgb_f_3 = ColourRGBF(Alpha=centipede_6, Red=number_slider_21, Green=number_slider_21, Blue=number_slider_21)
get_object_by_nickname_6 = GetObjectByNickname(NickName="CustomEdificios")
mesh = Mesh([<mesh referenced from the Rhino model> x1312])
customedificios = CustomPreview(CustomMaterial=mesh, Material=colour_rgb_f_3)
enable_disable_object_5 = EnableDisableObject(Objects=get_object_by_nickname_6, Enabled=expression_6, AllObjects_Object=customedificios)

# ----
curve = Curve(<curve referenced from the Rhino model>)
curve_2 = Curve(<curve referenced from the Rhino model>)
number_slider_24 = Slider(24.323, range=0..500)
get_camera = GetCamera(GetCamera=Toggle(False))  # -> Location, Target, LensLength, UpDirection
point = Point(Point(-239.2511343, -77.01564917, 215.4740685))
point_2 = Point(Point(-246.0066201, 189.2318598, 38.39411235))
point_3 = Point(Point(-396.4990699, 64.91942677, 209.3986668))
point_4 = Point(Point(-242.3450216, 175.5005526, 32.98647487))
point_5 = Point(Point(-407.1996286, 147.1574345, 230.8522818))
point_6 = Point(Point(-240.8028423, 171.5906576, 33.80395119))
point_7 = Point(Point(-396.288621, 202.5476923, 241.048847))
point_8 = Point(Point(-263.3484405, 152.1903207, 24.47562387))
point_9 = Point(reverse([point_2, point_4, point_6, point_8]))
point_10 = Point(reverse([point, point_3, point_5, point_7]))
interpolate = Interpolate(Vertices=point_10, Degree=3, Periodic=False, KnotStyle=1)  # -> Curve, Length, Domain
divide_curve = DivideCurve(Curve=interpolate.Curve, Count=number_slider_20, Kinks=False, UseTasks=False)  # -> Points, Tangents, Parameters
list_item = ListItem(List=divide_curve.Points, Index=number_slider_6, Wrap=True)
interpolate_2 = Interpolate(Vertices=point_9, Degree=3, Periodic=False, KnotStyle=1)  # -> Curve, Length, Domain
divide_curve_2 = DivideCurve(Curve=interpolate_2.Curve, Count=number_slider_20, Kinks=False, UseTasks=False)  # -> Points, Tangents, Parameters
list_item_2 = ListItem(List=divide_curve_2.Points, Index=number_slider_6, Wrap=True)
set_camera = SetCamera(CameraLocation=list_item, TargetLocation=list_item_2, LensLength=number_slider_24, Activate=Toggle(False))
set_camera_2 = SetCamera(CameraLocation=point_7, TargetLocation=point_8, LensLength=number_slider_24, Activate=Toggle(False))
divide_curve_3 = DivideCurve(Curve=interpolate_2.Curve, Count=10, Kinks=False, UseTasks=False)  # -> Points, Tangents, Parameters
divide_curve_4 = DivideCurve(Curve=interpolate.Curve, Count=10, Kinks=False, UseTasks=False)  # -> Points, Tangents, Parameters
galapagos = Galapagos(fitness=ma_6, gene=[genelist_e, number_slider_25, genelist_f, genelist_h, genelist_g])

# ---- group: WhereToPlaceRectangles
crv = Curve(<curve referenced from the Rhino model>)
crv_2 = Curve(<curve referenced from the Rhino model>)
crv_3 = Curve(<curve referenced from the Rhino model>)
number_slider_25 = Slider(8, range=0..10)
crv_4 = Curve([crv, crv_2, crv_3])
shift = ShiftList(List=crv_4, Shift=number_slider_25, Wrap=True)
genelist_f = GenePool(Decimals=0, Maximum=1825, Minimum=0, Value=[20, 1575, 1740])
crv_5 = Curve(flatten(shift))
number_slider_26 = Slider(50, range=0..100)
runion = RegionUnion(Curves=crv_5)
srf_4 = Surface(runion)
sdivide = DivideSurface(Surface=srf_4, UCount=number_slider_26, VCount=number_slider_26)  # -> Points, Normals, Parameters
disc = Discontinuity(Curve=runion, Level=1)  # -> Points, Parameters
null = NullItem(Item=sdivide.Points)  # -> NullFlags, InvalidFlags, Description
cull = CullPattern(List=sdivide.Points, CullPattern=invert(null.NullFlags))
item_3 = ListItem(List=disc.Points, Index=0, Wrap=True)  # -> Item, Item1, Item2
item_4 = ListItem(List=flatten(cull), Index=genelist_f, Wrap=True)
vec2pt = Vector2Pt(PointA=item_3.Item, PointB=item_3.Item1, Unitize=False)  # -> Vector, Length
vec2pt_2 = Vector2Pt(PointA=item_3.Item1, PointB=item_3.Item2, Unitize=False)  # -> Vector, Length
Z_4 = UnitZ(Factor=1)
xprod = CrossProduct(VectorA=vec2pt.Vector, VectorB=Z_4, Unitize=False)  # -> expr("-x", Vector), Length

# ---- group: ModifyGenePools
number_slider_27 = Slider(0.5, range=0..1)
number_slider_28 = Slider(1, range=0..40)
lng_2 = ListLength(List=flatten(cull))
dom_3 = ConstructDomain(DomainStart=number_slider_27, DomainEnd=number_slider_28)
dom_4 = ConstructDomain(DomainStart=number_slider_27, DomainEnd=number_slider_28)
dom_5 = ConstructDomain(DomainStart=Slider(10, range=0..100), DomainEnd=Slider(40, range=0..40))
dom_6 = ConstructDomain(DomainStart=Slider(10, range=0..100), DomainEnd=Slider(40, range=0..40))
dom_7 = ConstructDomain(DomainStart=Slider(0, range=0..100), DomainEnd=lng_2)
genemodifier = GenePoolModifier(GeneList="GeneList G", Count=numberoftowers, Domain=dom_3)
genemodifier_2 = GenePoolModifier(GeneList="GeneList H", Count=numberoftowers, Domain=dom_4)
genemodifier_3 = GenePoolModifier(GeneList="GeneList C", Count=numberoftowers, Domain=dom_5)
genemodifier_4 = GenePoolModifier(GeneList="GeneList D", Count=numberoftowers, Domain=dom_5)
genemodifier_5 = GenePoolModifier(GeneList="GeneList E", Count=numberoftowers, Domain=dom_6)
genemodifier_6 = GenePoolModifier(GeneList="GeneList F", Count=numberoftowers, Domain=dom_7)

# ----
graft = GraftTree(Tree=item_4, IncludeEmptyLists=True, IncludeNullItems=True)

# ---- group: WhereToPlaceRectangles (continued)
pl = ConstructPlane(Origin=graft, XAxis=vec2pt.Vector, YAxis=vec2pt_2.Vector)  # -> simplify(Plane)

# ----
c_script = CSharpScript(points=pt, vector=vec2pt.Vector, percentage=number_slider_5)  # -> rectangles; inputs points: list of Point3d, vector: Vector3d, percentage: Double; disabled
# ---------- c_script: C# ----------
    Point3d pointOne = points[0];
    Point3d pointTwo = points[1];

    Rhino.Geometry.Point p = new Point(pointOne);
    p.Translate(-vector);

    Point3d pointTranslate = p.Location;

    NurbsCurve curve = new Line(pointTwo, pointTranslate).ToNurbsCurve();
    double t = 0.0;
    curve.ClosestPoint(pointOne, out t);
    Point3d pt = curve.PointAt(t);

    double total = 1.0 - percentage;

    double distance = pt.DistanceTo(pointTwo);
    double distanceOne = distance * percentage;
    double distanceTwo = distance * total;

    Interval[] inter = new Interval[2];

    inter[0] = new Interval(-distanceOne, distanceOne);
    inter[1] = new Interval(-distanceTwo, distanceTwo);

    rectangles = inter;
# ---------- end c_script ----------

# ---- group: Rectangles / y
vector = Vector(expr("x*10.0", vec2pt.Vector))
vector_2 = Vector(expr("-x", vector))

# ---- group: Rectangles / x
vector_3 = Vector(expr("x*10.0", vec2pt_2.Vector))
vector_4 = Vector(expr("-x", vector_3))

# ---- group: Rectangles
pln = Plane(pl)
item_5 = ListItem(List=pln, Index=0, Wrap=True)  # -> Item, Item1, Item2
pt_2 = Point(pln)
deconstruct = Deconstruct(Point=pt_2)  # -> XComponent, YComponent, ZComponent
addition = Addition(A=deconstruct.YComponent, B=Slider(1000, range=0..1000))
sort_list = SortList(Keys=addition, ValuesValuesA=pt_2)  # -> Keys, ValuesValuesA
vector_5 = Vector(expr("-x", [vec2pt.Vector, xprod.Vector]))
vector_6 = Vector([vec2pt.Vector, xprod.Vector])
item_6 = ListItem(List=sort_list.ValuesValuesA, Index=0, Wrap=True)  # -> Item, Item1, Item2
vector_7 = Vector([vector_3, vector_4, vector, vector_2])
pt_3 = Point(pln)
point_list = PointList(Size=Slider(1.5, range=0..10))
curve_3 = Curve(runion)
move_3 = Move(Geometry=pt_3, Motion=vector_7)  # -> Geometry, Transform
explode_tree = ExplodeTree(Data=pt_3)  # -> Branch0, Branch1, Branch2
brep_wireframe = BrepWireframe(Brep=curve_3, Density=-1)
surface_2 = Surface(curve_3)
point_11 = Point(explode_tree.Branch0)
curve_closest_point = CurveClosestPoint(Point=pt_2, Curve=curve_3)  # -> flatten(Point), Parameter, Distance
curve_closest_point_2 = CurveClosestPoint(Point=pt_2, Curve=curve_3)  # -> flatten(Point), Parameter, Distance
list_item_3 = ListItem(List=brep_wireframe, Index=Slider(7, range=0..10), Wrap=True)  # -> Item, Item1
list_item_4 = ListItem(List=brep_wireframe, Index=Slider(6, range=0..10), Wrap=True)
list_item_5 = ListItem(List=move_3.Geometry, Index=0, Wrap=True)  # -> Item, Item1, Item2, Item3
join_curves = JoinCurves(Curves=[list_item_3.Item, list_item_3.Item1], Preserve=False)
c_script_2 = CSharpScript(pointOne=item_6.Item, pointTwo=item_6.Item1)  # -> pointOut; inputs pointOne: Point3d, pointTwo: Point3d
# ---------- c_script_2: C# ----------
    double slope = gradient(pointOne, pointTwo);

    Point3d point = new Point3d();

    if( slope <= 0.0 )
    {

      point.X = Math.Max(pointOne.X, pointTwo.X);
      point.Y = Math.Max(pointOne.Y, pointTwo.Y);

    }

    else
    {

      point.X = Math.Min(pointOne.X, pointTwo.X);
      point.Y = Math.Max(pointOne.Y, pointTwo.Y);

    }

    pointOut = point;
# ---------- c_script_2: C# additional code ----------
  private double gradient(Point3d pointOne, Point3d pointTwo)
  {

    double y = pointTwo.Y - pointOne.Y;
    double x = pointTwo.X - pointOne.X;

    return y / x;

  }
# ---------- end c_script_2 ----------
c_script_3 = CSharpScript(pointOne=item_6.Item1, pointTwo=item_6.Item2)  # -> pointOut; inputs pointOne: Point3d, pointTwo: Point3d; same code as c_script_2
line = Line(StartPoint=[list_item_5.Item, list_item_5.Item2], EndPoint=[list_item_5.Item1, list_item_5.Item3])
curve_closest_point_3 = CurveClosestPoint(Point=flatten(pt_2), Curve=join_curves)  # -> flatten(Point), Parameter, Distance
deconstruct_2 = Deconstruct(Point=curve_closest_point_3.Point)  # -> XComponent, YComponent, ZComponent
curve_closest_point_4 = CurveClosestPoint(Point=flatten(pt_2), Curve=list_item_4)  # -> flatten(Point), Parameter, Distance
deconstruct_3 = Deconstruct(Point=curve_closest_point_4.Point)  # -> XComponent, YComponent, ZComponent
sort_list_2 = SortList(Keys=deconstruct_2.XComponent, ValuesValuesA=curve_closest_point_3.Point)  # -> Keys, ValuesValuesA
sort_list_3 = SortList(Keys=deconstruct_3.YComponent, ValuesValuesA=curve_closest_point_4.Point)  # -> Keys, ValuesValuesA
curve_curve = CurveCurve(CurveA=line, CurveB=runion)  # -> Points, ParamsA, ParamsB
shift_list = ShiftList(List=curve_closest_point_4.Point, Shift=1, Wrap=True)
list_item_6 = ListItem(List=sort_list_2.ValuesValuesA, Index=0, Wrap=True)  # -> Item, Item1, Item2
list_item_7 = ListItem(List=sort_list_3.ValuesValuesA, Index=0, Wrap=True)  # -> Item, Item1, Item2
vector_2pt = Vector2Pt(PointA=curve_closest_point_4.Point, PointB=shift_list, Unitize=False)  # -> Vector, Length
distance = Distance(PointA=item_6.Item, PointB=c_script_2)
distance_2 = Distance(PointA=item_6.Item1, PointB=c_script_3)
list_item_8 = ListItem(List=curve_curve.Points, Index=0, Wrap=True)  # -> Item, Item1
line_2 = Line(StartPoint=list_item_6.Item1, EndPoint=list_item_6.Item2)
line_3 = Line(StartPoint=list_item_7.Item1, EndPoint=list_item_7.Item2)
distance_3 = Distance(PointA=list_item_6.Item, PointB=list_item_6.Item1)
line_4 = Line(StartPoint=list_item_6.Item, EndPoint=list_item_6.Item1)
distance_4 = Distance(PointA=list_item_7.Item, PointB=list_item_7.Item1)
distance_5 = Distance(PointA=list_item_6.Item1, PointB=list_item_6.Item2)
distance_6 = Distance(PointA=list_item_7.Item1, PointB=list_item_7.Item2)
line_5 = Line(StartPoint=list_item_7.Item, EndPoint=list_item_7.Item1)
number_slider_29 = Slider(24.676, range=0..30)
number_slider_30 = Slider(0.6, range=0..1)
number = Number([distance_4, distance_6])
number_slider_31 = Slider(0.4, range=0..1)
number_slider_32 = Slider(1, range=0..2)
line_6 = Line(StartPoint=list_item_8.Item, EndPoint=list_item_8.Item1)  # -> simplify(Line)
number_slider_33 = Slider(0.3, range=0..1)
dom_8 = ConstructDomain(DomainStart=expr("-x", number_slider_29), DomainEnd=number_slider_29)
number_slider_34 = Slider(1, range=0..2)
subtraction_2 = Subtraction(A=Slider(1, range=0..1.4), B=number_slider_30)
golden_ratio = GoldenRatio(Factor=1)
path_mapper = PathMapper(line_6, source="{A;B}", target="{A}")
tree_branch = TreeBranch(Tree=path_mapper, Path="{1}", MaintainPaths=True)
plane = Plane(pln)
golden_ratio_2 = GoldenRatio(Factor=1)
subtraction_3 = Subtraction(A=number_slider_32, B=number_slider_31)
subtraction_4 = Subtraction(A=number_slider_32, B=number_slider_33)
multiplication_2 = Multiplication(A=distance_2, B=Slider(0.7, range=0..1))
multiplication_3 = Multiplication(A=distance, B=subtraction_2)
subtraction_5 = Subtraction(A=distance_2, B=multiplication_3)
multiplication_4 = Multiplication(A=distance, B=number_slider_30)
explode_tree_2 = ExplodeTree(Data=plane)  # -> Branch0, Branch1, Branch2
length = Length(Curve=path_mapper)
multiplication_5 = Multiplication(A=distance_3, B=number_slider_31)
subtraction_6 = Subtraction(A=multiplication_5, B=distance_5)
multiplication_6 = Multiplication(A=distance_3, B=subtraction_3)
multiplication_7 = Multiplication(A=distance_4, B=number_slider_33)
subtraction_7 = Subtraction(A=multiplication_7, B=distance_6)
multiplication_8 = Multiplication(A=distance_4, B=subtraction_4)
curve_closest_point_5 = CurveClosestPoint(Point=pt_3, Curve=reparameterize(path_mapper))  # -> simplify(Point), Parameter, Distance
dom_9 = ConstructDomain(DomainStart=expr("-x", multiplication_3), DomainEnd=multiplication_3)
dom_10 = ConstructDomain(DomainStart=expr("-x", multiplication_4), DomainEnd=multiplication_4)
dom_11 = ConstructDomain(DomainStart=expr("-x", subtraction_5), DomainEnd=subtraction_5)
construct_domain = ConstructDomain(DomainStart=expr("-x", multiplication_6), DomainEnd=multiplication_6)
construct_domain_2 = ConstructDomain(DomainStart=expr("-x", multiplication_5), DomainEnd=multiplication_5)
construct_domain_3 = ConstructDomain(DomainStart=expr("-x", multiplication_8), DomainEnd=multiplication_8)
construct_domain_4 = ConstructDomain(DomainStart=expr("-x", multiplication_7), DomainEnd=multiplication_7)
rectangle_2 = Rectangle(Plane=[item_5.Item, item_5.Item1], XSize=dom_8, YSize=[dom_9, dom_10], Radius=0)  # -> Rectangle, Length
dom_12 = ConstructDomain(DomainStart=expr("-x", subtraction_6), DomainEnd=subtraction_6)
dom_13 = ConstructDomain(DomainStart=expr("-x", subtraction_7), DomainEnd=subtraction_7)
domain = Domain([construct_domain_2, construct_domain, dom_12])
domain_2 = Domain([construct_domain_4, construct_domain_3, dom_13])
number_2 = Number(length)
list_item_9 = ListItem(List=number_2, Index=0, Wrap=True)  # -> Item, Item1
list_item_10 = ListItem(List=curve_closest_point_5.Parameter, Index=0, Wrap=True)  # -> Item, Item1
subtraction_8 = Subtraction(A=Slider(1, range=0..1), B=list_item_10.Item1)
subtraction_9 = Subtraction(A=Slider(1, range=0..1), B=list_item_10.Item)
multiplication_9 = Multiplication(A=list_item_10.Item, B=list_item_9.Item)
multiplication_10 = Multiplication(A=subtraction_8, B=list_item_9.Item1)
multiplication_11 = Multiplication(A=subtraction_9, B=list_item_9.Item)
multiplication_12 = Multiplication(A=list_item_10.Item1, B=list_item_9.Item1)
plane_2 = Plane(pl)
rectangle_3 = Rectangle(Plane=flatten(plane_2), XSize=domain, YSize=domain_2, Radius=0)  # -> Rectangle, Length
dom_14 = ConstructDomain(DomainStart=expr("-x", multiplication_11), DomainEnd=multiplication_9)
dom_15 = ConstructDomain(DomainStart=expr("-x", multiplication_10), DomainEnd=multiplication_12)
rectangle_4 = Rectangle(Plane=plane_2, XSize=dom_15, YSize=dom_14, Radius=0)  # -> Rectangle, Length
genelist_h = GenePool(Decimals=2, Maximum=1, Minimum=0.5, Value=[0.61, 0.52, 0.52])
genelist_g = GenePool(Decimals=2, Maximum=1, Minimum=0.5, Value=[0.56, 0.87, 0.51])
minwidth_height = CSharpScript(x=rectangle_4.Rectangle, y=Slider(25, range=0..100))  # -> A; inputs x: tree of Rectangle3d, y: Double
# ---------- minwidth_height: C# ----------
    int branchCount = x.BranchCount;

    int penal = 0;

    for( int i = 0; i < branchCount; ++i )
    {

      double width = x.Branch(i)[0].Width;
      double height = x.Branch(i)[0].Height;

      if( width <= y )
        
        penal -= 200;
      
      if( height <= y  )

        penal -= 200;
        
    }

    A = penal;
# ---------- end minwidth_height ----------
panel_2 = Panel(minwidth_height)
scale_nu = ScaleNU(Geometry=rectangle_4.Rectangle, Plane=plane_2, ScaleX=graft(genelist_g), ScaleY=graft(genelist_h), ScaleZ=1)  # -> Geometry, Transform

# ---- group: CreateOurInitialFloorPlan
rectangle_5 = Rectangle(Plane=pl, XSize=Domain(-1, 1), YSize=Domain(-2, 2), Radius=0)  # -> Rectangle, Length; disabled
flatten = FlattenTree(Tree=scale_nu.Geometry, Path="{0}")
graft_2 = GraftTree(Tree=flatten, IncludeEmptyLists=True, IncludeNullItems=True)
rint = RegionIntersection(CurvesA=runion, CurvesB=graft_2)  # -> simplify(Result)
c_script_4 = CSharpScript(x=rint)  # -> A; inputs x: tree of Polyline
# ---------- c_script_4: C# ----------
    var treeOut = new DataTree<Polyline>();

    for( int i = 0; i < x.BranchCount; ++i )
      for( int j = 0; j < x.Branch(i).Count; ++j )
      {

        treeOut.Add(x.Branch(i)[j], new GH_Path(i));

      }

    A = treeOut;
# ---------- end c_script_4 ----------
crv_6 = Curve(simplify(c_script_4))

# ----
panel_3 = Panel(rint)
rectangle_6 = Rectangle(Plane=flatten(PlaneXY(0, 0, 0)), XSize=c_script, YSize=c_script, Radius=0)  # -> Rectangle, Length; disabled

# ---- group: Commercial / Floors
number_slider_35 = Slider(0.5, range=0..1)
pt_4 = ConstructPoint(XCoordinate=number_slider_35, YCoordinate=number_slider_35, ZCoordinate=0)
move_4 = Move(Geometry=runion, Motion=Z_3)  # -> simplify(Geometry), Transform
c_script_5 = CSharpScript(x=move_4.Geometry)  # -> A; inputs x: tree of Polyline
# ---------- c_script_5: C# ----------
    var treeOut = new DataTree<Polyline>();

    for( int i = 0; i < 1; ++i )
      for( int j = 0; j < x.Branch(i).Count; ++j )
      {

        treeOut.Add(x.Branch(i)[j], new GH_Path(i));

      }

    A = treeOut;
# ---------- end c_script_5 ----------
evalsrf = EvaluateSurface(Surface=reparameterize(c_script_5), Point=pt_4)  # -> Point, Normal, UDirection, VDirection, Frame
runion_2 = RegionUnion(Curves=flatten(move_4.Geometry), Plane=flatten(evalsrf.Point))  # -> simplify(Result)
frgb_3 = ColourRGBF(Alpha=Slider(1, range=0..1), Red=Slider(1, range=0..1), Green=Slider(1, range=0..1), Blue=Slider(0, range=0..1))
srf_5 = Surface(runion_2)
preview_2 = CustomPreview(Geometry=srf_5, Material=frgb_3)

# ---- group: Commercial / Volume
flip = FlipMatrix(Data=runion_2)
lng_3 = ListLength(List=flip)
item_7 = ListItem(List=flip, Index=expr("x-1", lng_3), Wrap=True)
Z_5 = UnitZ(Factor=number_slider_18)
move_5 = Move(Geometry=item_7, Motion=Z_5)  # -> Geometry, Transform
loft_2 = Loft(
    Curves=[flip, move_5.Geometry],
    Options={Adjust=False, Closed=False, LoftEnds=0, LoftSimp=0, LoftType=0, Rebuild=10, Refit=0.01})
cap_2 = CapHoles(Brep=loft_2)
frgb_4 = ColourRGBF(Alpha=centipede_5, Red=Slider(1, range=0..1), Green=Slider(0.587, range=0..1), Blue=Slider(0, range=0..1))
previewoffice = CustomPreview(Geometry=cap_2, Material=frgb_4)

# ---- group: Fitness / RectangularFloorPlans
crv_7 = Curve(crv_6)
disc_2 = Discontinuity(Curve=crv_7, Level=1)  # -> Points, Parameters
lng_4 = ListLength(List=disc_2.Points)
expression_7 = Expression(x=lng_4, y=Slider(4, range=0..10), Expression="If( x ≠ y, -50, 0 )")  # -> flatten(R)
panel_4 = Panel(expression_7)

# ---- group: Fitness / NoSmallBuildings
area_3 = Area(Geometry=crv_6)  # -> Area, Centroid
expression_8 = Expression(x=area_3.Area, y=Slider(400, range=0..1000), Expression="If( x < y, -2, 0 )")  # -> flatten(R)
panel_5 = Panel(expression_8)

# ---- group: Office
genelist_e = GenePool(Decimals=0, Maximum=40, Minimum=10, Value=[20, 25, 31])
item_8 = ListItem(List=series_2, Index=expr("x-1", number_slider_19), Wrap=True)
addition_2 = Addition(A=number_slider_18, B=item_8)
series_3 = Series(Start=addition_2, Step=Slider(3.8, range=0..10), Count=graft(genelist_e))  # -> simplify(Series)
Z_6 = UnitZ(Factor=series_3)  # -> simplify(UnitVector)
move_6 = Move(Geometry=crv_6, Motion=Z_6)  # -> simplify(Geometry), Transform
sortbranchaccordingtoheight = CSharpScript(x=move_6.Geometry)  # -> A, B, C; inputs x: tree of Polyline
# ---------- sortbranchaccordingtoheight: C# ----------
    int count = x.BranchCount;

    var treeOut = new DataTree<Polyline>();
    var itemsOfBranch = new int[count];
    var index = new int[count];

    for( int i = 0; i < count; ++i )
    {

      itemsOfBranch[i] = x.Branch(i).Count;
      index[i] = i;

    }

    Array.Sort(itemsOfBranch, index);

    for( int i = 0; i < count; ++i )
    {

      treeOut.AddRange(x.Branch(index[i]), new GH_Path(i));

    }

    A = treeOut;
    B = itemsOfBranch;
    C = count;
# ---------- end sortbranchaccordingtoheight ----------
prune = PruneTree(Tree=sortbranchaccordingtoheight.A, Minimum=Slider(1, range=0..1), Maximum=0)
number_slider_36 = Slider(0.5, range=0..1)
path_mapper_2 = PathMapper(prune, source="{A}", target="{path_index}")
pt_5 = ConstructPoint(XCoordinate=number_slider_36, YCoordinate=number_slider_36, ZCoordinate=0)
evalsrf_2 = EvaluateSurface(Surface=reparameterize(path_mapper_2), Point=pt_5)  # -> Point, Normal, UDirection, VDirection, Frame
crv_8 = Curve(path_mapper_2)
colmm = CollisionManyMany(Colliders=flatten(crv_8))  # -> Collision, Indices
ma_3 = MassAddition(Input=colmm.Collision)  # -> Result, PartialResults
unit_z_2 = UnitZ(Factor=Slider(0.1, range=0..1))

# ----
floorsandvolumes = FloorsAndVolumes(Points=evalsrf_2.Point, Frames=evalsrf_2.Frame, Collisions=ma_3.Result, Curves=crv_8)  # -> Floors, Volumes, NumberOfBranches

# ---- group: Office / Floors
area_4 = Area(Geometry=flatten(floorsandvolumes.Floors), UseTasks=True)  # -> Area, Centroid
srf_6 = Surface(floorsandvolumes.Floors)
ma_4 = MassAddition(Input=area_4.Area)  # -> Result, PartialResults
frgb_5 = ColourRGBF(
    Alpha=Slider(0.426, range=0..1),
    Red=Slider(1, range=0..1),
    Green=Slider(0.071, range=0..1),
    Blue=Slider(0.04, range=0..1))
preview_3 = CustomPreview(Geometry=srf_6, Material=frgb_5)

# ---- group: Fitness / DifferenceBetweenNumberOfFloors
int = Integer(genelist_e)
crossref = CrossReference(ListA=int, ListB=int, CrossMode=2)  # -> graft(ListA), graft(ListB)
int_2 = Integer(simplify([crossref.ListA, crossref.ListB]))
item_9 = ListItem(List=int_2, Index=0, Wrap=True)  # -> Item, Item1
subtraction_10 = Subtraction(A=item_9.Item, B=item_9.Item1)  # -> flatten(Result)
expression_9 = Expression(x=subtraction_10, y=Slider(5, range=0..10), Expression="If( Abs( x ) < y, -5, 0 )")
nullrep = ReplaceNulls(Items=expression_9, Replacements=Slider(0, range=0..100))  # -> Items, Count
panel_6 = Panel(nullrep.Items)

# ---- group: Fitness / CloseToEachOtherOffice
flip_2 = FlipMatrix(Data=crv_8)
c_script_6 = CSharpScript(x=flip_2)  # -> A; inputs x: tree of Polyline; same code as c_script_5
crossref_2 = CrossReference(ListA=c_script_6, ListB=c_script_6, CrossMode=2)  # -> graft(ListA), graft(ListB)
crv_9 = Curve([crossref_2.ListA, crossref_2.ListB])
item_10 = ListItem(List=crv_9, Index=0, Wrap=True)  # -> simplify(Item), simplify(Item1)
number_slider_37 = Slider(0.001, range=0..0.001)
crvprox = CurveProximity(CurveA=item_10.Item, CurveB=item_10.Item1)  # -> PointA, PointB, Distance
nullrep_2 = ReplaceNulls(Items=crvprox.Distance, Replacements=number_slider_37)  # -> Items, Count
expression_10 = Expression(x=nullrep_2.Items, y=number_slider_37, z=Slider(3.4, range=0..10), Expression="If( x < z, If( x > y, -7, 0 ), 0 ) ")  # -> flatten(R)
panel_7 = Panel(expression_10)

# ---- group: Fitness / NoOverlappingGeo
crossref_3 = CrossReference(ListA=c_script_6, ListB=c_script_6, CrossMode=2)  # -> graft(ListA), graft(ListB); disabled
crv_10 = Curve(simplify([crossref_3.ListA, crossref_3.ListB]))  # disabled
sdivide_2 = DivideSurface(Surface=crv_10, UCount=10, VCount=10)  # -> simplify(Points), Normals, Parameters; disabled
path_mapper_3 = PathMapper(sdivide_2.Points, source="{A;B;C}", target="{A}")  # disabled
null_2 = NullItem(Item=path_mapper_3)  # -> NullFlags, InvalidFlags, Description; disabled
cull_2 = CullPattern(List=path_mapper_3, CullPattern=invert(null_2.NullFlags))  # disabled
pt_6 = Point(cull_2)  # disabled
number_slider_38 = Slider(15, range=0..100)  # disabled
number_slider_39 = Slider(30, range=0..100)  # disabled
item_11 = ListItem(List=crv_10, Index=0, Wrap=True)  # -> Item, Item1; disabled
lng_5 = ListLength(List=pt_6)  # disabled
multiplication_13 = Multiplication(A=lng_5, B=0.5)  # disabled
split = SplitList(List=pt_6, Index=multiplication_13)  # -> simplify(ListA), simplify(ListB); disabled
crv_11 = Curve(item_11.Item)  # disabled
pt_7 = Point(split.ListB)  # disabled
pointinclusion = CSharpScript(pts=pt_7, crv=crv_11)  # -> flatten(A); inputs pts: list of Point3d, crv: Polyline; disabled
# ---------- pointinclusion: C# ----------
    int penalize = 0;

    System.Threading.Tasks.Parallel.ForEach(pts, pt =>
      {

      if( IsInside(pt, crv) )
      {

        System.Threading.Interlocked.Decrement( ref penalize );

      }

      }
      );

    A = penalize;
# ---------- pointinclusion: C# additional code ----------
  bool IsInside (Point3d pt, Polyline crv)
  {
    Point3d pt1, pt2;
    bool oddNodes = false;

    for (int i = 0; i < crv.SegmentCount; i++) //for each contour line
    {

      pt1 = crv.SegmentAt(i).From; //get start and end pt
      pt2 = crv.SegmentAt(i).To;

      if ( (pt1[1] < pt[1] && pt2[1] >= pt[1] || pt2[1] < pt[1] && pt1[1] >= pt[1]) && (pt1[0] <= pt[0] || pt2[0] <= pt[0]) ) //if pt is between pts in y, and either of pts is before pt in x
        oddNodes ^= ( pt2[0] + (pt[1] - pt2[1]) * (pt1[0] - pt2[0]) / (pt1[1] - pt2[1]) < pt[0] ); //^= is xor
      //end.X + (pt-end).Y   * (start-end).X  /(start-end).Y   <   pt.X
    }


    if (!oddNodes)
    {
      double minDist = 1e10;
      for (int i = 0; i < crv.SegmentCount; i++) {
        Point3d cp = crv.SegmentAt(i).ClosestPoint(pt, true);
        //Point3d cp = mvContour[i].closestPoint(pt);
        //minDist = min(minDist, cp.distance(pt));
        minDist = Math.Min(minDist, cp.DistanceTo(pt));
      }
      if (minDist < 1e-10)
        return true;
    }

    if(oddNodes) return true;

    return false;
  }
# ---------- end pointinclusion ----------
expression_11 = Expression(x=pointinclusion, y=number_slider_38, z=number_slider_39, Expression="If( ( x ≥ y ) And ( x ≤ z ), 0, -10 )")  # disabled
panel_8 = Panel(pointinclusion)  # disabled
panel_9 = Panel(expression_11)  # disabled

# ---- group: Fitness / TotalArea
area_5 = Area(Geometry=flatten(runion_2), UseTasks=False)  # -> Area, Centroid
ma_5 = MassAddition(Input=area_5.Area)  # -> Result, PartialResults
addition_3 = Addition(A=ma.Result, B=ma_5.Result)
addition_4 = Addition(A=addition_3, B=ma_4.Result)
panel_10 = Panel(addition_3)
expression_12 = Expression(
    x=addition_4,
    y=Slider(83000, range=0..100000),
    z=Slider(85799, range=0..100000),
    Expression="If( ( x ≤ z ) And ( x ≥ y ), 0, -100 )")  # -> flatten(Result)
panel_11 = Panel(addition_4)

# ---- group: PenalizeFloorPlan
flip_matrix = FlipMatrix(Data=floorsandvolumes.Floors)
c_script_7 = CSharpScript(x=flip_matrix)  # -> A; inputs x: tree of Polyline; same code as c_script_5
disc_3 = Discontinuity(Curve=c_script_7, Level=1)  # -> Points, Parameters
lng_6 = ListLength(List=disc_3.Points)
expression_13 = Expression(x=lng_6, y=Slider(4, range=0..10), Expression="If( x ≠ y, -50, 0 )")  # -> flatten(R)
panel_12 = Panel(expression_13)

# ----
point_within_curve = PointWithinCurve(pts=pt_7, crv=crv_11)  # -> out, A, B; inputs pts: list of Point3d, crv: Polyline; disabled
# ---------- point_within_curve: C# ----------
    var inside = new List<Point3d>();
    var outside = new List<Point3d>();

    foreach (Point3d pt in pts)
    {
      if(IsInside(pt, crv))
      {
        inside.Add(pt);
      }
      else outside.Add(pt);
    }
    A = inside;
    B = outside;
# ---------- point_within_curve: C# additional code ----------
  bool IsInside (Point3d pt, Polyline crv)
  {
    Point3d pt1, pt2;
    bool oddNodes = false;

    for (int i = 0; i < crv.SegmentCount; i++) //for each contour line
    {

      pt1 = crv.SegmentAt(i).From; //get start and end pt
      pt2 = crv.SegmentAt(i).To;

      if ( (pt1[1] < pt[1] && pt2[1] >= pt[1] || pt2[1] < pt[1] && pt1[1] >= pt[1]) && (pt1[0] <= pt[0] || pt2[0] <= pt[0]) ) //if pt is between pts in y, and either of pts is before pt in x
        oddNodes ^= ( pt2[0] + (pt[1] - pt2[1]) * (pt1[0] - pt2[0]) / (pt1[1] - pt2[1]) < pt[0] ); //^= is xor
      //end.X + (pt-end).Y   * (start-end).X  /(start-end).Y   <   pt.X
    }


    if (!oddNodes)
    {
      double minDist = 1e10;
      for (int i = 0; i < crv.SegmentCount; i++) {
        Point3d cp = crv.SegmentAt(i).ClosestPoint(pt, true);
        //Point3d cp = mvContour[i].closestPoint(pt);
        //minDist = min(minDist, cp.distance(pt));
        minDist = Math.Min(minDist, cp.DistanceTo(pt));
      }
      if (minDist < 1e-10)
        return true;
    }

    if(oddNodes) return true;

    return false;
  }
# ---------- end point_within_curve ----------
point_12 = Point(point_within_curve.A)  # disabled
point_13 = Point(point_within_curve.B)  # disabled

# ---- group: Office / Volumes
number_slider_40 = Slider(0.436, range=0..1)
brep = Brep(floorsandvolumes.Volumes)
frgb_6 = ColourRGBF(
    Alpha=centipede_4,
    Red=[Slider(0.618, range=0..1), Slider(0, range=0..1), Slider(0, range=0..1)],
    Green=[Slider(0.103, range=0..1), Slider(0.561, range=0..1), Slider(0, range=0..1)],
    Blue=[Slider(1, range=0..1), Slider(0.711, range=0..1), Slider(0.438, range=0..1)])  # -> simplify(graft(Colour))
prunecolours = CSharpScript(colours=frgb_6, branchCount=floorsandvolumes.NumberOfBranches)  # -> prunedTree; inputs colours: tree, branchCount: Int32
# ---------- prunecolours: C# ----------
    switch( branchCount )
    {

      case 1:

        colours.RemovePath(1);
        colours.RemovePath(2);

        break;

      case 2:

        colours.RemovePath(2);

        break;

    }

    prunedTree = colours;
# ---------- end prunecolours ----------

# ---- group: Office (continued)
move_7 = Move(Geometry=brep, Motion=unit_z_2)  # -> Geometry, Transform

# ---- group: Office / Volumes (continued)
previewbuildings = CustomPreview(Geometry=move_7.Geometry, Material=prunecolours)

# ---- group: Fitness / NoFloatingOfficeBuildings
srf_7 = Surface(<surface referenced from the Rhino model>)
rint_2 = RegionIntersection(CurvesA=srf_4, CurvesB=srf_7)
crv_12 = Curve(rint_2)
offset = OffsetCurve(Curve=crv_12, Distance=Slider(2, range=0..10), Plane=PlaneXY(0, 0, 0), Corners=1)
project = Project(Geometry=crv_8, Plane=PlaneXY(0, 0, 0))  # -> Geometry, Transform
disc_4 = Discontinuity(Curve=flatten(offset), Level=1)  # -> Points, Parameters
rint_3 = RegionIntersection(CurvesA=offset, CurvesB=project.Geometry)
item_12 = ListItem(List=disc_4.Points, Index=0, Wrap=True)  # -> Item, Item1, Item2
disc_5 = Discontinuity(Curve=rint_3, Level=3)  # -> simplify(Points), Parameters
sortbranchaccordingtonumberofpoints = CSharpScript(x=disc_5.Points)  # -> A, B, C; inputs x: tree of Point3d
# ---------- sortbranchaccordingtonumberofpoints: C# ----------
    int count = x.BranchCount;

    var treeOut = new DataTree<Point3d>();
    var itemsOfBranch = new int[count];
    var index = new int[count];

    for( int i = 0; i < count; ++i )
    {

      itemsOfBranch[i] = x.Branch(i).Count;
      index[i] = i;

    }

    Array.Sort(itemsOfBranch, index);

    for( int i = 0; i < count; ++i )
    {

      treeOut.AddRange(x.Branch(index[i]), new GH_Path(i));

    }

    A = treeOut;
    B = itemsOfBranch;
    C = count;
# ---------- end sortbranchaccordingtonumberofpoints ----------
pdecon = Deconstruct(Point=disc_5.Points)  # -> XComponent, YComponent, ZComponent
ln = Line(StartPoint=item_12.Item1, EndPoint=item_12.Item2)
dist = Distance(PointA=item_12.Item1, PointB=item_12.Item2)
path = ConstructPath(Indices=expr("x-1", sortbranchaccordingtonumberofpoints.C))
addition_5 = Addition(A=pdecon.XComponent, B=Slider(1000, range=0..1000))
multiplication_14 = Multiplication(A=pdecon.YComponent, B=addition_5)
branch = TreeBranch(Tree=sortbranchaccordingtonumberofpoints.A, Path=path, MaintainPaths=True)
sort = SortList(Keys=multiplication_14, ValuesA=disc_5.Points)  # -> Keys, ValuesA
round = Round(Number=dist)  # -> Nearest, Floor, Ceiling

# ----
lng_7 = ListLength(List=branch)
item_13 = ListItem(List=sort.ValuesA, Index=expr("x-2", lng_7), Wrap=True)
item_14 = ListItem(List=sort.ValuesA, Index=expr("x-1", lng_7), Wrap=True)

# ---- group: Fitness / NoFloatingOfficeBuildings (continued)
dist_2 = Distance(PointA=item_13, PointB=item_14)
ln_2 = Line(StartPoint=item_13, EndPoint=item_14)
nullrep_3 = ReplaceNulls(Items=dist_2, Replacements=dist)  # -> Items, Count
round_2 = Round(Number=nullrep_3.Items)  # -> Nearest, Floor, Ceiling
expression_14 = Expression(x=round.Nearest, y=round_2.Nearest, Expression="If( x = y, 0, -50 )")  # -> flatten(R)
panel_13 = Panel(expression_14)

# ---- group: Fitness
ma_6 = MassAddition(Input=flatten([expression_7, expression_8, expression_14, expression_12, nullrep.Items, expression_10, pointinclusion, minwidth_height, expression_13]))  # -> Result, PartialResults
panel_14 = Panel(ma_6.Result)

# ==== cluster ReparametrizeCurve
curve = ClusterInput()
discontinuity = Discontinuity(Curve=curve, Level=1)  # -> Points, Parameters
area = Area(Geometry=curve, UseTasks=False)  # -> Area, Centroid
list_item = ListItem(List=discontinuity.Points, Index=0, Wrap=True)  # -> Item, Item1, Item2, Item3
point = Point(list_item.Item)
point_2 = Point(list_item.Item1)
point_3 = Point(list_item.Item2)
point_4 = Point(list_item.Item3)
point_5 = Point(area.Centroid)
vector_2pt = Vector2Pt(PointA=point, PointB=point_2, Unitize=False)  # -> Vector, Length
vector_2pt_2 = Vector2Pt(PointA=point, PointB=point_5, Unitize=False)  # -> Vector, Length
move = Move(Geometry=point_5, Motion=expr("x*0.5", vector_2pt.Vector))  # -> Geometry, Transform
move_2 = Move(Geometry=point, Motion=expr("x*0.5", vector_2pt_2.Vector))  # -> Geometry, Transform
move_3 = Move(Geometry=point, Motion=expr("x*0.5", vector_2pt.Vector))  # -> Geometry, Transform
domain_start = ClusterInput()
domain_end = ClusterInput()
domain_start_2 = ClusterInput()
domain_end_2 = ClusterInput()
construct_domain = ConstructDomain(DomainStart=expr("-x", domain_start), DomainEnd=domain_end)
construct_domain_2 = ConstructDomain(DomainStart=expr("-x", domain_start_2), DomainEnd=domain_end_2)
plane_3pt = Plane3Pt(PointA=point_5, PointB=move_3.Geometry, PointC=move.Geometry)
domain = ClusterOutput(construct_domain)
domain_2 = ClusterOutput(construct_domain_2)
plane = ClusterOutput(plane_3pt)
